# Grasshopper definition 0_MultiSpanBeams.gh (Grasshopper 1.0.7)
# plug-ins: Alpaca4d

# ---- group: Element
data = Data(0)
data_2 = Data(0)

# ---- group: Load
# instagram:    Alpaca4d
# facebook:     Alpaca4d
# mail:         alpaca4d@gmail.com
data_3 = Data(0)
data_4 = Data(0)

# ---- group: Cross-Section
data_5 = Data(0)
data_6 = Data(0)

# ---- group: Support
data_7 = Data(0)
data_8 = Data(0)

# ----
construct_point = ConstructPoint(XCoordinate=0, YCoordinate=0, ZCoordinate=0)
unit_x = UnitX(Factor=Slider(50, range=0..100))
move = Move(Geometry=construct_point, Motion=unit_x)  # -> Geometry, Transform
ln = Line(StartPoint=construct_point, EndPoint=move.Geometry)
genes = GenePool(Decimals=2, Maximum=1, Minimum=0, Value=[0.2010812835, 0.4448275643, 0.8612168584])
shatter = Shatter(Curve=ln, Parameters=genes)
explode = Explode(Curve=shatter, Recursive=True)  # -> flatten(Segments), Vertices

# ---- group: Material
data_9 = Data(0)
data_10 = Data(0)

# ---- group: Constraint
data_11 = Data(0)
data_12 = Data(0)

# ---- group: Material
uniaxialmaterial_alpaca4d = UniaxialMaterialAlpaca4d(MatName="Concrete", E=210000, V=0.3, MarshallingSignalParameter=78.5, MarshallingSignalParameter_2=23.5)

# ---- group: Cross-Section
double_t_section_alpaca4d = DoubleTSectionAlpaca4d(
    MarshallingSignalParameter="IPE",
    Bsup="400",
    Binf="400",
    H="1000",
    Tsup="20",
    Tinf="20",
    Tw="20",
    MarshallingSignalParameter_2=uniaxialmaterial_alpaca4d)

# ---- group: Support
cullpt = CullDuplicates(Points=flatten(explode.Vertices), Tolerance=0.1, CullMode=1)  # -> Points, Indices, Valence
boolean_toggle = BooleanToggle(True)
boolean_toggle_2 = BooleanToggle(False)
support_alpaca4d = SupportAlpaca4d(
    Pos=cullpt.Points,
    Tx=boolean_toggle,
    Ty=boolean_toggle,
    Tz=boolean_toggle,
    Rx=boolean_toggle,
    Ry=boolean_toggle_2,
    Rz=boolean_toggle_2)

# ---- group: Load
vector_xyz = VectorXYZ(XComponent=0, YComponent="-300", ZComponent=0)  # -> Vector, Length
linear_load_alpaca4d = LinearLoadAlpaca4d(Force=vector_xyz.Vector, Element=explode.Segments, Orientation="1")

# ---- group: Element
crv = Curve(explode.Segments)
line_to_beam_alpaca4d = LineToBeamAlpaca4d(Line=crv, MarshallingSignalParameter=ColourSwatch(SwatchColor=RGB(0, 237, 40)), CrossSection=double_t_section_alpaca4d)

# ----
assemble_model_alpaca_4d = AssembleModelAlpaca4d(Element=flatten(line_to_beam_alpaca4d), Support=flatten(support_alpaca4d), Load=flatten(linear_load_alpaca4d))  # -> AlpacaModel, MassOfStructure
visualise_model_alpaca4d = VisualiseModelAlpaca4d(AlpacaModel=assemble_model_alpaca_4d.AlpacaModel, Model=Toggle(True))  # -> AlpacaModel, Model
dash = DashPattern(Curve=visualise_model_alpaca4d.Model, Pattern=Slider(0.15, range=0..1))  # -> Dashes, Gaps
static_analyses_alpaca4d = StaticAnalysesAlpaca4d(AlpacaModel=visualise_model_alpaca4d.AlpacaModel)

# ---- group: Post -Processing
gradientlibrary = GradientLibraryAlpaca4d(GradientIndex=Slider(12, range=0..12))  # -> reverse(ColorsList)
static_model_view = StaticModelViewAlpaca4d(
    AlpacaStaticOutput=static_analyses_alpaca4d,
    Scale=Slider(419, range=0..10000),
    ModelExtrude=Toggle(False),
    ColorList=gradientlibrary)  # -> ModelDisp, DisplacementRange
