# Grasshopper definition 5_VaultBeam_staticAnalysis.gh (Grasshopper 1.0.7)
# plug-ins: Kangaroo Components, Alpaca4d

# ---- group: Element
data = Data(0)
# instagram:    Alpaca4d
# facebook:     Alpaca4d
# mail:         alpaca4d@gmail.com
# instagram:    Alpaca4d
# facebook:     Alpaca4d
# mail:         alpaca4d@gmail.com
# instagram:    Alpaca4d
# facebook:     Alpaca4d
# mail:         alpaca4d@gmail.com
data_2 = Data(0)

# ---- group: Load
# instagram:    Alpaca4d
# facebook:     Alpaca4d
# mail:         alpaca4d@gmail.com
data_3 = Data(0)
data_4 = Data(0)

# ---- group: Cross-Section
data_5 = Data(0)
data_6 = Data(0)

# ---- group: Support
data_7 = Data(0)
data_8 = Data(0)

# ---- group: Material
data_9 = Data(0)
data_10 = Data(0)

# ---- group: Constraint
data_11 = Data(0)
data_12 = Data(0)

# ---- group: Model
mesh = Mesh(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)
refine = Refine(Mesh=mesh, Level=1)
medges = MeshEdges(Mesh=refine)  # -> NakedEdges, InteriorEdges, NonManifoldEdges
demesh = DeconstructMesh(Mesh=refine)  # -> Vertices, Faces, Colours, Normals
crv = Curve([medges.InteriorEdges, medges.NakedEdges])
duppt = RemoveDuplicatePts(Points=flatten(demesh.Vertices), Tolerance=0.01)
curve_beam = Curve(crv)
pdecon = Deconstruct(Point=duppt)  # -> XComponent, YComponent, ZComponent
equals = Equality(FirstNumber=pdecon.ZComponent, SecondNumber="0")  # -> Equality, Inequality
dispatch = Dispatch(List=duppt, DispatchPattern=equals.Equality)  # -> ListA, ListB

# ---- group: Material
uniaxialmaterial = UniaxialMaterialAlpaca4d(MatName="S235", E=210000, V=0.3, Rho=78.5, Fy=23.5)

# ---- group: Cross-Section
circular_cross_section = CircularCrossSectionAlpaca4d(SectionName="Circular", Diameter="300", Thickness="10", UniaxialMaterial=uniaxialmaterial)

# ---- group: Support
toggle = BooleanToggle(True)
toggle_2 = BooleanToggle(False)
pt = Point(dispatch.ListA)
support = SupportAlpaca4d(Pos=pt, Tx=toggle, Ty=toggle, Tz=toggle, Rx=toggle_2, Ry=toggle_2, Rz=toggle)

# ---- group: Load
vec = VectorXYZ(XComponent="0", YComponent=0, ZComponent="-40")  # -> Vector, Length
point_load = PointLoadAlpaca4d(Force=vec.Vector, Pos=dispatch.ListB)

# ---- group: Element
crv_2 = Curve(curve_beam)
line_to_beam = LineToBeamAlpaca4d(Line=crv_2, CrossSection=circular_cross_section)  # -> flatten(BeamWrapper)

# ----
assemble_model = AssembleModelAlpaca4d(Element=flatten(line_to_beam), Support=flatten(support), Load=flatten(point_load))  # -> AlpacaModel, MassOfStructure
visualise_model = VisualiseModelAlpaca4d(AlpacaModel=assemble_model.AlpacaModel, Model=Toggle(True), Support=Toggle(True), Load=Toggle(False))  # -> AlpacaModel, Model
dash = DashPattern(Curve=visualise_model.Model, Pattern=Slider(0.4, range=0..1))  # -> Dashes, Gaps
preview = CustomPreview(Geometry=dash.Dashes, Material=ColourSwatch(SwatchColor=RGB(0, 0, 0)))
static_analyses = StaticAnalysesAlpaca4d(AlpacaModel=visualise_model.AlpacaModel)

# ---- group: Post -Processing
gradientlibrary = GradientLibraryAlpaca4d(GradientIndex=Slider(1, range=1..12))
list = ValueList({"x": 0, "y": 1, "z": 2, "xyz": 3}, selected="xyz")
static_model_view = StaticModelViewAlpaca4d(AlpacaStaticOutput=static_analyses, Scale="50", ModelExtrude=Toggle(False), Direction=list, ColorList=gradientlibrary)  # -> ModelDisp, DisplacementRange
geo = Geometry(static_model_view.ModelDisp)

# ----
list_2 = ValueList({"N", "V1", "V2", "M1", "M2"}, selected="N")
reaction_forces = ReactionForcesAlpaca4d(AlpacaStaticOutput=static_analyses, ReactionForcesView=Toggle(True), Scale="20")  # -> TagPoints, ReactionForce, ReactionMoment
beam_force_diagram = BeamForceDiagramAlpaca4d(AlpacaStaticOutput=static_analyses, SectionForces=list_2)
node_displacement = NodeDisplacementAlpaca4d(AlpacaStaticOutput=static_analyses)  # -> Points, Trans, Rot
beam_displacement = BeamDisplacementAlpaca4d(AlpacaStaticOutput=static_analyses)  # -> TagElement, LocalTrans, LocalRot, GlobalTrans, GlobalRot
