# Grasshopper definition 3dPrintTest.gh (Grasshopper 1.0.7)
# plug-ins: MeshEdit Components, NGon 2, Alpaca4d, VoxelPrint, karambaGH

# Format Engineers CAD Information Issue Disclaimer
# 
# Project: PROJECT NAME
# 
# You should use this model for reference purposes only to assist in co-ordinating your work and is supplementary to formally issued drawings. Once the data is introduced into your own CAD or other system Format Engineers Ltd. can take no responsibility for its accuracy.
# 
# The last set of formally issued paper drawings are the contractual documents which represent the current stage of design development. If you have any queries, please contact the project CAD co-ordinator or the CAD Development Team.
# 
# Changes:
# 
# YYYY-MM-DD: Summary of changes
# 
# Usage notes:
# 
# This definition includes a basic implementation of Merbarki's Farthest Point Seeding algorithm (2005), adapted for tracing lines of principal curvature on NURBS surfaces. Requires modified Triangle.NET, if this isn't attached then... good luck! There are currently two main limitations: (a) this implementation measures density in parameter space, and (b) it doesn't include the dynamic refinement of density that Mebarki suggests.
brep = Brep(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)
voxelizer = BrepToVoxel(Brep=brep, VoxelSize="10", BeadWidth="30", LayerHeight="10")  # -> PointList, VoxelSettings
panel = Panel("10")
panel_2 = Panel("0.1")
division = Division(A="1", B="10")
rdpoints = RemoveDuplicatePointsKaramba3D(Point=flatten(voxelizer.PointList), LimitDistance=0.005)  # -> graft(OutPoint), Info, Indexes
rdpoints_2 = RemoveDuplicatePointsKaramba3D(Point=voxelizer.PointList, LimitDistance=0.005)  # -> OutPoint, Info, Indexes
panel_3 = Panel("{>1}")
concat = Concatenate(FragmentA="{<", FragmentB=Slider(20, range=1..20), FragmentC="}")
split = SplitTree(Data=simplify(rdpoints_2.OutPoint), Masks=flatten(concat))  # -> Positive, Negative
pt = Point(split.Positive)
voxels = Voxels(Points=graft(pt), Scale=division)
demesh = DeconstructMesh(Mesh=flatten(voxels))  # -> Vertices, Faces, Colours, Normals
rdpoints_3 = RemoveDuplicatePointsKaramba3D(Point=flatten(demesh.Vertices), LimitDistance=0.005)  # -> graft(OutPoint), Info, Indexes
pdecon = Deconstruct(Point=flatten(rdpoints_3.OutPoint))  # -> XComponent, YComponent, ZComponent

pt_2 = Point(flatten(rdpoints_3.OutPoint))
pdecon_2 = Deconstruct(Point=pt_2)  # -> XComponent, YComponent, ZComponent
bnd = Bounds(Numbers=pdecon_2.ZComponent)
dedomain = DeconstructDomain(Domain=bnd)  # -> Start, End
addition = Addition(A="0.01", B=dedomain.Start)
smaller = SmallerThan(FirstNumber=pdecon_2.ZComponent, SecondNumber=addition)  # -> SmallerThan, OrEqualTo

ndmaterial = NDMaterialAlpaca4d(MatName="S235", E=210000, V=0.3, Rho=78.5, Fy=23.5)
weldvertices = MeshWeldVertices(Mesh=voxels, Tolerance=0.01)  # -> RuntimeMessage, Mesh
smaller_2 = SmallerThan(FirstNumber=pdecon.ZComponent, SecondNumber="10")  # -> SmallerThan, OrEqualTo
cull = CullPattern(List=flatten(rdpoints_3.OutPoint), CullPattern=smaller_2.OrEqualTo)
brick_element = BrickElementAlpaca4d(Brick=flatten(weldvertices.Mesh), Colour=ColourSwatch(SwatchColor=RGB(255, 255, 255)), NDMaterial=ndmaterial)  # -> flatten(SolidWrapper)
Z = UnitZ(Factor="-10")
toggle = BooleanToggle(True)
Y = UnitY(Factor=Z)
dispatch = Dispatch(List=pt_2, DispatchPattern=smaller.SmallerThan)  # -> ListA, ListB
pt_3 = Point(dispatch.ListA)
pt_4 = Point(dispatch.ListB)
support = SupportAlpaca4d(Pos=pt_3, Tx=toggle, Ty=toggle, Tz=toggle, Rx=toggle, Ry=toggle, Rz=toggle)
point_load = PointLoadAlpaca4d(Force=Z, Pos=pt_4)
assemble_model = AssembleModelAlpaca4d(Element=flatten(brick_element), Support=flatten(support), Load=flatten(point_load))  # -> AlpacaModel, MassOfStructure
brick_stress = BrickStressAlpaca4d()  # -> Brick, StressValue, StressRange; disabled
ndfanalyses = NDFAnalysesAlpaca4d(MarshallingSignalParameter=assemble_model.AlpacaModel)
gradientlibrary = GradientLibraryAlpaca4d(GradientIndex=11)  # -> reverse(ColorsList)
multiplication = Multiplication(A=Slider(207, range=1..1000), B="100")
static_model_view = StaticModelViewAlpaca4d(AlpacaStaticOutput=ndfanalyses, Scale=multiplication, ColorList=gradientlibrary)  # -> ModelDisp, DisplacementRange
node_displacement = NodeDisplacementAlpaca4d(AlpacaStaticOutput=ndfanalyses)  # -> Points, Trans, Rot
brick_stress_2 = BrickStressAlpaca4d(AlpacaStaticOutput=ndfanalyses, StressView=Slider(1, range=0..5))  # -> Brick, StressValue, StressRange
mesh = Mesh(static_model_view.ModelDisp)
mjoin = MeshJoin(Meshes=brick_stress_2.Brick)
