# Grasshopper definition Brick2.gh (Grasshopper 1.0.7)
# plug-ins: MeshEdit Components, Pufferfish, Alpaca4d, Weaverbird

# ---- group: Element
data = Data(0)
data_2 = Data(0)

# ---- group: Load
# instagram:    Alpaca4d
# facebook:     Alpaca4d
# mail:         alpaca4d@gmail.com
data_3 = Data(0)
data_4 = Data(0)

# ---- group: Cross-Section
data_5 = Data(0)
data_6 = Data(0)

# ---- group: Support
data_7 = Data(0)
data_8 = Data(0)

# ---- group: Material
data_9 = Data(0)
data_10 = Data(0)

# ---- group: Constraint
data_11 = Data(0)
data_12 = Data(0)

# ---- group: variable
ncolumn = Slider(4, range=0..10)
number_slider = Slider(71, range=0..100)

# ----
range = Range(Domain="0 to 2.0", Steps=Slider(3, range=2..4))

# ---- group: Material
division = Division(A="39000", B=2)
ndmaterial = NDMaterialAlpaca4d(MatName="S235", E="39000", G=division, V=0.3, Rho=78.5, Fy=23.5)

# ----
galapagos = Galapagos(fitness=item, gene=number_slider)
col = Colour(reverse([ColourSwatch(SwatchColor=RGB(204, 0, 71)), ColourSwatch(SwatchColor=RGB(255, 182, 71)), ColourSwatch(SwatchColor=RGB(206, 255, 115)), ColourSwatch(SwatchColor=RGB(26, 180, 214)), ColourSwatch(SwatchColor=RGB(0, 0, 207))]))

number_slider_2 = Slider(1, range=0..10)
number_slider_3 = Slider(20, range=0..20)
mplane = MeshPlane(Boundary={Plane=PlaneXY(0, 0, 0), Size=Domain2(u=-10..10, v=-10..10)}, WidthCount=10, HeightCount=10)  # -> Mesh, Area
multiplication = Multiplication(A=number_slider_2, B=number_slider_3)
explode = MeshExplode(Mesh=mplane.Mesh, Interpolate=False)
lng = ListLength(List=explode)
subtraction = Subtraction(A=multiplication, B=number_slider_2)
Z = UnitZ(Factor=subtraction)
subtraction_2 = Subtraction(A=lng, B=ncolumn)
Z_2 = UnitZ(Factor=range)
series = Series(Start=0, Step=number_slider_2, Count=number_slider_3)
move = Move(Geometry=graft(mplane.Mesh), Motion=Z)  # -> Geometry, Transform
Z_3 = UnitZ(Factor=series)
reduce = RandomReduce(List=explode, Reduction=subtraction_2, Seed=number_slider)
move_2 = Move(Geometry=graft(move.Geometry), Motion=Z_2)  # -> Geometry, Transform
mesh_series_to_brick = MeshSeriesToBrickAlpaca4d(MeshSeries=move_2.Geometry)  # -> flatten(Brick)

wbsplitquads = WeaverbirdsConstantQuadsSplitSubdivision(MeshCurves=reduce, Level="2", SmoothNakedEdges=0)

move_3 = Move(Geometry=graft(wbsplitquads), Motion=Z_3)  # -> Geometry, Transform
mesh_series_to_brick_2 = MeshSeriesToBrickAlpaca4d(MeshSeries=move_3.Geometry)  # -> flatten(Brick)
entwine = Entwine(Branch00=mesh_series_to_brick_2, Branch01=mesh_series_to_brick, FlattenInputs=True)
demesh = DeconstructMesh(Mesh=entwine)  # -> flatten(Vertices), Faces, Colours, Normals
cullpt = CullDuplicates(Points=flatten(demesh.Vertices), Tolerance=0.1, CullMode=3)  # -> Points, Indices, Valence
pdecon = Deconstruct(Point=cullpt.Points)  # -> XComponent, YComponent, ZComponent
bnd = Bounds(Numbers=pdecon.YComponent)
bnd_2 = Bounds(Numbers=pdecon.ZComponent)
pdecon_2 = Deconstruct(Point=cullpt.Points)  # -> XComponent, YComponent, ZComponent
dedomain = DeconstructDomain(Domain=bnd)  # -> Start, End
dedomain_2 = DeconstructDomain(Domain=bnd_2)  # -> Start, End
smaller = SmallerThan(FirstNumber=pdecon_2.ZComponent, SecondNumber=dedomain_2.Start)  # -> SmallerThan, OrEqualTo
larger = LargerThan(FirstNumber=pdecon.ZComponent, SecondNumber=dedomain_2.End)  # -> LargerThan, OrEqualTo
cull = CullPattern(List=cullpt.Points, CullPattern=smaller.OrEqualTo)
cull_2 = CullPattern(List=cullpt.Points, CullPattern=larger.OrEqualTo)

# ---- group: Element
brick_element = BrickElementAlpaca4d(Brick=entwine, Colour=ColourSwatch(SwatchColor=RGB(219, 33, 207)), NDMaterial=ndmaterial)  # -> simplify(SolidWrapper)

# ---- group: Load
vec = VectorXYZ(XComponent="-100", YComponent=0, ZComponent="-1000")  # -> Vector, Length
point_load = PointLoadAlpaca4d(Force=vec.Vector, Pos=cull_2)

# ---- group: Support
toggle = BooleanToggle(True)
support = SupportAlpaca4d(Pos=cull, Tx=toggle, Ty=toggle, Tz=toggle, Rx=toggle, Ry=toggle, Rz=toggle)

# ----
assemble_model = AssembleModelAlpaca4d(Element=flatten(brick_element), Support=flatten(support), Load=flatten(point_load))  # -> AlpacaModel, MassOfStructure
visualisemodel = VisualiseModelAlpaca4d(AlpacaModel=assemble_model.AlpacaModel, Support=Toggle(True), Load=Toggle(False))  # -> AlpacaModel, Model
geo = Geometry(visualisemodel.Model)
ndfanalyses = NDFAnalysesAlpaca4d(MarshallingSignalParameter=visualisemodel.AlpacaModel)

# ---- group: Post -Processing
gradientlibrary = GradientLibraryAlpaca4d(GradientIndex=Slider(11, range=0..12))  # -> reverse(ColorsList)
static_model_view = StaticModelViewAlpaca4d(AlpacaStaticOutput=ndfanalyses, Scale=Slider(100, range=0..100), ModelExtrude=Toggle(False), ColorList=gradientlibrary)  # -> ModelDisp, DisplacementRange
item = ListItem(List=static_model_view.DisplacementRange, Index=0, Wrap=True)  # -> Item, Item1
X = UnitX(Factor=Slider(39, range=0..100))
move_4 = Move(Geometry=static_model_view.ModelDisp, Motion=X)  # -> Geometry, Transform

# ----
mesh = Mesh(static_model_view.ModelDisp)
brick_stress = BrickStressAlpaca4d(AlpacaStaticOutput=ndfanalyses, StressView=Slider(0, range=0..5))  # -> Brick, StressValue, StressRange

# ---- group: value to plot
num = Number(brick_stress.StressValue)

# ----
abs = Absolute(Value=num)
demesh_2 = DeconstructMesh(Mesh=static_model_view.ModelDisp)  # -> Vertices, Faces, Colours, Normals
num_2 = Number(abs)
bnd_3 = Bounds(Numbers=num_2)
remap = RemapNumbers(Value=num_2, Source=bnd_3, Target=Domain(0, 1))  # -> Mapped, Clipped
twnthrucols = TweenThroughColors(
    Colors=col,
    Factor=remap.Mapped,
    Normalized=True,
    Equalized=False,
    Weighted=False,
    Degree=3,
    InterpolationType=0,
    Alpha=True)
preview = CustomPreview(Geometry=demesh_2.Vertices, Material=twnthrucols)

node_displacement = NodeDisplacementAlpaca4d(AlpacaStaticOutput=ndfanalyses)  # -> Points, Trans, Rot
vlen = VectorLength(Vector=node_displacement.Trans)
col_2 = Colour(reverse([ColourSwatch(SwatchColor=RGB(204, 0, 71)), ColourSwatch(SwatchColor=RGB(255, 182, 71)), ColourSwatch(SwatchColor=RGB(206, 255, 115)), ColourSwatch(SwatchColor=RGB(26, 180, 214)), ColourSwatch(SwatchColor=RGB(0, 0, 207))]))

# ---- group: value to plot
num_3 = Number(vlen)

# ----
abs_2 = Absolute(Value=num_3)
num_4 = Number(abs_2)
bnd_4 = Bounds(Numbers=num_4)
remap_2 = RemapNumbers(Value=num_4, Source=bnd_4, Target=Domain(0, 1))  # -> Mapped, Clipped
twnthrucols_2 = TweenThroughColors(
    Colors=col_2,
    Factor=remap_2.Mapped,
    Normalized=True,
    Equalized=False,
    Weighted=False,
    Degree=3,
    InterpolationType=0,
    Alpha=True)
num_5 = Number(expr("round(x*1000,2)", abs_2))
tag = TextTag(Location=node_displacement.Points, Text=num_5, Colour=twnthrucols_2)
preview_2 = CustomPreview(Geometry=node_displacement.Points, Material=twnthrucols_2)
