# Grasshopper definition crapperShellTest2_RhinoVault.gh (Grasshopper 1.0.7)
# plug-ins: K2Engineering, Human, Kangaroo Components, Weaverbird, Kangaroo2 Components, plankton, karambaGH

dpipeline = DynamicGeometryPipeline(
    LayerFilter="Springs",
    TypeFilter="Curve",
    NameFilter="*",
    GroupByLayer=False,
    GroupByType=False,
    IncludeHidden=True,
    IncludeLocked=True,
    enableFullPath=False,
    listenToAttributes=True)
crv = Curve(reparameterize(dpipeline))
graft = GraftTree(Tree=crv, IncludeEmptyLists=True, IncludeNullItems=True)  # -> simplify(Tree)
crv_2 = Curve([<curve referenced from the Rhino model> x66])
panel = Panel("6")
wbweave = WeaverbirdsMeshFromLinesWeaveBack(Lines=crv_2, MaximumValence=4)
clean = CombineClean(Meshes=wbweave)
objatts = ObjectAttributes(ObjectOrAttributes=dpipeline)  # -> Name, LayerName, LayerFullPath, Color, MaterialName, LinetypeName, GroupIndices, PlotWeight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

# ----
# Format Engineers CAD Information Issue Disclaimer
# 
# Project: PROJECT NAME
# 
# You should use this model for reference purposes only to assist in co-ordinating your work and is supplementary to formally issued drawings. Once the data is introduced into your own CAD or other system Format Engineers Ltd. can take no responsibility for its accuracy.
# 
# The last set of formally issued paper drawings are the contractual documents which represent the current stage of design development. If you have any queries, please contact the project CAD co-ordinator or the CAD Development Team.
# 
# Changes:
# 
# YYYY-MM-DD: Summary of changes
# 
# Usage notes:
# 
# This definition includes a basic implementation of Merbarki's Farthest Point Seeding algorithm (2005), adapted for tracing lines of principal curvature on NURBS surfaces. Requires modified Triangle.NET, if this isn't attached then... good luck! There are currently two main limitations: (a) this implementation measures density in parameter space, and (b) it doesn't include the dynamic refinement of density that Mebarki suggests.
crv_3 = Curve([<curve referenced from the Rhino model> x24])
crv_4 = Curve([<curve referenced from the Rhino model> x476])
crv_5 = Curve([<curve referenced from the Rhino model> x24])
entwine = Entwine(Branch00=crv_5, Branch01=crv_3, Branch02=crv_4, FlattenInputs=True)
crv_6 = Curve([<curve referenced from the Rhino model> x524])
wbweave_2 = WeaverbirdsMeshFromLinesWeaveBack(Lines=crv_6, MaximumValence=4)
entwine_2 = Entwine(
    Branch00=Slider(20, range=0..20),
    Branch01=Slider(20, range=0..20),
    Branch02=Slider(10.046, range=0..20),
    FlattenInputs=True)
number_slider = Slider(6.052, range=0..10)
tri = Triangulate(Mesh=wbweave_2)  # -> Mesh, Count
pt = Point([<point referenced from the Rhino model> x42])
pmesh = PlanktonMesh(tri.Mesh)
anchor = Anchor(Point=pt, Strength=10000)
length_line = LengthLine(Line=entwine, Length="0", Strength=entwine_2)
mvarea = MeshVertexArea(PlanktonMesh=pmesh)  # -> Vertices, VertexNormals
show = Show(G=entwine)
neg = Negative(Value=Slider(5.8168, range=0..10))
multiplication = Multiplication(A=mvarea.VertexNormals, B=neg)
load = Load(Point=mvarea.Vertices, NodalForce=multiplication)
entwine_3 = Entwine(Branch00=show, Branch01=length_line, Branch02=anchor, Branch03=load, FlattenInputs=True)
solver = Solver(GoalObjects=entwine_3, Reset=Button(), Threshold=1e-15, Tolerance=0.01, On=Toggle(True))  # -> I, V, O

unim = UnifyMesh(Mesh=clean)  # -> Result, Count
wbunify = WeaverbirdsUnifyFaceWindings(MeshCurves=unim.Result)
refine = Refine(Mesh=wbunify, Level="2")
tri_2 = Triangulate(Mesh=refine)  # -> Mesh, Count
demesh = DeconstructMesh(Mesh=tri_2.Mesh)  # -> Vertices, Faces, Colours, Normals
crv_cp = CurveClosestPoint(Point=demesh.Vertices, Curve=graft(crv))  # -> Point, Parameter, Distance
smaller = SmallerThan(FirstNumber=crv_cp.Distance, SecondNumber="0.01")  # -> SmallerThan, OrEqualTo
cull = CullPattern(List=crv_cp.Parameter, CullPattern=smaller.SmallerThan)
sort = SortList(Keys=cull)  # -> Keys, ValuesA
shatter = Shatter(Curve=simplify(graft), Parameters=simplify(sort.Keys))
end = EndPoints(Curve=shatter)  # -> Start, End
ln = Line(StartPoint=end.Start, EndPoint=end.End)
clean_2 = CleanTree(RemoveNulls=invert(True), RemoveInvalid=True, RemoveEmpty=False, Tree=ln)
medges = MeshEdges(Mesh=tri_2.Mesh)  # -> NakedEdges, InteriorEdges, NonManifoldEdges
curvepoint = PointOnCurve(clean_2, parameter=0.5)
crv_7 = Curve(medges.InteriorEdges)
curvepoint_2 = PointOnCurve(crv_7, parameter=0.5)
dpipeline_2 = DynamicGeometryPipeline(
    LayerFilter="Boundary",
    TypeFilter="Curve",
    NameFilter="*",
    GroupByLayer=False,
    GroupByType=False,
    IncludeHidden=True,
    IncludeLocked=True,
    enableFullPath=False,
    listenToAttributes=True)
demesh_2 = DeconstructMesh(Mesh=tri_2.Mesh)  # -> Vertices, Faces, Colours, Normals
fsim = FindSimilarMember(Data=flatten(curvepoint), Set=flatten(curvepoint_2))  # -> Hit, Index
strength = Data(objatts.Name)
cull_i = CullIndex(List=crv_7, Indices=fsim.Index, Wrap=True)
tri_3 = Triangulate(Mesh=tri_2.Mesh)  # -> Mesh, Count
crv_cp_2 = CurveClosestPoint(Point=demesh_2.Vertices, Curve=graft(dpipeline_2))  # -> Point, Parameter, Distance
graft_2 = GraftTree(Tree=strength, IncludeEmptyLists=True, IncludeNullItems=True)
pmesh_2 = PlanktonMesh(tri_3.Mesh)
smaller_2 = SmallerThan(FirstNumber=crv_cp_2.Distance, SecondNumber="0.01")  # -> SmallerThan, OrEqualTo
mvarea_2 = MeshVertexArea(PlanktonMesh=pmesh_2)  # -> Vertices, VertexNormals
length_line_2 = LengthLine(Line=clean_2, Length="0", Strength=graft_2)
length_line_3 = LengthLine(Line=cull_i, Length="0", Strength=Slider(1, range=0.01..4))
cull_2 = CullPattern(List=demesh_2.Vertices, CullPattern=smaller_2.SmallerThan)
show_2 = Show(G=tri_2.Mesh)
rdpoints = RemoveDuplicatePointsKaramba3D(Point=flatten(cull_2), LimitDistance=0.005)  # -> OutPoint, Info, Indexes
mselfweight = MeshSelfweight(VertexNormals=mvarea_2.VertexNormals, Thickness=Slider(21, range=0..200), MaterialDensity="1")
rev = Reverse(Vector=mselfweight)
anchor_2 = Anchor(Point=rdpoints.OutPoint, Strength=10000)
load_2 = Load(Point=mvarea_2.Vertices, NodalForce=rev)
crv_8 = Curve(solver.O)
entwine_4 = Entwine(Branch00=show_2, Branch01=[length_line_3, length_line_2], Branch02=anchor_2, Branch03=load_2, FlattenInputs=True)
solver_2 = Solver(GoalObjects=entwine_4, Reset=Button(), Threshold=1e-15, Tolerance=0.01, On=Toggle(True))  # -> I, V, O
bang = ExplodeTree(Data=solver_2.O)  # -> Branch0, Branch1
mesh = Mesh(bang.Branch0)
mesh_2 = Mesh(mesh)
medges_2 = MeshEdges(Mesh=mesh_2)  # -> NakedEdges, InteriorEdges, NonManifoldEdges
crv_9 = Curve(medges_2.NakedEdges)
crv_10 = Curve(medges_2.InteriorEdges)
custom_preview = CustomPreview(Geometry=mesh_2, Material=ColourSwatch(SwatchColor=RGB(255, 255, 255)))
previewlw = CustomPreviewLineweights(Geometry=crv_9, Shader=ColourSwatch(SwatchColor=RGB(0, 0, 0)), Thickness="3", Absolute=False)
previewlw_2 = CustomPreviewLineweights(Geometry=crv_10, Shader=ColourSwatch(SwatchColor=RGB(0, 0, 0)), Thickness="1", Absolute=False)
