# Grasshopper definition 200401_GHPython_DrawViewportWires_02.gh (Grasshopper 1.0.7)

# ---- group: Draw Curves with Custom Weights
thickness = Slider(5, range=0..20)
crv = Curve([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])
dc = DrawCurves(Curves=crv, Weight=thickness, Color=ColourSwatch(SwatchColor=RGB(0, 207, 255)))  # inputs Curves: list
# ---------- dc: Python ----------
"""
Minimal working prototype for implementing DrawViewportWires in GHPython.
    Inputs:
        Curves: Curves to render {list,curve}
        Weight: {item,int}
        Color: {item,color}
    Outputs:
    Remarks:
        Author: Anders Holden Deleuran (BIG IDEAS)
        Rhino: 6.24.20079.23341
        Version: 200401
"""

ghenv.Component.Name = "DrawCurves"
ghenv.Component.NickName = "DC"

from ghpythonlib.componentbase import executingcomponent as component
import Rhino as rc

class MyComponent(component):
    
    def RunScript(self,Curves,Weight,Color):
        self.curves = Curves
        self.weight = Weight
        self.color = Color
        
    def DrawViewportWires(self,arg):
        for crv in self.curves:
            arg.Display.DrawCurve(crv,self.color,self.weight)
# ---------- end dc ----------

# ---- group: Draw Flat Shaded Two-Sided Mesh with Custom Wire Thickness/Color
mesh = Mesh(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)
dmf = DrawMeshFlat(
    Mesh=mesh,
    FrontColor=ColourSwatch(SwatchColor=RGB(235, 235, 235)),
    BackColor=ColourSwatch(SwatchColor=RGB(255, 127, 0)),
    EdgeColor=ColourSwatch(SwatchColor=RGB(0, 0, 0)),
    EdgeWidth=Slider(3, range=0..10))
# ---------- dmf: Python ----------
"""
How to add to rendered display mode.
https://discourse.mcneel.com/t/grasshopper-mesh-rendering-preview-in-c/82069
"""

ghenv.Component.Name = "DrawMeshFlat"
ghenv.Component.NickName = "DMF"

from ghpythonlib.componentbase import executingcomponent as component
import Rhino as rc
from System.Drawing import Color

class MyComponent(component):
    
    def RunScript(self,Mesh,FrontColor,BackColor,EdgeColor,EdgeWidth):
        self.mesh = Mesh
        self.edgeColor = EdgeColor
        self.edgeWidth = EdgeWidth
        
        # Set front colors
        self.material = rc.Display.DisplayMaterial(Color.Black)
        self.material.Emission = FrontColor
        
        # Color back faces
        if BackColor:
            self.material.IsTwoSided = True
            self.material.BackDiffuse = Color.Black
            self.material.BackEmission = BackColor
            
    def DrawViewportMeshes(self,arg):
        arg.Display.DrawMeshShaded(self.mesh,self.material)
        
    def DrawViewportWires(self,arg):
        arg.Display.DrawMeshWires(self.mesh,self.edgeColor,self.edgeWidth)
# ---------- end dmf ----------

# ---- group: Draw Curves with Custom Weights
thickness_2 = Slider(7, range=0..20)
crv_2 = Curve([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])
dc_2 = DrawCurves(Curves=crv_2, Weight=thickness_2, Color=ColourSwatch(SwatchColor=RGB(168, 0, 0)))  # inputs Curves: list
# ---------- dc_2: Python ----------
"""
Minimal working prototype for implementing DrawViewportWires in GHPython.
    Inputs:
        Curves: Curves to render {list,curve}
        Weight: {item,int}
        Color: {item,color}
    Outputs:
    Remarks:
        Author: Anders Holden Deleuran (BIG IDEAS)
        Rhino: 6.24.20079.23341
        Version: 200401
"""

ghenv.Component.Name = "DrawCurves"
ghenv.Component.NickName = "DC"

from ghpythonlib.componentbase import executingcomponent as component
import Rhino as rc
import Rhino.Geometry as rg


class MyComponent(component):
    
    def RunScript(self,Curves,Weight,Color):
        self.curves = Curves
        self.weight = Weight
        self.color = Color
       
        Point = []
        for i in range(0,20):
            Point.append(rg.Point3d(i,0,0))
        
        self.points = Point
        
    def DrawViewportWires(self,arg):
        for crv in self.curves:
            arg.Display.DrawCurve(crv,self.color,self.weight)
        
        for point in self.points:
            arg.Display.DrawPoint(point)
# ---------- end dc_2 ----------

# ---- group: Draw 2D Text in Screen Space
# Create by
# Anders - BIG IDeas
panel = Panel("""Ham:
- Foo
- Bar
- Jeff
- Britta
- 100%""")
pt = Point(Point(100, 100, 0))
dst = DrawScreenText(Text=panel, Color=ColourSwatch(SwatchColor=RGB(0, 0, 0)), Height=Slider(30, range=0..30), Point=pt, Font="Iosevka")
# ---------- dst: Python ----------
from ghpythonlib.componentbase import executingcomponent as component
import Rhino as rc
import System

ghenv.Component.Name = "DrawScreenText"
ghenv.Component.NickName = "DST"

class MyComponent(component):
    
    def RunScript(self,Text,Color,Height,Point,Font):
        self.text = Text
        self.color = Color
        self.height = Height
        self.point = rc.Geometry.Point2d(Point.X,Point.Y)
        self.font = Font
        
        
    def DrawViewportWires(self,arg):
        arg.Display.Draw2dText(self.text,self.color,self.point,False,self.height,self.font)
# ---------- end dst ----------

# ----
sph = Sphere(Base=PlaneXY(0, 0, 0), Radius=1)
cyl = Cylinder(Base=PlaneXY(0, 0, 0), Radius=0.5, Length="10")
flip = Flip(Surface=sph)  # -> Surface, Result
pi = Pi(Factor="2")
cap = CapHoles(Brep=cyl)
sunion = SolidUnion(Breps=flip.Surface)
range = Range(Domain=pi, Steps="20")
cos = Cosine(Value=range)
brep = Brep(sunion)
vec = VectorXYZ(XComponent=range, YComponent=range, ZComponent=cos)  # -> Vector, Length
multiplication = Multiplication(A=vec.Vector, B=Slider(10, range=1..10))
move = Move(Geometry=brep, Motion=multiplication)  # -> Geometry, Transform

pt_2 = ConstructPoint(XCoordinate=Slider(109, range=0..1000), YCoordinate=Slider(0, range=0..1000), ZCoordinate=0)
pt_3 = ConstructPoint(XCoordinate=Slider(224, range=0..1000), YCoordinate=Slider(398, range=0..1000), ZCoordinate=0)
clr = ColorsAlpaca4d(gradIndex=11)  # -> colors; inputs gradIndex: Int32
#   port colors: A series of colors to be plugged into the "Ladybug_Legend Parameters" component.
# ---------- clr: Python ----------
"""
Preset of gradient colors perfect for Data Visualisation
    Inputs:
        gradIndex: An index refering to one of the following possible gradients:
            0 - Orignal Ladybug
            1 - Nuanced Ladybug
            2 - Multi-colored Ladybug
            3 - Ecotect
            4 - Thermal Comfort Percentage
            5 - Thermal Comfort Colors
            6 - Shade Benefit/Harm
            7 - Shade Harm
            8 - Shade Benefit
            9 - CFD Colors 1
            10 - Radiation Benefit
            11 - Gsa10 Colour
            12 - Gsa9 Colour
    Returns:
        customColors: A series of colors.
"""

ghenv.Component.Name = "Colors (Alpaca4d)"
ghenv.Component.NickName = 'CLR'
ghenv.Component.Message = 'Colors (Alpaca4d)'

import scriptcontext as sc
import Grasshopper.Kernel as gh
import System

gradientLibrary = {
        0: [System.Drawing.Color.FromArgb(75, 107, 169), System.Drawing.Color.FromArgb(115, 147, 202), System.Drawing.Color.FromArgb(170, 200, 247), System.Drawing.Color.FromArgb(193, 213, 208), System.Drawing.Color.FromArgb(245, 239, 103), System.Drawing.Color.FromArgb(252, 230, 74), System.Drawing.Color.FromArgb(239, 156, 21), System.Drawing.Color.FromArgb(234, 123, 0), System.Drawing.Color.FromArgb(234, 74, 0), System.Drawing.Color.FromArgb(234, 38, 0)],
        1: [System.Drawing.Color.FromArgb(49,54,149), System.Drawing.Color.FromArgb(69,117,180), System.Drawing.Color.FromArgb(116,173,209), System.Drawing.Color.FromArgb(171,217,233), System.Drawing.Color.FromArgb(224,243,248), System.Drawing.Color.FromArgb(255,255,191), System.Drawing.Color.FromArgb(254,224,144), System.Drawing.Color.FromArgb(253,174,97), System.Drawing.Color.FromArgb(244,109,67), System.Drawing.Color.FromArgb(215,48,39), System.Drawing.Color.FromArgb(165,0,38)],
        2: [System.Drawing.Color.FromArgb(4,25,145), System.Drawing.Color.FromArgb(7,48,224), System.Drawing.Color.FromArgb(7,88,255), System.Drawing.Color.FromArgb(1,232,255), System.Drawing.Color.FromArgb(97,246,156), System.Drawing.Color.FromArgb(166,249,86), System.Drawing.Color.FromArgb(254,244,1), System.Drawing.Color.FromArgb(255,121,0), System.Drawing.Color.FromArgb(239,39,0), System.Drawing.Color.FromArgb(138,17,0)],
        3: [System.Drawing.Color.FromArgb(0,0,255), System.Drawing.Color.FromArgb(53,0,202), System.Drawing.Color.FromArgb(107,0,148), System.Drawing.Color.FromArgb(160,0,95), System.Drawing.Color.FromArgb(214,0,41), System.Drawing.Color.FromArgb(255,12,0), System.Drawing.Color.FromArgb(255,66,0), System.Drawing.Color.FromArgb(255,119,0), System.Drawing.Color.FromArgb(255,173,0), System.Drawing.Color.FromArgb(255,226,0), System.Drawing.Color.FromArgb(255,255,0)],
        4: [System.Drawing.Color.FromArgb(0,0,0), System.Drawing.Color.FromArgb(110,0,153), System.Drawing.Color.FromArgb(255,0,0), System.Drawing.Color.FromArgb(255,255,102), System.Drawing.Color.FromArgb(255,255,255)],
        5: [System.Drawing.Color.FromArgb(0,136,255), System.Drawing.Color.FromArgb(200,225,255), System.Drawing.Color.FromArgb(255,255,255), System.Drawing.Color.FromArgb(255,230,230), System.Drawing.Color.FromArgb(255,0,0)],
        6: [System.Drawing.Color.FromArgb(5,48,97), System.Drawing.Color.FromArgb(33,102,172), System.Drawing.Color.FromArgb(67,147,195), System.Drawing.Color.FromArgb(146,197,222), System.Drawing.Color.FromArgb(209,229,240), System.Drawing.Color.FromArgb(255,255,255), System.Drawing.Color.FromArgb(253,219,199), System.Drawing.Color.FromArgb(244,165,130), System.Drawing.Color.FromArgb(214,96,77), System.Drawing.Color.FromArgb(178,24,43), System.Drawing.Color.FromArgb(103,0,31)],
        7: [System.Drawing.Color.FromArgb(255,255,255), System.Drawing.Color.FromArgb(253,219,199), System.Drawing.Color.FromArgb(244,165,130), System.Drawing.Color.FromArgb(214,96,77), System.Drawing.Color.FromArgb(178,24,43), System.Drawing.Color.FromArgb(103,0,31)],
        8: [System.Drawing.Color.FromArgb(255,255,255), System.Drawing.Color.FromArgb(209,229,240), System.Drawing.Color.FromArgb(146,197,222), System.Drawing.Color.FromArgb(67,147,195), System.Drawing.Color.FromArgb(33,102,172), System.Drawing.Color.FromArgb(5,48,97)],
        9: [System.Drawing.Color.FromArgb(0,16,120), System.Drawing.Color.FromArgb(38,70,160), System.Drawing.Color.FromArgb(5,180,222), System.Drawing.Color.FromArgb(16,180,109), System.Drawing.Color.FromArgb(59,183,35), System.Drawing.Color.FromArgb(143,209,19), System.Drawing.Color.FromArgb(228,215,29), System.Drawing.Color.FromArgb(246,147,17), System.Drawing.Color.FromArgb(243,74,0), System.Drawing.Color.FromArgb(255,0,0)],
        10: [System.Drawing.Color.FromArgb(0,191,48), System.Drawing.Color.FromArgb(255,238,184), System.Drawing.Color.FromArgb(255,0,0)],
        11: [System.Drawing.Color.FromArgb(204,0,71), System.Drawing.Color.FromArgb(255,182,71), System.Drawing.Color.FromArgb(206,255,115), System.Drawing.Color.FromArgb(26,180, 214),System.Drawing.Color.FromArgb(0,0,207)],
        12: [System.Drawing.Color.FromArgb(255, 51, 51), System.Drawing.Color.FromArgb(255, 170, 51), System.Drawing.Color.FromArgb(255, 255, 51), System.Drawing.Color.FromArgb(170, 255, 125), System.Drawing.Color.FromArgb(51, 255, 231), System.Drawing.Color.FromArgb(51, 170, 255), System.Drawing.Color.FromArgb(51,51, 255)]}
colors = gradientLibrary[gradIndex]
# ---------- end clr ----------

# ---- group: Draw 2D Rectangle in Screen Space
pt_4 = Point(pt_2)
dst_2 = DrawScreenText(Color=ColourSwatch(SwatchColor=RGB(0, 0, 0)), Height=Slider(30, range=0..30), Point=pt_4, Font="Iosevka", colors=clr)  # inputs colors: list of Color
# ---------- dst_2: Python ----------
from ghpythonlib.componentbase import executingcomponent as component
import Rhino as rc
import System

ghenv.Component.Name = "DrawScreenText"
ghenv.Component.NickName = "DST"

class MyComponent(component):
    
    def RunScript(self,Text,Color,Height,Point,Font,colors):
        
        
        self.anchor_x = Point.X
        self.anchor_y = Point.Y
        
        self.dimension_x = 30
        self.dimension_y = 20
        
        #self.rectangle = System.Drawing.Rectangle(anchor_x, anchor_y, dimension_x,dimension_y)
        
        self.stroke = System.Drawing.Color.Black
        self.fillColor = System.Drawing.Color.Red
        
        self.colors = colors
        


        
    def DrawViewportWires(self,arg):
        
        
        
        self.rectangle = System.Drawing.Rectangle(self.anchor_x, self.anchor_y, self.dimension_x, self.dimension_y)
        self.rectangle_2 = System.Drawing.Rectangle(self.anchor_x, self.anchor_y + self.dimension_y, self.dimension_x, self.dimension_y)
        
        self.Rect = [self.rectangle, self.rectangle_2]
        
        
        for i,rect in enumerate(self.Rect):
            
            arg.Display.Draw2dRectangle(rect, self.stroke, 1, self.colors[i])
# ---------- end dst_2 ----------

# ----
clr_2 = ColorsAlpaca4d(gradIndex=11)  # -> colors; inputs gradIndex: Int32; same code as clr

# ---- group: Draw 2D Rectangle in Screen Space
pt_5 = Point(pt_3)
dst_3 = DrawScreenText(Color=ColourSwatch(SwatchColor=RGB(0, 0, 0)), Height=Slider(30, range=0..30), Point=pt_5, Font="Iosevka", colors=clr_2)  # inputs colors: list of Color
# ---------- dst_3: Python ----------
from ghpythonlib.componentbase import executingcomponent as component
import Rhino as rc
import System

ghenv.Component.Name = "DrawScreenText"
ghenv.Component.NickName = "DST"

class MyComponent(component):
    
    def RunScript(self,Text,Color,Height,Point,Font,colors):
        
        
        self.anchor_x = Point.X
        self.anchor_y = Point.Y
        
        self.dimension_x = 30
        self.dimension_y = 20
        
        #self.rectangle = System.Drawing.Rectangle(anchor_x, anchor_y, dimension_x,dimension_y)
        
        self.stroke = System.Drawing.Color.Black
        self.fillColor = System.Drawing.Color.Blue
        
        self.colors = colors


        
    def DrawViewportWires(self,arg):
        

        
        self.rectangle = System.Drawing.Rectangle(self.anchor_x, self.anchor_y, self.dimension_x, self.dimension_y)
        self.rectangle_2 = System.Drawing.Rectangle(self.anchor_x, self.anchor_y + self.dimension_y, self.dimension_x, self.dimension_y)
        
        
        arg.Display.Draw2dRectangle(self.rectangle, self.stroke, 3, self.fillColor)
        arg.Display.Draw2dRectangle(self.rectangle_2, self.stroke, 3, self.fillColor)
# ---------- end dst_3 ----------

# ----
# Original
swatch = ColourSwatch(SwatchColor=RGB(255, 225, 0))
python = GhPythonScript(Text="Bar", Color=swatch)
# ---------- python: Python ----------
import System
import Rhino as rc
from ghpythonlib.componentbase import executingcomponent as component

class MyComponent(component):
        
    def RunScript(self,Text,Color):
        
        # Assign input variables
        self.txt = Text
        self.col = Color
        self.black = System.Drawing.Color.Black
        
    def DrawForeground(self,sender,arg):
        if self.drawingWires:
            self.drawingWires = False
            
            
            anchor_x = 30
            anchor_y = 30
            
            rect_x = 100
            rect_y = 75
            
            txt_height = 120
            
            # Rectangle is drawn in front of mesh
            rec2d = System.Drawing.Rectangle(anchor_x,anchor_y,rect_x,rect_y)
            arg.Display.Draw2dRectangle(rec2d,self.black,3,self.col)

            # Text is drawn in front of mesh
            pt = rc.Geometry.Point2d(anchor_x + rect_x, anchor_y)
            arg.Display.Draw2dText(self.txt,self.black,pt,False,txt_height,"Consolas")




    def DrawViewportWires(self,arg):
        self.drawingWires = True
        
    def __exit__(self):
        rc.Display.DisplayPipeline.DrawForeground -= self.DrawForeground
        
    def __enter__(self):
        rc.Display.DisplayPipeline.DrawForeground += self.DrawForeground
# ---------- end python ----------

structural_output = Number([28.55469492, 10.20812974, -1.700066483, 39.25235263, -4.549768322, 5.334020399, 30.10702306, 12.27733395, 1.249157698, -9.439667351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])
clr_3 = ColorsAlpaca4d(gradIndex=Slider(3, range=0..12))  # -> colors; inputs gradIndex: Int32; same code as clr
python_2 = GhPythonScript(Color=clr_3, Scale=Slider(6.66, range=1..10), Data=structural_output)  # inputs Color: list, Data: list
# ---------- python_2: Python ----------
import System
import Rhino as rc
from ghpythonlib.componentbase import executingcomponent as component

class MyComponent(component):
        
    def RunScript(self,Color,Scale,Data):
        
        # Assign input variables
        self.col = Color
        self.black = System.Drawing.Color.Black
        self.scale = Scale
        self.data = Data




        self.min_number = float(min(self.data))
        self.max_number = float(max(self.data))
        
        self.diff = self.max_number - self.min_number
        
        self.range = len(self.col) + 1



    def DrawForeground(self,sender,arg):
        if self.drawingWires:
            self.drawingWires = False
            
            RhinoDocument = rc.RhinoDoc.ActiveDoc
            active_view = RhinoDocument.Views.ActiveView
            
            width = active_view.Size.Width
            height = active_view.Size.Height
            
            anchor_x = width * 0.025
            anchor_y = height * 0.1
            
            #anchor_x = 50
            #anchor_y = 50
            
            
            rect_x = 5 * self.scale
            rect_y = 5 * self.scale
            
            #txt_height = 50
            txt_height = rect_y * 0.8
            title_height = rect_y * 1.1
            
            
            # Title
            pt = rc.Geometry.Point2d(anchor_x, anchor_y - 1/(1.6) * txt_height)
            arg.Display.Draw2dText("Disp (cm)",self.black,pt,False,title_height,"Arial")

            
            for i,col in enumerate(self.col,1):
                
            
                # Rectangle is drawn in front of mesh
                rec2d = System.Drawing.Rectangle(anchor_x,anchor_y + i * rect_y, rect_x,rect_y)
                arg.Display.Draw2dRectangle(rec2d,self.black,3,col)


                value = self.diff * i/self.range + self.min_number
                value = "{:.1f}".format(value)
                
                # Text is drawn in front of mesh
                pt = rc.Geometry.Point2d(anchor_x + 1.5 * rect_x, anchor_y - 1/(1.6*2) * txt_height + i * rect_y)
                
                arg.Display.Draw2dText(value,self.black,pt,False,txt_height,"Arial")
            
            i += 1
            pt = rc.Geometry.Point2d(anchor_x + 1.55 * rect_x, anchor_y - 1/(1.6*2) * txt_height + i * rect_y)
            arg.Display.Draw2dText(self.txt,self.black,pt,False,txt_height,"Arial")


    def DrawViewportWires(self,arg):
        self.drawingWires = True
        
    def __exit__(self):
        rc.Display.DisplayPipeline.DrawForeground -= self.DrawForeground
        
    def __enter__(self):
        rc.Display.DisplayPipeline.DrawForeground += self.DrawForeground
# ---------- end python_2 ----------

# ---- group: Draw Curves with Custom Weights
dc_3 = DrawCurves(Brep=move.Geometry)  # inputs Brep: list of Brep
# ---------- dc_3: Python ----------
"""
Minimal working prototype for implementing DrawViewportWires in GHPython.
    Inputs:
        Curves: Curves to render {list,curve}
        Weight: {item,int}
        Color: {item,color}
    Outputs:
    Remarks:
        Author: Anders Holden Deleuran (BIG IDEAS)
        Rhino: 6.24.20079.23341
        Version: 200401
"""

ghenv.Component.Name = "DrawCurves"
ghenv.Component.NickName = "DC"

from ghpythonlib.componentbase import executingcomponent as component
import Rhino as rc
import Rhino.Geometry as rg
import System


class MyComponent(component):
    
    def RunScript(self,Brep):
        self.Brep = Brep
        self.material = rc.Display.DisplayMaterial(System.Drawing.Color.Chocolate, 0)
        
    def DrawViewportWires(self,arg):
        for item in self.Brep:
            arg.Display.DrawBrepShaded(item,self.material)
# ---------- end dc_3 ----------

# ----
python_3 = GhPythonScript(Text="Bar", Color=ColourSwatch(SwatchColor=RGB(255, 225, 0)))
# ---------- python_3: Python ----------
import System
import Rhino as rc
from ghpythonlib.componentbase import executingcomponent as component

class MyComponent(component):
        
    def RunScript(self,Text,Color):
        
        # Assign input variables
        self.txt = Text
        self.col = Color
        self.black = System.Drawing.Color.Black
        
    def DrawForeground(self,sender,arg):
        if self.drawingWires:
            self.drawingWires = False
            
            
            anchor_x = 30
            anchor_y = 120
            
            rect_x = 30
            rect_y = 20
            
            #txt_height = 50
            txt_height = rect_y * 1.1
            
            
            # Rectangle is drawn in front of mesh
            rec2d = System.Drawing.Rectangle(anchor_x,anchor_y,rect_x,rect_y)
            arg.Display.Draw2dRectangle(rec2d,self.black,3,self.col)

            # Text is drawn in front of mesh
            pt = rc.Geometry.Point2d(anchor_x + 1.1 * rect_x, anchor_y - 1/(1.6*2) * txt_height)
            arg.Display.Draw2dText(self.txt,self.black,pt,False,txt_height,"Consolas")




            # Rectangle is drawn in front of mesh
            rec2d = System.Drawing.Rectangle(anchor_x,anchor_y + rect_y, rect_x,rect_y)
            arg.Display.Draw2dRectangle(rec2d,self.black,3,self.col)

            # Text is drawn in front of mesh
            pt = rc.Geometry.Point2d(anchor_x + 1.1 * rect_x, anchor_y - 1/(1.6*2) * txt_height + rect_y)
            arg.Display.Draw2dText(self.txt,self.black,pt,False,txt_height,"Consolas")






            # Rectangle is drawn in front of mesh
            rec2d = System.Drawing.Rectangle(anchor_x,anchor_y + rect_y + rect_y, rect_x,rect_y)
            arg.Display.Draw2dRectangle(rec2d,self.black,3,self.col)

            # Text is drawn in front of mesh
            pt = rc.Geometry.Point2d(anchor_x + 1.1 * rect_x, anchor_y - 1/(1.6*2) * txt_height + rect_y + rect_y)
            arg.Display.Draw2dText(self.txt,self.black,pt,False,txt_height,"Consolas")






    def DrawViewportWires(self,arg):
        self.drawingWires = True
        
    def __exit__(self):
        rc.Display.DisplayPipeline.DrawForeground -= self.DrawForeground
        
    def __enter__(self):
        rc.Display.DisplayPipeline.DrawForeground += self.DrawForeground
# ---------- end python_3 ----------
