# Grasshopper definition AlpacaLogo.gh (Grasshopper 1.0.7)
# plug-ins: Human, Weaverbird

# ----
# 64 x 64 icon
geo = Geometry([<brep referenced from the Rhino model> x45])
geo_2 = Geometry([<brep referenced from the Rhino model> x117])
join = BrepJoin(Breps=flatten(geo_2))  # -> Breps, Closed
join_2 = BrepJoin(Breps=flatten(geo))  # -> Breps, Closed
edges = BrepEdges(Brep=join.Breps)  # -> Naked, Interior, NonManifold
edges_2 = BrepEdges(Brep=join_2.Breps)  # -> Naked, Interior, NonManifold
crv = Curve([edges.Naked, edges.Interior])
crv_2 = Curve(edges_2.Naked)
previewlw = CustomPreviewLineweights(Geometry=crv, Shader=ColourSwatch(SwatchColor=RGB(255, 255, 255)), Thickness=Slider(1, range=1..5), Absolute=False)
previewlw_2 = CustomPreviewLineweights(Geometry=crv_2, Shader=ColourSwatch(SwatchColor=RGB(255, 255, 255)), Thickness=Slider(1, range=1..5), Absolute=False)

number_slider = Slider(1, range=1..5)
number_slider_2 = Slider(4, range=1..5)
crv_3 = Curve([<curve referenced from the Rhino model> x246])
crv_4 = Curve([<curve referenced from the Rhino model> x75])
previewlw_3 = CustomPreviewLineweights(Geometry=crv_3, Shader=ColourSwatch(SwatchColor=RGB(0, 0, 0)), Thickness="2", Absolute=False)
previewlw_4 = CustomPreviewLineweights(Geometry=crv_4, Shader=ColourSwatch(SwatchColor=RGB(0, 0, 0)), Thickness="8", Absolute=False)

# ---- group: palette Perù
merge = Merge(
    Data1=ColourSwatch(SwatchColor=RGB(209, 17, 17)),
    Data2=ColourSwatch(SwatchColor=RGB(235, 109, 63)),
    Data3=ColourSwatch(SwatchColor=RGB(158, 53, 219)),
    Data4=ColourSwatch(SwatchColor=RGB(173, 227, 48)),
    Data5=ColourSwatch(SwatchColor=RGB(67, 136, 247)),
    Data6=ColourSwatch(SwatchColor=RGB(0, 30, 255)))  # -> reverse(Result)

# ----
geo_3 = Geometry([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])
# Format Engineers CAD Information Issue Disclaimer
# 
# Project: PROJECT NAME
# 
# You should use this model for reference purposes only to assist in co-ordinating your work and is supplementary to formally issued drawings. Once the data is introduced into your own CAD or other system Format Engineers Ltd. can take no responsibility for its accuracy.
# 
# The last set of formally issued paper drawings are the contractual documents which represent the current stage of design development. If you have any queries, please contact the project CAD co-ordinator or the CAD Development Team.
# 
# Changes:
# 
# YYYY-MM-DD: Summary of changes
# 
# Usage notes:
# 
# This definition includes a basic implementation of Merbarki's Farthest Point Seeding algorithm (2005), adapted for tracing lines of principal curvature on NURBS surfaces. Requires modified Triangle.NET, if this isn't attached then... good luck! There are currently two main limitations: (a) this implementation measures density in parameter space, and (b) it doesn't include the dynamic refinement of density that Mebarki suggests.
geo_4 = Geometry([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])
panel = Panel("""13
22
24
26""")
debrep = DeconstructBrep(Brep=geo_4)  # -> Faces, Edges, Vertices
debrep_2 = DeconstructBrep(Brep=geo_3)  # -> Faces, Edges, Vertices
list_item = ListItem(List=geo_3, Index=flatten(panel), Wrap=True)
number_slider_3 = Slider(1, range=0..1)
crv_5 = Curve(debrep.Edges)
crv_6 = Curve(debrep_2.Edges)
previewlw_5 = CustomPreviewLineweights(Geometry=crv_6, Shader=ColourSwatch(SwatchColor=RGB(0, 0, 0)), Thickness=Slider(1, range=1..5), Absolute=False)
previewlw_6 = CustomPreviewLineweights(Geometry=list_item, Shader=ColourSwatch(SwatchColor=RGB(0, 0, 0)), Thickness=Slider(1, range=1..5), Absolute=False)
previewlw_7 = CustomPreviewLineweights(Geometry=crv_5, Shader=ColourSwatch(SwatchColor=RGB(0, 0, 0)), Thickness=Slider(1, range=1..5), Absolute=False)
number_slider_4 = Slider(10, range=0..100)
join_curves = JoinCurves(Curves=debrep.Edges, Preserve=False)
weaverbird_s_mesh_window = WeaverbirdsMeshWindow(MeshPolylines=flatten(join_curves), Distance=number_slider_4, InsetType=0)
weaverbird_s_picture_frame = WeaverbirdsPictureFrame(MeshPolylines=flatten(join_curves), Distance=number_slider_4, InsetType=0)
deconstruct_mesh = DeconstructMesh(Mesh=weaverbird_s_picture_frame)  # -> Vertices, Faces, Colours, Normals
deconstruct = Deconstruct(Point=deconstruct_mesh.Vertices)  # -> XComponent, YComponent, ZComponent
stream_filter = StreamFilter(Gate=0, Stream0=deconstruct.XComponent, Stream1=deconstruct.YComponent, Stream2=deconstruct.ZComponent)
bounds = Bounds(Numbers=stream_filter)
deconstruct_domain = DeconstructDomain(Domain=bounds)  # -> Start, End
division = Division(A=stream_filter, B=deconstruct_domain.End)
gradient = Gradient(
    LowerLimit=deconstruct_domain.Start,
    UpperLimit=deconstruct_domain.End,
    Parameter=stream_filter,
    stops=[0: RGB(243, 57, 0), 0.1: RGB(236, 27, 60), 0.2: RGB(210, 0, 118), 0.3: RGB(103, 0, 120), 0.4: RGB(39, 72, 161), 0.5: RGB(1, 192, 229), 0.6: RGB(18, 178, 90), 0.7: RGB(79, 186, 8), 0.8: RGB(220, 237, 32), 0.9: RGB(247, 159, 20), 1: RGB(243, 57, 0)])
interpolate_data = InterpolateData(Data=merge, Parameter=stream_filter, Interpolation=2)
mesh_colours = MeshColours(Mesh=weaverbird_s_picture_frame, Colours=gradient)
previewlw_8 = CustomPreviewLineweights(
    Geometry=weaverbird_s_mesh_window,
    Shader=ColourSwatch(SwatchColor=RGB(0, 0, 0)),
    Thickness=Slider(1, range=1..5),
    Absolute=False)
