# Grasshopper definition 3dModelDeformation.gh (Grasshopper 1.0.7)

crv = Curve([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])
swatch = ColourSwatch(SwatchColor=RGB(255, 255, 255))
swatch_2 = ColourSwatch(SwatchColor=RGB(0, 73, 209))
merge = Merge(Data1=ColourSwatch(SwatchColor=RGB(255, 255, 255)), Data2=ColourSwatch(SwatchColor=RGB(0, 73, 209)))
rev = ReverseList(List=merge)
filter = StreamFilter(Gate=Slider(1, range=0..1), Stream0=merge, Stream1=rev)
c_script = CSharpScript(iPolys=crv, iColors=filter)  # -> out, A; inputs iPolys: list of Polyline, iColors: list of Color
# ---------- c_script: C# usings ----------
using System.Drawing;
using System.Linq;
# ---------- c_script: C# ----------
    var a = CreateLoftClosed(iPolys, null, iColors);
    A = a;
# ---------- c_script: C# additional code ----------
  public static Mesh CreateLoftClosed(IList<Polyline> polylines, List<double> deformation = null, List<Color> iColors = null)
  {
    Mesh result = new Mesh();
    var verts = result.Vertices;
    var faces = result.Faces;
    var clrs = result.VertexColors;

    int ny = polylines.Count;
    int nx = Enumerable.Min(polylines, p => p.Count) - 1;
    int n;

    // add vertices
    for (int i = 0; i < ny; i++)
    {
      var poly = polylines[i];

      for (int j = 0; j < nx; j++)
      {
        verts.Add(poly[j]);
        clrs.Add(iColors[i]);
      }
    }

    // add faces
    for (int i = 0; i < ny - 1; i++)
    {
      n = i * nx;

      for (int j0 = 0; j0 < nx; j0++)
      {
        int j1 = (j0 + 1) % nx;
        faces.AddFace(n + j0, n + j1, n + j1 + nx, n + j0 + nx);
      }
    }

    return result;
  }
# ---------- end c_script ----------
