# Grasshopper definition CantiliverBeam.gh (Grasshopper 1.0.7)
# plug-ins: Alpaca4d, BH.UI.Grasshopper

i_section = ISectionAlpaca4d(Height=0.3, TopFlangeWidth=0.15, TopFlangeThickness=0.02, BottomFlangeWidth=0.2, BottomFlangeThickness=0.02, Web=0.02)
rectanglehollowcs = RectangleHollowAlpaca4d(Width=0.3, Height=0.6, Web=0.02, TopFlange=0.02, BottomFlange=0.02)
circlecs = CircleCSAlpaca4d(Diameter=0.15, Thickness=0.01)
rectanglecs = RectangleCSAlpaca4d(Width=0.3, Height=0.6)
X = UnitX(Factor=1)
pt = Point(Point(0, 0, 0))
list = ValueList({"ipe": 0, "rect": 1, "hollowSquare": 2, "circle": 3}, selected="hollowSquare")
line = LineSDL(Start=pt, Direction=X, Length="12")
filter = StreamFilter(Gate=list, Stream0=i_section, Stream1=rectanglecs, Stream2=rectanglehollowcs, Stream3=circlecs)
python = GhPythonScript()  # -> Out, A
pframe = PerpFrame(Curve=reparameterize(line), Parameter="0.50")
pt_2 = Point(pframe)
vec = VectorXYZ(XComponent=Slider(0.2, range=0..1), YComponent=Slider(0.22, range=0..1), ZComponent=Slider(1, range=0..1))  # -> Vector, Length
Y = UnitY(Factor=1)
Z = UnitZ(Factor=1)
geo = Geometry()
end = EndPoints(Curve=line)  # -> Start, End
align = AlignPlane(Plane=pframe, Direction=vec.Vector)  # -> Plane, Angle
Z_2 = UnitZ(Factor="1000000")
force_beam_column = ForceBeamColumnAlpaca4d(Line=line, Section=filter, ZAxis=Y)
Z_3 = UnitZ(Factor="1000000")
support = SupportAlpaca4d(Point=end.Start, Tx=True, Ty=True, Tz=True, Rx=True, Ry=True, RZ=True)
point_load = PointLoadAlpaca4d(Point=end.End, Force=Z_2, Moment=Vector(0, 0, 0))
graft = GraftTree(Tree=force_beam_column, IncludeEmptyLists=True, IncludeNullItems=True)
linearload = LinearLoadAlpaca4d(BeamElement=graft, Force=Z_3)
graft_2 = GraftTree(Tree=force_beam_column, IncludeEmptyLists=True, IncludeNullItems=True)
getproperty = GetProperty(Obj=graft_2, PropName="Curve", Component="{ .GetProperty")
getproperty_2 = GetProperty(Obj=graft_2, PropName="Section", Component="{ .GetProperty")
assemble_model = AssembleModelAlpaca4d(Element=graft, Support=support, Load=point_load, Tollerance=0.01)  # -> AlpacaModel, MassForce
model_view_alpaca4d = ModelViewAlpaca4d(
    AlpacaModel=assemble_model.AlpacaModel,
    Extruded=Toggle(True),
    Load=False,
    LoadFactor=1,
    Support=False,
    SupportFactor=1,
    Constraint=False)  # -> AlpacaModel, Info
analysissettings = AnalysisSettingsAlpaca4d()
graft_3 = GraftTree(Tree=graft_2, IncludeEmptyLists=True, IncludeNullItems=True)
vlen = VectorLength(Vector=Z_2)
explode = Explode(Component="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")
getproperty_3 = GetProperty(Obj=getproperty_2, PropName="Material", Component="{ .GetProperty")
getproperty_4 = GetProperty(Obj=getproperty_2, PropName="Iyy", Component="{ .GetProperty")
getproperty_5 = GetProperty(Obj=getproperty_2, PropName="Izz", Component="{ .GetProperty")
len = Length(Curve=getproperty)
num = Number(vlen)
bang = ExplodeTree(Data=assemble_model.AlpacaModel)  # -> Branch0, Branch1
ra = RunAnalysisAlpaca4d(AlpacaModel=bang.Branch0, Settings=analysissettings)  # -> Log, AlpacaModel
panel = Panel(getproperty_4)
getproperty_6 = GetProperty(Obj=getproperty_3, PropName="E", Component="{ .GetProperty")
bang_2 = ExplodeTree(Data=[getproperty_5, getproperty_4])  # -> Branch0, Branch1
getproperty_7 = GetProperty(Obj=graft_2, PropName="Section", Component="{ .GetProperty")
getproperty_8 = GetProperty(Obj=graft_2, PropName="GeomTransf", Component="{ .GetProperty")
python_2 = GhPythonScript(P=num, L=len, E=getproperty_6, I=bang_2.Branch0)  # -> out, a
# ---------- python_2: Python ----------
__author__ = "MarcoPellegrinoKonsu"
__version__ = "2022.09.09"

import rhinoscriptsyntax as rs

a = P * L**4/(8*E*I)
a = P * L**3/(3*E*I)
# ---------- end python_2 ----------
panel_2 = Panel(bang_2.Branch0)
nd = NodalDisplacementsAlpaca4d(AlpacaModel=ra.AlpacaModel, History=False, Step=0)  # -> Displacement, Rotation, port, Velocity, Acceleration
panel_3 = Panel(python_2.a)
getproperty_9 = GetProperty(Obj=getproperty_7, PropName="Curves", Component="{ .GetProperty")
panel_4 = Panel(nd.Displacement)
explode_2 = Explode(Object=getproperty_8, Component="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")  # -> Type, Line, Id, LocalZ, LocalY
bang_3 = ExplodeTree(Data=panel_3)  # -> Branch0, Branch1
list_item = ListItem(List=getproperty_9, Index=0, Wrap=True)
item = ListItem(List=panel_4, Index="1", Wrap=True)
panel_5 = Panel(explode_2.LocalZ)
panel_6 = Panel(explode_2.LocalY)
merge = Merge(Data2=flatten(item))
end_2 = EndPoints(Curve=explode_2.Line)  # -> Start, End
data = Data(flatten(bang_3.Branch0))
midpt = CurveMiddle(Curve=explode_2.Line)
data_2 = Data(flatten(merge))
modelview = ModelViewAlpaca4d(
    AlpacaModel=bang.Branch0,
    Extruded=False,
    Load=False,
    LoadFactor=1,
    Support=Toggle(True),
    SupportFactor=1,
    Constraint=False)  # -> AlpacaModel, Info
pl = ConstructPlane(Origin=[end_2.Start, end_2.End], XAxis=explode_2.LocalZ, YAxis=explode_2.LocalY)
panel_7 = Panel(data_2)
panel_8 = Panel(data)
orient = Orient(Geometry=list_item, Source=PlaneXY(0, 0, 0), Target=pl)  # -> Geometry, Transform
vdisex = VectorDisplayEx(Point=midpt, Vector=panel_6, Colour=ColourSwatch(SwatchColor=RGB(48, 204, 0)), Width="3")
vdisex_2 = VectorDisplayEx(Point=midpt, Vector=panel_5, Colour=ColourSwatch(SwatchColor=RGB(0, 118, 161)), Width="3")
pdecon = Deconstruct(Point=panel_7)  # -> XComponent, YComponent, ZComponent
panel_9 = Panel(modelview.Info)
similar = Similarity(FirstNumber=pdecon.ZComponent, SecondNumber=panel_8, Threshold="3")  # -> Similarity, AbsoluteDifference
ml = MeshLoftAlpaca4d(Polylines=orient.Geometry)
merge_2 = Merge(Data1=ColourSwatch(SwatchColor=RGB(255, 0, 0)), Data2=ColourSwatch(SwatchColor=RGB(77, 255, 0)))
item_2 = ListItem(List=merge_2, Index=similar.Similarity, Wrap=True)
preview = CustomPreview(Geometry=ml, Material=ColourSwatch(SwatchColor=RGBA(255, 255, 255, 112)))
legend = Legend(Colour=item_2, Tags=similar.Similarity, LegendType=1)
