# Grasshopper definition CantiliverBeamConcentratedLoad.gh (Grasshopper 1.0.7)
# plug-ins: Alpaca4d

i_section = ISectionAlpaca4d(Height=0.3, TopFlangeWidth=0.15, TopFlangeThickness=0.02, BottomFlangeWidth=0.2, BottomFlangeThickness=0.02, Web=0.02)
rectanglehollowcs = RectangleHollowAlpaca4d(Width=0.3, Height=0.6, Web=0.02, TopFlange=0.02, BottomFlange=0.02)
circlecs = CircleCSAlpaca4d(Diameter=0.15, Thickness=0.01)
rectanglecs = RectangleCSAlpaca4d(Width=0.3, Height=0.6)
X = UnitX(Factor=1)
pt = Point(Point(0, 0, 0))
list = ValueList({"ipe": 0, "rect": 1, "hollowSquare": 2, "circle": 3}, selected="rect")
line = LineSDL(Start=pt, Direction=X, Length="12")
filter = StreamFilter(Gate=list, Stream0=i_section, Stream1=rectanglecs, Stream2=rectanglehollowcs, Stream3=circlecs)
unit_y = UnitY(Factor=1)
Z = UnitZ(Factor="1000000")
force_beam_column = ForceBeamColumnAlpaca4d(Line=line, Section=filter, ZAxis=unit_y)
end = EndPoints(Curve=line)  # -> Start, End
support = SupportAlpaca4d(Point=end.Start, Tx=True, Ty=True, Tz=True, Rx=True, Ry=True, RZ=True)
ghpython_script = GhPythonScript(obj=force_beam_column, propName="Curve")  # -> out, value
# ---------- ghpython_script: Python ----------
__author__ = "Marco"
__version__ = "2023.04.10"

import rhinoscriptsyntax as rs

value = getattr(obj, propName)
# ---------- end ghpython_script ----------
point_load_alpaca4d = PointLoadAlpaca4d(Point=end.End, Force=Z, Moment=Vector(0, 0, 0))
ghpython_script_2 = GhPythonScript(obj=force_beam_column, propName="Section")  # -> out, value; same code as ghpython_script
assemble_model = AssembleModelAlpaca4d(Element=force_beam_column, Support=support, Load=flatten(point_load_alpaca4d), Tollerance=0.01)  # -> AlpacaModel, MassForce
analysissettings = AnalysisSettingsAlpaca4d()
vlen = VectorLength(Vector=Z)
ghpython_script_3 = GhPythonScript(obj=ghpython_script_2.value, propName="Material")  # -> out, value; same code as ghpython_script
ghpython_script_4 = GhPythonScript(obj=ghpython_script_2.value, propName="Izz")  # -> out, value; same code as ghpython_script
len = Length(Curve=ghpython_script.value)
num = Number(vlen)
ra = RunAnalysisAlpaca4d(AlpacaModel=assemble_model.AlpacaModel, Settings=analysissettings)  # -> Log, AlpacaModel
ghpython_script_5 = GhPythonScript(obj=ghpython_script_3.value, propName="E")  # -> out, value; same code as ghpython_script
bang = ExplodeTree(Data=ghpython_script_4.value)  # -> Branch0, Branch1
python = GhPythonScript(P=num, L=len, E=ghpython_script_5.value, I=bang.Branch0)  # -> out, a
# ---------- python: Python ----------
__author__ = "MarcoPellegrinoKonsu"
__version__ = "2022.09.09"

import rhinoscriptsyntax as rs

a = P * L**3/(3*E*I)
# ---------- end python ----------
nd = NodalDisplacementsAlpaca4d(AlpacaModel=ra.AlpacaModel, History=False, Step=0)  # -> Displacement, Rotation, port, Velocity, Acceleration
panel = Panel(python.a)
panel_2 = Panel(nd.Displacement)
bang_2 = ExplodeTree(Data=panel)  # -> Branch0, Branch1
item = ListItem(List=panel_2, Index="1", Wrap=True)
merge = Merge(Data2=flatten(item))
data = Data(flatten(bang_2.Branch0))
data_2 = Data(flatten(merge))
model_view_alpaca4d = ModelViewAlpaca4d(
    AlpacaModel=ra.AlpacaModel,
    Extruded=Toggle(True),
    Load=False,
    LoadFactor=1,
    Support=False,
    SupportFactor=1,
    Constraint=False)  # -> AlpacaModel, Info
panel_3 = Panel(data_2)
panel_4 = Panel(data)
pdecon = Deconstruct(Point=panel_3)  # -> XComponent, YComponent, ZComponent
similar = Similarity(FirstNumber=pdecon.ZComponent, SecondNumber=panel_4, Threshold="3")  # -> Similarity, AbsoluteDifference
merge_2 = Merge(Data1=ColourSwatch(SwatchColor=RGB(255, 0, 0)), Data2=ColourSwatch(SwatchColor=RGB(77, 255, 0)))
item_2 = ListItem(List=merge_2, Index=similar.Similarity, Wrap=True)
legend = Legend(Colour=item_2, Tags=similar.Similarity, LegendType=1)
