# Grasshopper definition portal_frame.gh (Grasshopper 1.0.7)
# plug-ins: Karamba3D, Alpaca4d, BH.UI.Grasshopper

cross_section = CrossSectionKaramba3D(
    FamilyNameOfCrossSection="DefaultCroSec",
    Height_cm=9.6,
    UpperFlangeWidth_cm=10,
    LowerFlangeWidth_cm=10,
    UpperFlangeThickness_cm=0.8,
    LowerFlangeThickness_cm=0.8,
    WebThickness_cm=0.5,
    FilletRadius_cm=0,
    mode="I")
crv = Curve(<curve referenced from the Rhino model>)
pt = Point([<point referenced from the Rhino model> x2])
explode = Explode(Curve=crv, Recursive=True)  # -> Segments, Vertices
vec = VectorXYZ(XComponent="10", YComponent="10", ZComponent="10")  # -> Vector, Length
pt_2 = Point(<point referenced from the Rhino model>)
supp = SupportKaramba3D(PosInd=pt, menu=[buttons(on, on, on, on, on, on)])
loads = LoadsKaramba3D(ForceVector=vec.Vector, Local=False, PosInd=pt_2, LCase="LoadCase1", mode="Point")
linetobeam = LineToBeamKaramba3D(
    Line=explode.Segments,
    CrossSection=cross_section,
    New=True,
    Remove=True,
    LimitDistance_m=0.005,
    Bending=True,
    SetBucklingLength=True,
    ToPolylineMaxAngle=0.03,
    ToPolylineTolerance=0.01,
    ToPolylineMaxEdgeLength=0.25)  # -> Element, Points, Info
assemble = AssembleModelKaramba3D(Elem=linetobeam.Element, Support=supp, Load=loads, LimitDistance_m=0.005)  # -> Model, Info, Mass_kg, CenterOfGravity, LoadCaseNames
analyze = AnalyzeKaramba3D(Model=assemble.Model)  # -> CalculatedModel, MaximumDisplacement_cm, ResultingForceOfGravity_kN, ElasticEnergyChange_kNm
panel = Panel(analyze.MaximumDisplacement_cm)
disassemble = DisassembleModelKaramba3D(Model=analyze.CalculatedModel)  # -> Model, Point, Beam, Shell, Support, Load, Line, Mesh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
disassemble_2 = DisassembleElementKaramba3D(Element=disassemble.Beam)  # -> Element, ElementIdentifier, AxisOfElement, CrossSection, Joint, Material, LocalCoordinateSystem, ElementIsActive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
disassemble_3 = DisassembleCrossSectionKaramba3D(CroSec=disassemble_2.CrossSection)  # -> CrossSection, FamilyNameOfCrossSection, TypeNameOfCrossSection, ElemIdentifiers, Color, Material, LocalEccentricity_cm, Heights_cm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
item = ListItem(List=disassemble_3.Material, Index=0, Wrap=True)
num = Number(expr("x/100000000", disassemble_3.Izz_cm4))
num_2 = Number(expr("x/100000000", disassemble_3.Ipp_cm4))
num_3 = Number(expr("x/10000", disassemble_3.Area_cm2))
num_4 = Number(expr("x/10000", disassemble_3.AreaY_cm2))
num_5 = Number(expr("x/10000", disassemble_3.AreaZ_cm2))
num_6 = Number(expr("x/100000000", disassemble_3.Iyy_cm4))
disassemble_4 = DisassembleMaterialKaramba3D(Material=item)  # -> Material, TypeOfMaterial, FamilyNameOfMaterial, NameOfMaterial, ElemIdentifiers, Color, YoungsModulusKNCm2Dir12, InPlaneShearModulus_kN_cm2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
multiplication = Multiplication(A=disassemble_4.InPlaneShearModulus_kN_cm2, B="1e+7")
multiplication_2 = Multiplication(A=disassemble_4.YoungsModulusKNCm2Dir12, B="1e+7")
uniaxial_material_elastic = UniaxialMaterialElasticAlpaca4d(E=multiplication_2, G=multiplication, Rho=disassemble_4.SpecificWeight_kN_m3)
division = Division(A=num_4, B=num_3)
division_2 = Division(A=num_5, B=num_3)
generic_section = GenericSectionAlpaca4d(Area=num_3, Izz=num, Iyy=num_6, J=num_2, AlphaY=division, AlphaZ=division_2, Material=uniaxial_material_elastic)
constant_time_series = ConstantTimeSeriesAlpaca4d(LoadFactor=1)  # -> TimeSeries, Graph
multiplication_3 = Multiplication(A=vec.Vector, B="1000")
force_beam_column = ForceBeamColumnAlpaca4d(Line=disassemble_2.AxisOfElement, Section=generic_section)
support = SupportAlpaca4d(Point=pt, Tx=True, Ty=True, Tz=True, Rx=True, Ry=True, RZ=True)
point_load = PointLoadAlpaca4d(Point=pt_2, Force=multiplication_3, Moment=Vector(0, 0, 0), TimeSeries=constant_time_series.TimeSeries)
explode_2 = Explode(Object=generic_section, Component="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")  # -> SectionName, Area, Izz, Iyy, J, AlphaY, AlphaZ, Id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
assemble_model = AssembleModelAlpaca4d(Element=force_beam_column, Support=support, Load=point_load, Tollerance=0.01)  # -> AlpacaModel, MassForce
list = ValueList({"Linear", "Newton", "NewtonLineSearch", "ModifiedNewton", "KrylovNewton", "SecantNewton", "BFGS", "Broyden"}, selected="Linear")
analysissettings = AnalysisSettingsAlpaca4d(Algorithm=list)
ra = RunAnalysisAlpaca4d(AlpacaModel=assemble_model.AlpacaModel, Settings=analysissettings)  # -> Log, AlpacaModel
modelview = ModelViewAlpaca4d(
    AlpacaModel=ra.AlpacaModel,
    Extruded=Toggle(True),
    Load=False,
    LoadFactor=1,
    Support=False,
    SupportFactor=1,
    Constraint=False)  # -> AlpacaModel, Info
nd = NodalDisplacementsAlpaca4d(AlpacaModel=ra.AlpacaModel, History=False, Step=0)  # -> Displacement, Rotation, port, Velocity, Acceleration
nodedisp = NodalDisplacementsKaramba3D(AnalyzedModel=analyze.CalculatedModel)  # -> AnalyzedModel, NodalTranslations_m, NodalRotations_rad
vlen = VectorLength(Vector=nd.Displacement)
devec = DeconstructVector(Vector=nodedisp.NodalTranslations_m)  # -> XComponent, YComponent, ZComponent
devec_2 = DeconstructVector(Vector=nd.Displacement)  # -> XComponent, YComponent, ZComponent
similar = Similarity(FirstNumber=devec.XComponent, SecondNumber=devec_2.XComponent, Threshold="5")  # -> Similarity, AbsoluteDifference
similar_2 = Similarity(FirstNumber=devec.YComponent, SecondNumber=devec_2.YComponent, Threshold="5")  # -> Similarity, AbsoluteDifference
similar_3 = Similarity(FirstNumber=devec.ZComponent, SecondNumber=devec_2.ZComponent, Threshold="5")  # -> Similarity, AbsoluteDifference
entwine = Entwine(Branch00=similar.Similarity, Branch01=similar_2.Similarity, Branch02=similar_3.Similarity, FlattenInputs=True)  # -> flatten(Result)
merge = Merge(Data1=ColourSwatch(SwatchColor=RGB(255, 0, 0)), Data2=ColourSwatch(SwatchColor=RGB(77, 255, 0)))
item_2 = ListItem(List=merge, Index=entwine, Wrap=True)
legend = Legend(Colour=item_2, Tags=entwine, LegendType=1)
