# Grasshopper definition PortalFrame.gh (Grasshopper 1.0.7)
# plug-ins: Alpaca4d

rectanglehollowcs = RectangleHollowAlpaca4d(Width=0.3, Height=0.6, Web=0.02, TopFlange=0.02, BottomFlange=0.02)
i_section = ISectionAlpaca4d(Height=0.3, TopFlangeWidth=0.15, TopFlangeThickness=0.02, BottomFlangeWidth=0.2, BottomFlangeThickness=0.02, Web=0.02)
circlecs = CircleCSAlpaca4d(Diameter=0.15, Thickness=0.01)
pt = Point(Point(6, 0, 0))
rectanglecs = RectangleCSAlpaca4d(Width=0.3, Height=0.6)
pt_2 = Point(Point(0, 0, 0))
crv = Curve([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])
pt_3 = Point(Point(0, 0, 3))
X = UnitX(Factor="1000000")
divide = DivideCurve(Curve=crv, Count=10, Kinks=False)  # -> Points, Tangents, Parameters
merge = Merge(Data1=circlecs, Data2=i_section, Data3=rectanglecs)
graft = GraftTree(Tree=crv, IncludeEmptyLists=True, IncludeNullItems=True)
support = SupportAlpaca4d(Point=pt_2, Tx=True, Ty=True, Tz=True, Rx=True, Ry=True, RZ=True)
support_2 = SupportAlpaca4d(Point=pt, Tx=True, Ty=True, Tz=True, Rx=True, Ry=True, RZ=True)
point_load = PointLoadAlpaca4d(Point=pt_3, Force=X, Moment=Vector(0, 0, 0))
shatter = Shatter(Curve=graft, Parameters=divide.Parameters)
data = Data([support, support_2])
force_beam_column = ForceBeamColumnAlpaca4d(Line=shatter, Section=rectanglehollowcs)  # -> flatten(Element)
assemble_model = AssembleModelAlpaca4d(Element=force_beam_column, Support=data, Load=point_load, Tollerance=0.01)  # -> AlpacaModel, MassForce
analysissettings = AnalysisSettingsAlpaca4d()
modelview = ModelViewAlpaca4d(
    AlpacaModel=assemble_model.AlpacaModel,
    Extruded=Toggle(False),
    Load=Toggle(True),
    LoadFactor=1,
    Support=Toggle(True),
    SupportFactor=Slider(0.472, range=0..1),
    Constraint=False)  # -> AlpacaModel, Info
ra = RunAnalysisAlpaca4d(AlpacaModel=assemble_model.AlpacaModel, Settings=analysissettings)  # -> Log, AlpacaModel
nv = NaturalVibrationAnalysisAlpaca4d(AlpacaModel=assemble_model.AlpacaModel, VibrationModes="12", Solver="-fullGenLapack")  # -> Log, AlpacaModel, Eigenvalues, Period, Frequencies
number_slider = Slider(2, range=0..11)
nd = NodalDisplacementsAlpaca4d(AlpacaModel=ra.AlpacaModel, History=False, Step=0)  # -> Displacement, Rotation, port, Velocity, Acceleration
nd_2 = NodalDisplacementsAlpaca4d(AlpacaModel=nv.AlpacaModel, History=False, Step=number_slider)  # -> Displacement, Rotation, port, Velocity, Acceleration
vlen = VectorLength(Vector=nd.Displacement)
clr = ColorsAlpaca4d(GradientIndex=11)
clr_2 = ColorsAlpaca4d(GradientIndex=11)  # -> reverse(Colors)
bnd = Bounds(Numbers=vlen)
bnd_2 = Bounds(Numbers=nd_2.Displacement)
panel = Panel(bnd)
deformed_model_view = DeformedModelViewAlpaca4d(AlpacaModel=ra.AlpacaModel, Step=0, Scale=Slider(67, range=-100..100), Colors=clr, Range=bnd)  # -> Line, Mesh, Brick
deformed_model_view_2 = DeformedModelViewAlpaca4d(AlpacaModel=nv.AlpacaModel, Step=number_slider, Scale=Slider(69, range=-100..100), Colors=clr_2, Range=bnd_2)  # -> Line, Mesh, Brick
