# Grasshopper definition ShellNLDKGT.gh (Grasshopper 1.0.7)
# plug-ins: MeshEdit Components, Alpaca4d, Kangaroo2 Components

mplane = MeshPlane(Boundary={Plane=PlaneXY(0, 0, 0), Size=Domain2(u=-10..10, v=-10..10)}, WidthCount=10, HeightCount=10)  # -> Mesh, Area
explode = MeshExplode(Mesh=mplane.Mesh, Interpolate=False)
tri = Triangulate(Mesh=explode)  # -> Mesh, Count
jitter = Jitter(List=tri.Mesh, Jitter=1, Seed=2)  # -> Values, Indices
pfs = PlateFiberSectionAlpaca4d()
split = SplitList(List=jitter.Values, Index="20")  # -> ListA, ListB
constant_time_series = ConstantTimeSeriesAlpaca4d(LoadFactor=1)  # -> TimeSeries, Graph
mc = MeshCorners(Mesh=mplane.Mesh, Angle=2.35619449)
tri_2 = Triangulate(Mesh=split.ListB)  # -> Mesh, Count
Z = UnitZ(Factor=1)
demesh = DeconstructMesh(Mesh=mplane.Mesh)  # -> Vertices, Faces, Colours, Normals
explode_2 = MeshExplode(Mesh=tri_2.Mesh, Interpolate=False)  # -> flatten(Faces)
explode_3 = MeshExplode(Mesh=split.ListA, Interpolate=False)
asdq4 = ASDShellQ4Alpaca4d(Mesh=explode_3, Section=pfs)
point_load = PointLoadAlpaca4d(Point=demesh.Vertices, Force=Z, Moment=Vector(0, 0, 0), TimeSeries=constant_time_series.TimeSeries)
asdq4_2 = ASDShellQ4Alpaca4d(Mesh=explode_2, Section=pfs)
support = SupportAlpaca4d(Point=mc, Tx=True, Ty=True, Tz=True, Rx=True, Ry=True, RZ=True)
assemble_model = AssembleModelAlpaca4d(Element=flatten([asdq4, asdq4_2]), Support=support, Load=point_load, Tollerance=0.01)  # -> AlpacaModel, MassForce
panel = Panel(asdq4_2)
analysissettings = AnalysisSettingsAlpaca4d(AnalysisSteps="10")

# ---- group: Run Analysis (Alpaca4d)
ra = RunAnalysisAlpaca4d(AlpacaModel=assemble_model.AlpacaModel, Settings=analysissettings)  # -> Log, AlpacaModel

# ----
sf = ShellForcesAlpaca4d(History=False, Step=0)  # -> Fx, Fy, Fxy, Mx, My, Mxy, Vxz, Vyz
nd = NodalDisplacementsAlpaca4d(AlpacaModel=ra.AlpacaModel, History=False, Step=0)  # -> Displacement, Rotation, port, Velocity, Acceleration
modelview = ModelViewAlpaca4d(AlpacaModel=ra.AlpacaModel, Extruded=False, Load=False, LoadFactor=1, Support=False, SupportFactor=1, Constraint=False)  # -> AlpacaModel, Info
sf_2 = ShellForcesAlpaca4d(AlpacaModel=ra.AlpacaModel, History=False, Step=0)  # -> Fx, Fy, Fxy, Mx, My, Mxy, Vxz, Vyz
ss = ShellStressesAlpaca4d(AlpacaModel=ra.AlpacaModel, History=False, Step=0)  # -> Pxx, Pyy, Pxy, Mxx, Myy, Mxy, Vxz, Vyz
panel_2 = Panel(modelview.Info)
panel_3 = Panel(ss.Mxx)
