# Grasshopper definition 6x6-slab.gh (Grasshopper 1.0.7)
# plug-ins: Alpaca4d, MeshEdit Components, BH.UI.Grasshopper, Kangaroo2 Components

rectangle = Rectangle(Plane=PlaneXY(0, 0, 0), XSize="8", YSize="8", Radius=0)  # -> Rectangle, Length
panel = Panel("25000")  # "kg/m3"
panel_2 = Panel("250000")
division = Division(A=panel_2, B="1000")
mplane = MeshPlane(Boundary=rectangle.Rectangle, WidthCount="30", HeightCount="30")  # -> Mesh, Area
# Alpaca4d
panel_3 = Panel(division)  # "kN/m3"
mc = MeshCorners(Mesh=mplane.Mesh, Angle=2.35619449)
panel_4 = Panel("31000000000")
nv = NakedVertices(Mesh=mplane.Mesh)  # -> ClothedIndex, NakedIndex, ClothedPts, NakedPts
panel_5 = Panel("12916667000")
panel_6 = Panel("2500")  # "kg/m3"
point = Point(mc)
point_2 = Point(nv.NakedPts)
division_2 = Division(A=panel_4, B="2.6")
panel_7 = Panel(division_2)
toggle = BooleanToggle(True)
toggle_2 = BooleanToggle(True)
eim = ElasticIsotropicMaterialAlpaca4d(E=panel_4, G=panel_5, V="0.2", Rho=panel_6)
explode = Explode(Object=eim, Component="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")  # -> Id, MatName, E, G, Nu, Rho, MaterialDimension, MaterialType
support = SupportAlpaca4d(Point=point_2, Tx=toggle, Ty=toggle, Tz=toggle, Rx=toggle_2, Ry=toggle_2, RZ=toggle_2)
explode_2 = MeshExplode(Mesh=mplane.Mesh, Interpolate=False)  # -> flatten(Faces)
panel_8 = Panel([explode.MatName, explode.E, explode.G, explode.Nu, explode.Rho])
constant_time_series = ConstantTimeSeriesAlpaca4d(LoadFactor=1)  # -> TimeSeries, Graph
pfs = PlateFiberSectionAlpaca4d(SectionName="wall1", Thickness="0.3", Material=eim)
Z = UnitZ(Factor=1)
meshload = MeshLoadAlpaca4d(Force=Z, TimeSeries=constant_time_series.TimeSeries)
asdq4 = ASDShellQ4Alpaca4d(Mesh=explode_2, Section=pfs, Colour=ColourSwatch(SwatchColor=RGB(255, 59, 222)))
analysissettings = AnalysisSettingsAlpaca4d()
point_load = PointLoadAlpaca4d(Moment=Vector(0, 0, 0))
assemblemodel_alpaca4d = AssembleModelAlpaca4d(Element=asdq4, Support=support, Load=meshload, Tollerance=0.01)  # -> AlpacaModel, MassForce
linearload = LinearLoadAlpaca4d()
gravity_load = GravityLoadAlpaca4d(TimeSeriesType="Constant", GFactor=1)
analysissettings_2 = AnalysisSettingsAlpaca4d()
ra = RunAnalysisAlpaca4d(AlpacaModel=assemblemodel_alpaca4d.AlpacaModel, Settings=analysissettings)  # -> Log, AlpacaModel
number_slider = Slider(10, range=1..25)  # disabled
panel_9 = Panel("""-genBandArpack
-symmBandLapack
-fullGenLapack""")  # disabled
ra_2 = RunAnalysisAlpaca4d(AlpacaModel=assemblemodel_alpaca4d.AlpacaModel, Settings=analysissettings_2)  # -> Log, AlpacaModel
natural_vibration_analysis_alpaca4d = NaturalVibrationAnalysisAlpaca4d(AlpacaModel=assemblemodel_alpaca4d.AlpacaModel, VibrationModes=1, Solver="-fullGenLapack")  # -> Log, AlpacaModel, Eigenvalues, Period, Frequencies; disabled
panel_10 = Panel("30")  # disabled
item = ListItem(List=panel_9, Index=0, Wrap=True)  # disabled
nv_2 = NaturalVibrationAnalysisAlpaca4d(AlpacaModel=assemblemodel_alpaca4d.AlpacaModel, VibrationModes=panel_10, Solver=item)  # -> Log, AlpacaModel, Eigenvalues, Period, Frequencies; disabled
number_slider_2 = Slider(25, range=0..29)
nd = NodalDisplacementsAlpaca4d(AlpacaModel=ra_2.AlpacaModel, History=False, Step=0)  # -> Displacement, Rotation, port, Velocity, Acceleration
sf = ShellForcesAlpaca4d(AlpacaModel=ra.AlpacaModel, History=False, Step=0)  # -> Fx, Fy, Fxy, Mx, My, Mxy, Vxz, Vyz
panel_11 = Panel("""0
1
2""")
number_slider_3 = Slider(1000, range=1..1000)
mar = ModalAnalysisReportAlpaca4d(AlpacaModel=nv_2.AlpacaModel)  # -> EigenValueAnalysis, TotalMassOfStructure, TotalFreeMass, CenterOfMass, ModalParticipationFactors, ModalParticipationMasses, ModalParticipationMasses_Cumulative, ModalParticipationMassesRatio, ModalParticipationMassesRatio_Cumulative
clr = ColorsAlpaca4d(GradientIndex=Slider(9, range=0..12))
# Modal Analysis
panel_12 = Panel("100000000")
deformed_model_view = DeformedModelViewAlpaca4d(AlpacaModel=ra_2.AlpacaModel, Step=0, Scale=panel_12)  # -> Line, Mesh, Brick
deformed_model_view_2 = DeformedModelViewAlpaca4d(AlpacaModel=nv_2.AlpacaModel, Step=panel_11, Scale=Slider(201.47, range=0..10000), Colors=clr)  # -> Line, simplify(Mesh), Brick
nd_2 = NodalDisplacementsAlpaca4d(AlpacaModel=nv_2.AlpacaModel, History=False, Step=Slider(1, range=1..12))  # -> Displacement, Rotation, port, Velocity, Acceleration
panel_13 = Panel(mar.EigenValueAnalysis)
branch = TreeBranch(Tree=deformed_model_view_2.Mesh, Path=Slider(2, range=0..100), MaintainPaths=True)
branch_2 = TreeBranch(Tree=deformed_model_view_2.Mesh, Path=Slider(0, range=0..100), MaintainPaths=True)
item_2 = ListItem(Index=0, Wrap=True)
