# Grasshopper definition All_Element_Test2.gh (Grasshopper 1.0.7)
# plug-ins: Kangaroo2 Components, TetgenGH

numero_piani = Slider(5, range=0..100)
interasse_x = Slider(10, range=0..10)
interasse_y = Slider(4, range=0..10)
number_slider = Slider(0, range=0..10)
campate_y = Slider(4, range=0..10)
campate_x = Slider(3, range=0..10)
h_int = Slider(4, range=0..10)

series = Series(Start=0, Step=h_int, Count=numero_piani)
pt = ConstructPoint(XCoordinate=number_slider, YCoordinate=number_slider, ZCoordinate=number_slider)
X = UnitX(Factor=interasse_x)
move = Move(Geometry=pt, Motion=X)  # -> Geometry, Transform
series_2 = Series(Start=0, Step=interasse_y, Count=campate_y)
subtraction = Subtraction(A=campate_y, B=1)
ln = Line(StartPoint=pt, EndPoint=move.Geometry)
Y = UnitY(Factor=series_2)
move_2 = Move(Geometry=ln, Motion=Y)  # -> Geometry, Transform
addition = Addition(A=campate_x, B="1")
divide = DivideCurve(Curve=move_2.Geometry, Count=campate_x, Kinks=False)  # -> Points, Tangents, Parameters
shatter = Shatter(Curve=graft(move_2.Geometry), Parameters=divide.Parameters)
flip = FlipMatrix(Data=divide.Points)
pline = PolyLine(Vertices=flip, Closed=False)
Z = UnitZ(Factor=series)  # -> graft(UnitVector)
data = Data(flatten([shatter, pline]))
move_3 = Move(Geometry=data, Motion=Z)  # -> Geometry, Transform
explode = Explode(Curve=move_3.Geometry, Recursive=True)  # -> Segments, Vertices
end = EndPoints(Curve=ln)  # -> Start, End
trim = TrimTree(Tree=explode.Vertices, Depth=1)
duppt = RemoveDuplicatePts(Points=trim, Tolerance=0.01)
flip_2 = FlipMatrix(Data=duppt)
trim_2 = TrimTree(Tree=explode.Segments, Depth=1)
sort_pt = SortPoints(Points=duppt)  # -> Points, Indices
pline_2 = PolyLine(Vertices=flip_2, Closed=False)
split = SplitTree(Data=simplify(trim_2), Masks=flatten("{0}"))  # -> Positive, Negative
explode_2 = Explode(Curve=pline_2, Recursive=True)  # -> Segments, Vertices
srfgrid = SurfaceFromPoints(Points=sort_pt.Points, UCount=addition, Interpolate=False)
flip_3 = FlipMatrix(Data=explode_2.Segments)
mesh_uv = MeshSurface(Surface=srfgrid, UCount=subtraction, VCount=campate_x, Overhang=True, Equalize=False)  # -> flatten(Mesh)
explode_3 = Explode(Curve=flatten(split.Negative), Recursive=True)  # -> Segments, flatten(Vertices)
explode_4 = Explode(Curve=flatten(split.Positive), Recursive=True)  # -> Segments, flatten(Vertices)
duppt_2 = RemoveDuplicatePts(Points=explode_3.Vertices, Tolerance=0.01)
duppt_3 = RemoveDuplicatePts(Points=explode_4.Vertices, Tolerance=0.01)
item = ListItem(List=mesh_uv, Index="0", Wrap=True)
cull_i = CullIndex(List=mesh_uv, Indices="0", Wrap=True)
beam = Data(simplify(split.Negative))
nv = NakedVertices(Mesh=item)  # -> ClothedIndex, NakedIndex, ClothedPts, NakedPts
turn = MeshTurn(Mesh=cull_i)
dupln = RemoveDuplicateLines(Lines=beam, Tolerance=0.01)
data_2 = Data(nv.NakedPts)
fcircle = CircleFit(Points=data_2)  # -> Circle, Radius, Deviation
alongcrv = SortAlongCurve(Points=data_2, Curve=fcircle.Circle)  # -> Points, Indices
pline_3 = PolyLine(Vertices=alongcrv.Points, Closed=Toggle(True))  # -> reparameterize(Polyline)
explode_5 = Explode(Curve=pline_3, Recursive=True)  # -> Segments, Vertices
len = Length(Curve=explode_5.Segments)
area = Area(Geometry=pline_3)  # -> Area, Centroid
ma = MassAddition(Input=len)  # -> Result, PartialResults
dom = ConstructDomain(DomainStart="1", DomainEnd=Slider(5, range=0..100))
range = Range(Domain=dom, Steps="1")
eval = EvaluateLength(Curve=pline_3, Length=ma.PartialResults, Normalized=Toggle(False))  # -> Point, Tangent, Parameter
ins = InsertItems(List=eval.Parameter, Item="0", Indices="0", Wrap=True)
scale = Scale(Geometry=pline_3, Center=area.Centroid, Factor=range)  # -> Geometry, Transform
shatter_2 = Shatter(Curve=reparameterize(scale.Geometry), Parameters=ins)
flip_4 = FlipMatrix(Data=shatter_2)
loft = Loft(Curves=flip_4, Options={Adjust=False, Closed=False, LoftEnds=0, LoftSimp=0, LoftType=0, Rebuild=10, Refit=0.01})
number_slider_2 = Slider(4, range=0..10)
mesh_uv_2 = MeshSurface(Surface=loft, UCount=Slider(5, range=0..100), VCount="1", Overhang=True, Equalize=False)  # -> flatten(Mesh)
series_3 = Series(Start=0, Step=number_slider_2, Count=Slider(4, range=0..10))
mjoin = MeshJoin(Meshes=[item, mesh_uv_2])
Z_2 = UnitZ(Factor=series_3)
neg = Negative(Value=Z_2)
clean = CombineClean(Meshes=mjoin)
panel = Panel("2")
move_4 = Move(Geometry=clean, Motion=neg)  # -> Geometry, Transform
Z_3 = UnitZ(Factor=number_slider_2)
item_2 = ListItem(List=move_4.Geometry, Index=0, Wrap=True)  # -> Item1, Item
neg_2 = Negative(Value=Z_3)
move_5 = Move(Geometry=item_2.Item1, Motion=neg_2)  # -> Geometry, Transform
nv_2 = NakedVertices(Mesh=move_5.Geometry)  # -> ClothedIndex, NakedIndex, ClothedPts, NakedPts
nv_3 = NakedVertices(Mesh=item_2.Item1)  # -> ClothedIndex, NakedIndex, ClothedPts, NakedPts
mstb = MeshSeriesToBrickAlpaca4d(MeshSeries=move_4.Geometry)  # -> simplify(flatten(Brick)); inputs MeshSeries: list of Mesh
# ---------- mstb: Python ----------
"""Generate a Brick element from a list of mesh .
    the faces of the mesh '0' will be connected with the faces of the meshes '1' generating a brick element ( cube ).
    Attention : Each mesh in the list must have the same number of faces.
    Inputs:
        MeshSeries: quadMesh list with the same number of subdivisions .
    Output:
        Brick: Brick element --> Mesh with 6 faces and 8 nodes.
       """
import Rhino.Geometry as rg
import Grasshopper as gh

def MeshToShell(Mesh):
    
    Mesh.Unweld(0, True)
    mesh = Mesh.ExplodeAtUnweldedEdges()
    #print( len(mesh) )
    newMesh = []
    elementType = []
    for explodedMesh in mesh:
        newMesh.append(explodedMesh)
    return newMesh 

def brick( MeshList ):
    meshExpl = []
    Vertix = []
    elementType = []
    solid = []
    a = rg.Mesh.DuplicateMesh( MeshList[0] ) #.Unweld(0, True)
    a.Unweld(0, True)
    b = a.ExplodeAtUnweldedEdges()
    if len( b ) > 0 :
        for Mesh in MeshList:
            shellWrapper = MeshToShell(Mesh)
            meshExpl.append( shellWrapper )
        for index1 in range(0, len(MeshList)-1):
            for index2 in range(0, len(meshExpl[0])):
                if meshExpl[ index1 ][ index2 ].Vertices.Count == 4:
                    
                    elementType.append("stdBrick")
                    vertix1 = meshExpl[ index1 ][ index2 ].Vertices[0]
                    vertix2 = meshExpl[ index1 ][ index2 ].Vertices[1]
                    vertix3 = meshExpl[ index1 ][ index2 ].Vertices[2]
                    vertix4 = meshExpl[ index1 ][ index2 ].Vertices[3]
                    vertix5 = meshExpl[index1 + 1 ][ index2].Vertices[0]
                    vertix6 = meshExpl[index1 + 1 ][ index2].Vertices[1]
                    vertix7 = meshExpl[index1 + 1 ][ index2].Vertices[2]
                    vertix8 = meshExpl[index1 + 1 ][ index2].Vertices[3]
                    
                    vertix = [ vertix1, vertix2, vertix3, vertix4,
                    vertix5, vertix6, vertix7, vertix8 ]
                    
                    ele = rg.Mesh()
                    
                    ele.Vertices.Add( vertix1 ) # 0 
                    ele.Vertices.Add( vertix2 ) # 1
                    ele.Vertices.Add( vertix3 ) # 2
                    ele.Vertices.Add( vertix4 ) # 3
                    ele.Vertices.Add( vertix5 ) # 4
                    ele.Vertices.Add( vertix6 ) # 5
                    ele.Vertices.Add( vertix7 ) # 6
                    ele.Vertices.Add( vertix8 ) # 7
                    
                    ele.Faces.AddFace(0, 1, 2, 3) # 0
                    ele.Faces.AddFace(4, 5, 6, 7) # 1
                    ele.Faces.AddFace(0, 1, 5, 4) # 2
                    ele.Faces.AddFace(3, 2, 6, 7) # 3
                    ele.Faces.AddFace(1, 5, 6, 2) # 4
                    ele.Faces.AddFace(0, 4, 7, 3) # 5
                solid.append(ele)
                #ele.IsClosed()
                    
    else:
        for index1 in range(0, len(MeshList)-1):
            elementType.append("stdBrick")
            vertix1 = MeshList[ index1 ].Vertices[0]
            vertix2 = MeshList[ index1 ].Vertices[1]
            vertix3 = MeshList[ index1 ].Vertices[2]
            vertix4 = MeshList[ index1 ].Vertices[3]
            vertix5 = MeshList[index1 + 1 ].Vertices[0]
            vertix6 = MeshList[index1 + 1 ].Vertices[1]
            vertix7 = MeshList[index1 + 1 ].Vertices[2]
            vertix8 = MeshList[index1 + 1 ].Vertices[3]
            
            vertix = [ vertix1, vertix2, vertix3, vertix4,
            vertix5, vertix6, vertix7, vertix8 ]
            
            ele = rg.Mesh()
            
            ele.Vertices.Add( vertix1 ) # 0 
            ele.Vertices.Add( vertix2 ) # 1
            ele.Vertices.Add( vertix3 ) # 2
            ele.Vertices.Add( vertix4 ) # 3
            ele.Vertices.Add( vertix5 ) # 4
            ele.Vertices.Add( vertix6 ) # 5
            ele.Vertices.Add( vertix7 ) # 6
            ele.Vertices.Add( vertix8 ) # 7
            
            ele.Faces.AddFace(0, 1, 2, 3) # 0
            ele.Faces.AddFace(4, 5, 6, 7) # 1
            ele.Faces.AddFace(0, 1, 5, 4) # 2
            ele.Faces.AddFace(3, 2, 6, 7) # 3
            ele.Faces.AddFace(1, 5, 6, 2) # 4
            ele.Faces.AddFace(0, 4, 7, 3) # 5
            
            solid.append(ele)
            '''
            else :
                elementType.append(["FourNodeTetrahedron"]*3)
                
                if meshExpl[ index1 ][ index2 ].Vertices[0] == meshExpl[index1 + 1 ][ index2].Vertices[0] :
                    vertix1 = meshExpl[ index1 ][ index2 ].Vertices[0]
                    vertix2 = meshExpl[ index1 ][ index2 ].Vertices[1]
                    vertix3 = meshExpl[ index1 ][ index2 ].Vertices[2]
                    vertix4 = meshExpl[index1 + 1 ][ index2].Vertices[1]
                    vertix5 = meshExpl[index1 + 1 ][ index2].Vertices[2]
                    
                    vertixEle1 = [ vertix1, vertix2, vertix3, vertix4 ]
                    vertixEle2 = [ vertix1, vertix2, vertix3, vertix2 ]
                    
                    ele1 = rg.Mesh() # Tetrahedron 1
                    ele2 = rg.Mesh() # Tetrahedron 2
                    
                    ele1.Vertices.Add( vertix1 ) # 0 
                    ele1.Vertices.Add( vertix2 ) # 1
                    ele1.Vertices.Add( vertix3 ) # 2 
                    ele1.Vertices.Add( vertix4 ) # 3 
                    
                    ele1.VertexColors.Add(color)
                    ele1.VertexColors.Add(color)
                    ele1.VertexColors.Add(color)
                    ele1.VertexColors.Add(color)
                    
                    ele2.Vertices.Add( vertix1 ) # 0 
                    ele2.Vertices.Add( vertix2 ) # 1 
                    ele2.Vertices.Add( vertix3 ) # 2 
                    ele2.Vertices.Add( vertix2 ) # 3
    
                    ele2.VertexColors.Add(color)
                    ele2.VertexColors.Add(color)
                    ele2.VertexColors.Add(color)
                    ele2.VertexColors.Add(color)
                    
                    ele1.Faces.AddFace(0, 1, 4 ) # 0
                    ele1.Faces.AddFace(0, 1, 3 ) # 1
                    ele1.Faces.AddFace(0, 4, 3 ) # 2
                    ele1.Faces.AddFace(1, 3, 4 ) # 3
                    
                    ele2.Faces.AddFace(0, 1, 3 ) # 0
                    ele2.Faces.AddFace(0, 1, 2 ) # 1
                    ele2.Faces.AddFace(1, 2, 3 ) # 2
                    ele2.Faces.AddFace(0, 2, 3 ) # 3
                    
                    ele = [ ele1, ele2 ]
                    
                else :
                
                    vertix1 = meshExpl[ index1 ][ index2 ].Vertices[0]
                    vertix2 = meshExpl[ index1 ][ index2 ].Vertices[1]
                    vertix3 = meshExpl[ index1 ][ index2 ].Vertices[2]
                    vertix4 = meshExpl[index1 + 1 ][ index2].Vertices[0]
                    vertix5 = meshExpl[index1 + 1 ][ index2].Vertices[1]
                    vertix6 = meshExpl[index1 + 1 ][ index2].Vertices[2]
                    
                    vertixEle1 = [ vertix1, vertix2, vertix3, vertix6 ]
                    vertixEle2 = [ vertix4, vertix5, vertix6, vertix1 ]
                    vertixEle3 = [ vertix5, vertix6, vertix2, vertix1 ]
                    
                    vertix = [ vertixEle1, vertixEle2, vertixEle3 ]
                    
                    ele1 = rg.Mesh() # Tetrahedron 1
                    ele2 = rg.Mesh() # Tetrahedron 2
                    ele3 = rg.Mesh() # Tetrahedron 3
                    
                    ele1.Vertices.Add( vertix1 ) # 0 
                    ele1.Vertices.Add( vertix2 ) # 1
                    ele1.Vertices.Add( vertix3 ) # 2 
                    ele1.Vertices.Add( vertix6 ) # 3 
                    
                    ele1.VertexColors.Add(color)
                    ele1.VertexColors.Add(color)
                    ele1.VertexColors.Add(color)
                    ele1.VertexColors.Add(color)
                    
                    ele2.Vertices.Add( vertix4 ) # 0 
                    ele2.Vertices.Add( vertix5 ) # 1 
                    ele2.Vertices.Add( vertix6 ) # 2 
                    ele2.Vertices.Add( vertix1 ) # 3
    
                    ele2.VertexColors.Add(color)
                    ele2.VertexColors.Add(color)
                    ele2.VertexColors.Add(color)
                    ele2.VertexColors.Add(color)
                    
                    ele3.Vertices.Add( vertix5 ) # 0 
                    ele3.Vertices.Add( vertix6 ) # 1 
                    ele3.Vertices.Add( vertix2 ) # 2 
                    ele3.Vertices.Add( vertix1 ) # 3
                    
                    ele3.VertexColors.Add(color)
                    ele3.VertexColors.Add(color)
                    ele3.VertexColors.Add(color)
                    ele3.VertexColors.Add(color)
                    
                    ele1.Faces.AddFace(0, 1, 2 ) # 0
                    ele1.Faces.AddFace(0, 3, 1 ) # 1
                    ele1.Faces.AddFace(0, 3, 2 ) # 2
                    ele1.Faces.AddFace(1, 3, 2 ) # 3
                    
                    ele2.Faces.AddFace(0, 1, 2 ) # 0
                    ele2.Faces.AddFace(0, 3, 1 ) # 1
                    ele2.Faces.AddFace(0, 3, 2 ) # 2
                    ele2.Faces.AddFace(1, 3, 2 ) # 3
                    
                    ele3.Faces.AddFace(0, 1, 2 ) # 0
                    ele3.Faces.AddFace(0, 3, 1 ) # 1
                    ele3.Faces.AddFace(0, 3, 2 ) # 2
                    ele3.Faces.AddFace(1, 3, 2 ) # 3
                    
                    ele = [ ele1, ele2, ele3 ]
            
            solid.append(ele)
            Vertix.append( vertix )
            '''
    return solid

checkData = True

if not MeshSeries or len(MeshSeries) == 1 :  #is not None:
    checkData = False
    msg = "input 'MeshSeries' failed to collect data"
    ghenv.Component.AddRuntimeMessage( gh.Kernel.GH_RuntimeMessageLevel.Warning, msg )

if checkData != False:
    Brick= brick( MeshSeries )
# ---------- end mstb ----------
data_3 = Data(nv_2.NakedPts)
data_4 = Data(nv_3.NakedPts)
pline_4 = PolyLine(Vertices=nv_2.NakedPts, Closed=False)
fcircle_2 = CircleFit(Points=data_3)  # -> Circle, Radius, Deviation
fcircle_3 = CircleFit(Points=data_4)  # -> Circle, Radius, Deviation
alongcrv_2 = SortAlongCurve(Points=data_3, Curve=fcircle_2.Circle)  # -> Points, Indices
alongcrv_3 = SortAlongCurve(Points=data_4, Curve=fcircle_3.Circle)  # -> Points, Indices
pline_5 = PolyLine(Vertices=alongcrv_2.Points, Closed=Toggle(True))  # -> reparameterize(Polyline)
pline_6 = PolyLine(Vertices=alongcrv_3.Points, Closed=Toggle(True))  # -> reparameterize(Polyline)
explode_6 = Explode(Curve=pline_5, Recursive=True)  # -> Segments, Vertices
explode_7 = Explode(Curve=pline_6, Recursive=True)  # -> Segments, Vertices
entwine = Entwine(Branch00=explode_7.Segments, Branch01=explode_6.Segments, FlattenInputs=True)
flip_5 = FlipMatrix(Data=entwine)
loft_2 = Loft(Curves=flip_5, Options={Adjust=False, Closed=False, LoftEnds=0, LoftSimp=0, LoftType=0, Rebuild=10, Refit=0.01})
smesh = SimpleMesh(Brep=loft_2)
mjoin_2 = MeshJoin(Meshes=flatten([smesh, item_2.Item1, move_5.Geometry]))
clean_2 = CombineClean(Meshes=mjoin_2)
tetgen = Tetrahedralize(Mesh=clean_2, Flags="0", MinRatio=Slider(64, range=0..100))  # -> Mesh, Indices, Points
demesh = DeconstructMesh(Mesh=tetgen.Mesh)  # -> flatten(Vertices), Faces, Colours, Normals
duppt_4 = RemoveDuplicatePts(Points=demesh.Vertices, Tolerance=0.01)
pdecon = Deconstruct(Point=duppt_4)  # -> XComponent, YComponent, ZComponent
bnd = Bounds(Numbers=pdecon.ZComponent)
dedomain = DeconstructDomain(Domain=bnd)  # -> Start, End
smaller = SmallerThan(FirstNumber=dedomain.Start, SecondNumber=pdecon.ZComponent)  # -> SmallerThan, OrEqualTo
not = GateNot(A=smaller.SmallerThan)
cull = CullPattern(List=duppt_4, CullPattern=not)

load = Data(duppt_2)
travi = Data(dupln)
column = Data(flip_3)
brick = Data(mstb)
solaio = Data(turn)
tetraedri = Data(tetgen.Mesh)
support = Data(cull)
