# Grasshopper definition Domenico_developmentScript.gh (Grasshopper 1.0.7)
# plug-ins: Human, Weaverbird, Kangaroo2 Components, Pufferfish, karambaGH, MeshEdit Components, TetgenGH

# Format Engineers CAD Information Issue Disclaimer
# 
# Project: PROJECT NAME
# 
# You should use this model for reference purposes only to assist in co-ordinating your work and is supplementary to formally issued drawings. Once the data is introduced into your own CAD or other system Format Engineers Ltd. can take no responsibility for its accuracy.
# 
# The last set of formally issued paper drawings are the contractual documents which represent the current stage of design development. If you have any queries, please contact the project CAD co-ordinator or the CAD Development Team.
# 
# Changes:
# 
# YYYY-MM-DD: Summary of changes
# 
# Usage notes:
# 
# This definition includes a basic implementation of Merbarki's Farthest Point Seeding algorithm (2005), adapted for tracing lines of principal curvature on NURBS surfaces. Requires modified Triangle.NET, if this isn't attached then... good luck! There are currently two main limitations: (a) this implementation measures density in parameter space, and (b) it doesn't include the dynamic refinement of density that Mebarki suggests.
mesh = Mesh(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)
number_slider = Slider(4, range=0..10)
pt = ConstructPoint(XCoordinate=0, YCoordinate=0, ZCoordinate=0)
number_slider_2 = Slider(10, range=0..10)
pt_2 = ConstructPoint(XCoordinate=number_slider, YCoordinate=number_slider, ZCoordinate=number_slider)
line = LineSDL(Start=pt, Direction=Vector(0, 0, 1), Length=Slider(10, range=0..10))
# Closed mesh
mesh_2 = Mesh(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)
end = EndPoints(Curve=line)  # -> Start, End
crv = Curve(line)
Z = UnitZ(Factor=number_slider_2)
X = UnitX(Factor=number_slider_2)
number_slider_3 = Slider(2, range=0..10)
number_slider_4 = Slider(2, range=0..10)
tetgen = Tetrahedralize(Mesh=mesh_2, Flags="0", MinRatio=2)  # -> Mesh, Indices, Points

nv = NakedVertices()  # -> ClothedIndex, NakedIndex, ClothedPts, NakedPts
duppt = RemoveDuplicatePts(Points=nv.NakedPts, Tolerance=0.01)

move = Move(Geometry=pt_2, Motion=X)  # -> Geometry, Transform
data = Data(tetgen.Mesh)
series = Series(Start=0, Step=Slider(5, range=0..10), Count=number_slider_3)
addition = Addition(A=number_slider_4, B="1")
ln = Line(StartPoint=pt_2, EndPoint=move.Geometry)
crv_2 = Curve(reparameterize(ln))  # disabled
Y = UnitY(Factor=series)
pframe = PerpFrame(Curve=reparameterize(ln), Parameter="0.5")  # disabled
python = GhPythonScript(x=crv_2)  # -> out, a, b; inputs x: Curve; disabled
# ---------- python: Python ----------
__author__ = "domy7"
__version__ = "2021.04.03"

import cmath as mt
import Rhino.Geometry as rg
import rhinoscriptsyntax as rs
import Rhino.RhinoMath as rm

midPoint =  x.PointAtNormalizedLength(0.5)
parameter = x.ClosestPoint(midPoint, 0.01)[1]
a = rg.Curve.PerpendicularFrameAt( x, parameter )[1]
# ---------- end python ----------
move_2 = Move(Geometry=ln, Motion=Y)  # -> Geometry, Transform
deplane = DeconstructPlane(Plane=pframe)  # -> Origin, XAxis, YAxis, ZAxis; disabled
deplane_2 = DeconstructPlane(Plane=python.a)  # -> Origin, XAxis, YAxis, ZAxis; disabled
divide = DivideCurve(Curve=ln, Count=Slider(2, range=0..10), Kinks=False)  # -> Points, Tangents, Parameters
divide_2 = DivideCurve(Curve=move_2.Geometry, Count=number_slider_4, Kinks=False)  # -> Points, Tangents, Parameters
vdis = VectorDisplay(Anchor=pframe, Vector=deplane.XAxis)  # disabled
vdis_2 = VectorDisplay(Anchor=pframe, Vector=deplane_2.XAxis)  # disabled
flip = FlipMatrix(Data=divide_2.Points)
duppt_2 = RemoveDuplicatePts(Points=divide.Points, Tolerance=0.01)
panel = Panel("""0
-1""")
shatter = Shatter(Curve=move_2.Geometry, Parameters=divide_2.Parameters)
pline = PolyLine(Vertices=flip, Closed=False)
data_2 = Data(flatten([shatter, pline]))
cull_i = CullIndex(List=duppt_2, Indices=panel, Wrap=True)
shatter_2 = Shatter(Curve=ln, Parameters=divide.Parameters)  # -> reparameterize(Segments)
series_2 = Series(Start=0, Step=Slider(4, range=0..10), Count=Slider(1, range=0..100))
simplify = SimplifyCurve(Curve=reparameterize(graft(shatter_2)))  # -> flatten(Curve), Simplified
Z_2 = UnitZ(Factor=series_2)  # -> graft(UnitVector)

# ----
# nDMaterial
# ElasticIsotropic
python_2 = GhPythonScript(E="210", v="0.3", rho="7850")  # -> out, nDMaterial
# ---------- python_2: Python ----------
"""
Create a support
-
    Args:
        name:
        E:
        G:
        v:
        rho:
    Returns:
        nDMaterial:
"""


import sys
import Rhino.Geometry as rg
import Grasshopper as gh
import copy


## add alpaca install directory to system path

ghcompfolder = gh.Folders.DefaultAssemblyFolder
if ghcompfolder not in sys.path:
    sys.path.append(ghcompfolder)

try:
    from Alpaca4d import alpaca4d as alpaca
except:
    msg = "Cannot import Alpaca4d. Is the Alpaca4d folder available in " + ghcompfolder + "?"
    ghenv.Component.AddRuntimeMessage(gh.Kernel.GH_RuntimeMessageLevel.Error, msg)


checkData = True

if not E:
    checkData = False
    msg = "Input parameter E failed to collect data"
    ghenv.Component.AddRuntimeMessage(gh.Kernel.GH_RuntimeMessageLevel.Warning, msg)

if not G and not v:
    checkData = False
    msg = "Input parameter G or v failed to collect data"
    ghenv.Component.AddRuntimeMessage(gh.Kernel.GH_RuntimeMessageLevel.Warning, msg)

if not rho:
    checkData = False
    msg = "Input parameter rho failed to collect data"
    ghenv.Component.AddRuntimeMessage(gh.Kernel.GH_RuntimeMessageLevel.Warning, msg)

if checkData:
    nDMaterial = alpaca.ElasticIsotropic(name, E, G, rho, v)
# ---------- end python_2 ----------

sb = StandardBrickAlpaca4d(Brick=data, nDMaterial=python_2.nDMaterial)  # -> out, Element; inputs Brick: Mesh, Colour: Color
# ---------- sb: Python ----------
"""
Create a Standard Brick
-
    Args:
        Brick:
        nDMaterial:
        Colour:
    Returns:
        element:
"""

ghenv.Component.Name = "Standard Brick (Alpaca4d)"
ghenv.Component.NickName = 'SB'
ghenv.Component.Message = "Standard Brick\n (Alpaca4d)"


import sys
import Rhino.Geometry as rg
import Grasshopper as gh
import copy


## add alpaca install directory to system path

ghcompfolder = gh.Folders.DefaultAssemblyFolder
if ghcompfolder not in sys.path:
    sys.path.append(ghcompfolder)

try:
    from Alpaca4d import alpaca4d as alpaca
except:
    msg = "Cannot import Alpaca4d. Is the Alpaca4d folder available in " + ghcompfolder + "?"
    ghenv.Component.AddRuntimeMessage(gh.Kernel.GH_RuntimeMessageLevel.Error, msg)


checkData = True

if not Brick:
    checkData = False
    msg = "Input parameter Brick failed to collect data"
    ghenv.Component.AddRuntimeMessage(gh.Kernel.GH_RuntimeMessageLevel.Warning, msg)

if not nDMaterial:
    checkData = False
    msg = "Input parameter nDMaterial failed to collect data"
    ghenv.Component.AddRuntimeMessage(gh.Kernel.GH_RuntimeMessageLevel.Warning, msg)


if checkData:
    Element = alpaca.StdBrick(Brick, nDMaterial, Colour)
# ---------- end sb ----------
move_3 = Move(Geometry=data_2, Motion=Z_2)  # -> Geometry, Transform
explode = Explode(Curve=move_3.Geometry, Recursive=True)  # -> Segments, Vertices

mesh_3 = Mesh(mesh)  # disabled
bbox = BoundingBox(Content=mesh_3, Plane=PlaneXY(0, 0, 0), UnionBox=True)  # -> Box, Box_2; disabled

trim = TrimTree(Tree=explode.Vertices, Depth=1)
duppt_3 = RemoveDuplicatePts(Points=trim, Tolerance=0.01)
flip_2 = FlipMatrix(Data=duppt_3)
trim_2 = TrimTree(Tree=explode.Segments, Depth=1)

# ----
# Plate Fiber Section
python_3 = GhPythonScript(thickness="0.15", nDMaterial=python_2.nDMaterial)  # -> out, fiberSection
# ---------- python_3: Python ----------
"""
Create a support
-
    Args:
        secName:
        thickness:
        nDMaterial:
    Returns:
        fiberSection:
"""


import sys
import Rhino.Geometry as rg
import Grasshopper as gh
import copy


## add alpaca install directory to system path

ghcompfolder = gh.Folders.DefaultAssemblyFolder
if ghcompfolder not in sys.path:
    sys.path.append(ghcompfolder)

try:
    from Alpaca4d import alpaca4d as alpaca
except:
    msg = "Cannot import Alpaca4d. Is the Alpaca4d folder available in " + ghcompfolder + "?"
    ghenv.Component.AddRuntimeMessage(gh.Kernel.GH_RuntimeMessageLevel.Error, msg)


checkData = True

if not thickness:
    checkData = False
    msg = "Input parameter thickness failed to collect data"
    ghenv.Component.AddRuntimeMessage(gh.Kernel.GH_RuntimeMessageLevel.Warning, msg)

if not nDMaterial:
    checkData = False
    msg = "Input parameter nDMaterial failed to collect data"
    ghenv.Component.AddRuntimeMessage(gh.Kernel.GH_RuntimeMessageLevel.Warning, msg)

if checkData:
    fiberSection = alpaca.PlateFiberSection(secName, thickness, nDMaterial)
# ---------- end python_3 ----------

end_2 = EndPoints(Curve=ln)  # -> Start, End
sort_pt = SortPoints(Points=duppt_3)  # -> Points, Indices

panel_2 = Panel("0.15")  # disabled
offmsh = OffsetMesh(Mesh=mesh_3, Distance=panel_2, BothSides=False, CreateSolid=True)  # disabled
medges = MeshEdges(Mesh=offmsh)  # -> NakedEdges, InteriorEdges, NonManifoldEdges; disabled
swatch = ColourSwatch(SwatchColor=RGB(0, 0, 0))  # disabled
swatch_2 = ColourSwatch(SwatchColor=RGB(255, 255, 255))  # disabled
crv_3 = Curve(medges.NakedEdges)  # disabled
swatch_3 = ColourSwatch(SwatchColor=RGB(0, 0, 0))  # disabled
crv_4 = Curve(medges.InteriorEdges)  # disabled
panel_3 = Panel("3")  # disabled
panel_4 = Panel("1")  # disabled
previewlw = CustomPreviewLineweights(Geometry=crv_3, Shader=swatch, Thickness=panel_3, Absolute=False)  # disabled
previewlw_2 = CustomPreviewLineweights(Geometry=crv_4, Shader=swatch_3, Thickness=panel_4, Absolute=False)  # disabled
preview = CustomPreview(Geometry=offmsh, Material=swatch_2)  # disabled

pline_2 = PolyLine(Vertices=flip_2, Closed=False)
split = SplitTree(Data=simplify(trim_2), Masks=flatten("{0}"))  # -> Positive, Negative

wbnaked = WeaverbirdsNakedBoundary(MeshClosedPolylines=mesh_3)  # disabled
debrep = DeconstructBrep(Brep=bbox.Box)  # -> Faces, Edges, Vertices; disabled
splitatcorners = SplitAtCorners(Poly=wbnaked, Angle=1)  # -> Corners, Parts; disabled
curvepoint = PointOnCurve(splitatcorners.Parts, parameter=0.5)  # disabled
demesh = DeconstructMesh(Mesh=mesh_3)  # -> Vertices, Faces, Colours, Normals; disabled
crv_5 = Curve(debrep.Edges)  # disabled
offset = OffsetCurve(Curve=crv_5, Distance=1, Plane=PlaneXY(0, 0, 0), Corners=1)  # disabled
pdecon = Deconstruct(Point=demesh.Vertices)  # -> XComponent, YComponent, ZComponent; disabled
pdecon_2 = Deconstruct(Point=curvepoint)  # -> XComponent, YComponent, ZComponent; disabled
panel_5 = Panel("0.1")  # disabled
sort = SortList(Keys=pdecon.ZComponent, ValuesA=demesh.Vertices)  # -> Keys, ValuesA; disabled
larger = LargerThan(FirstNumber=pdecon_2.ZComponent, SecondNumber=panel_5)  # -> LargerThan, OrEqualTo; disabled
item = ListItem(List=reverse(sort.Keys), Index=0, Wrap=True)  # disabled
item_2 = ListItem(List=reverse(sort.ValuesA), Index=0, Wrap=True)  # disabled
cull = CullPattern(List=splitatcorners.Parts, CullPattern=larger.LargerThan)  # -> flatten(List); disabled
pt_3 = Point()  # disabled
join = JoinCurves(Curves=cull, Preserve=False)  # disabled
number_slider_5 = Slider(0.2, range=0.01..0.5)  # disabled
x_tremez = Extremes(Curve=join, Plane=PlaneXY(0, 0, 0))  # -> Highest, Lowest; disabled
panel_6 = Panel("0.30")  # disabled
pt_4 = Point(x_tremez.Highest)  # disabled
line_2 = LineSDL(Start=item_2, Direction=Vector(0, 0, 1), Length=panel_6)  # disabled
project = Project(Geometry=pt_4, Plane=PlaneXY(0, 0, 0))  # -> Geometry, Transform; disabled
ln_2 = Line(StartPoint=pt_4, EndPoint=project.Geometry)  # disabled
number_slider_6 = Slider(0.2, range=0.01..0.5)  # disabled
markdim = MarkerDimension(Line=line_2, Text="Z={2:0.0}", Size=number_slider_5)  # disabled
linedim = LineDimension(Line=ln_2, Text="{0:0.00}", Size=number_slider_6)  # disabled
linedim_2 = LineDimension(Line=offset, Text="{0:0.00}", Size=number_slider_5)  # disabled

# ----
# Support
toggle = BooleanToggle(True)
toggle_2 = BooleanToggle(True)
python_4 = GhPythonScript(Pos=[end_2.Start, end_2.End], Tx=toggle, Ty=toggle, Tz=toggle, Rx=toggle, Ry=toggle_2, Rz=toggle_2)  # -> Support; inputs Pos: Point3d, Tx: Boolean, Ty: Boolean, Tz: Boolean, Rx: Boolean, Ry: Boolean, Rz: Boolean
# ---------- python_4: Python ----------
from ghpythonlib.componentbase import executingcomponent as component
import Grasshopper, GhPython
import System
import Rhino
import rhinoscriptsyntax as rs

class MyComponent(component):
    
    def RunScript(self, Pos, Tx, Ty, Tz, Rx, Ry, Rz):
                
                
        import sys
        import Rhino.Geometry as rg
        import Grasshopper as gh
                
                
        ## add alpaca install directory to system path
                
        ghcompfolder = gh.Folders.DefaultAssemblyFolder
        if ghcompfolder not in sys.path:
            sys.path.append(ghcompfolder)
                
        try:
            from Alpaca4d import alpaca4d as alpaca
        except:
            msg = "Cannot import Alpaca4d. Is the Alpaca4d folder available in " + ghcompfolder + "?"
            ghenv.Component.AddRuntimeMessage(gh.Kernel.GH_RuntimeMessageLevel.Error, msg)
                
        checkData = True
                
        Tx = int(False) if Tx is None else int(Tx)
        Ty = int(False) if Ty is None else int(Ty)
        Tz = int(False) if Tz is None else int(Tz)
        Rx = int(False) if Rx is None else int(Rx)
        Ry = int(False) if Ry is None else int(Ry)
        Rz = int(False) if Rz is None else int(Rz)
                
                
        if not Pos:
            checkData = False
            msg = "Input parameter Pos failed to collect data"
            ghenv.Component.AddRuntimeMessage(gh.Kernel.GH_RuntimeMessageLevel.Warning, msg)
                
        if checkData:
            Support = alpaca.Support(Pos, Tx, Ty, Tz, Rx, Ry, Rz)
            return Support
        
        # return outputs if you have them; here I try it for you:
        return Support
# ---------- end python_4 ----------

explode_2 = Explode(Curve=pline_2, Recursive=True)  # -> Segments, Vertices
swatch_4 = ColourSwatch(SwatchColor=RGB(240, 0, 0))
flip_3 = FlipMatrix(Data=explode_2.Segments)
frompoints = MeshFromPoints(Points=sort_pt.Points, UDirection=addition, VDirection=number_slider_3)  # -> flatten(Mesh)

# ----
# Constant Time Series
# Linear Time Series
python_5 = GhPythonScript()  # -> timeSeries, Graph
# ---------- python_5: Python ----------
"""
Create a PointLoad
-
    Args:
        tStart:
        tEnd:
        period:
        factor:
        shift:
    Returns:
        timeSeries:
        Graph:
"""

import sys
import Rhino.Geometry as rg
import Grasshopper as gh
import copy
import math


## add alpaca install directory to system path

ghcompfolder = gh.Folders.DefaultAssemblyFolder
if ghcompfolder not in sys.path:
    sys.path.append(ghcompfolder)

try:
    from Alpaca4d import alpaca4d as alpaca
except:
    msg = "Cannot import Alpaca4d. Is the Alpaca4d folder available in " + ghcompfolder + "?"
    ghenv.Component.AddRuntimeMessage(gh.Kernel.GH_RuntimeMessageLevel.Error, msg)

def ConstantSeries(x):
    return x



checkData = True

if not constantFactor:
    constantFactor = 1


if checkData:
    timeSeries = alpaca.TimeSeriesConstant(constantFactor)
    
    Graph = []
    
    for x in range(10):
        Graph.append(ConstantSeries(constantFactor))
# ---------- end python_5 ----------
python_6 = GhPythonScript()  # -> timeSeries, Graph
# ---------- python_6: Python ----------
"""
Create a PointLoad
-
    Args:
        tStart:
        tEnd:
        period:
        factor:
        shift:
    Returns:
        timeSeries:
        Graph:
"""

import sys
import Rhino.Geometry as rg
import Grasshopper as gh
import copy
import math


## add alpaca install directory to system path

ghcompfolder = gh.Folders.DefaultAssemblyFolder
if ghcompfolder not in sys.path:
    sys.path.append(ghcompfolder)

try:
    from Alpaca4d import alpaca4d as alpaca
except:
    msg = "Cannot import Alpaca4d. Is the Alpaca4d folder available in " + ghcompfolder + "?"
    ghenv.Component.AddRuntimeMessage(gh.Kernel.GH_RuntimeMessageLevel.Error, msg)


def linearSeries(x):
    return x



checkData = True

if not linearFactor:
    linearFactor = 1




if checkData:
    timeSeries = alpaca.TimeSeriesLinear(linearFactor)
    
    Graph = []
    
    for x in range(10):
        Graph.append(linearSeries(x * linearFactor))
# ---------- end python_6 ----------

explode_3 = Explode(Curve=flatten(split.Negative), Recursive=True)  # -> Segments, flatten(Vertices)
explode_4 = Explode(Curve=flatten(split.Positive), Recursive=True)  # -> Segments, flatten(Vertices)
eim = ElasticIsotropicMaterialAlpaca4d()  # -> out, nDMaterial
# ---------- eim: Python ----------
"""
Create a nD Elastic Isotropic Material
-
    Args:
        name:
        E:
        G:
        v:
        rho:
    Returns:
        nDMaterial:
"""

ghenv.Component.Name = "Elastic Isotropic Material (Alpaca4d)"
ghenv.Component.NickName = 'EIM'
ghenv.Component.Message = "Elastic Isotropic Material\n (Alpaca4d)"


import sys
import Rhino.Geometry as rg
import Grasshopper as gh
import copy


## add alpaca install directory to system path

ghcompfolder = gh.Folders.DefaultAssemblyFolder
if ghcompfolder not in sys.path:
    sys.path.append(ghcompfolder)

try:
    from Alpaca4d import alpaca4d as alpaca
except:
    msg = "Cannot import Alpaca4d. Is the Alpaca4d folder available in " + ghcompfolder + "?"
    ghenv.Component.AddRuntimeMessage(gh.Kernel.GH_RuntimeMessageLevel.Error, msg)


checkData = True

if not E:
    checkData = False
    msg = "Input parameter E failed to collect data"
    ghenv.Component.AddRuntimeMessage(gh.Kernel.GH_RuntimeMessageLevel.Warning, msg)

if not G and not v:
    checkData = False
    msg = "Input parameter G or v failed to collect data"
    ghenv.Component.AddRuntimeMessage(gh.Kernel.GH_RuntimeMessageLevel.Warning, msg)

if not rho:
    checkData = False
    msg = "Input parameter rho failed to collect data"
    ghenv.Component.AddRuntimeMessage(gh.Kernel.GH_RuntimeMessageLevel.Warning, msg)

if checkData:
    nDMaterial = alpaca.ElasticIsotropic(name, E, G, rho, v)
# ---------- end eim ----------
cull_i_2 = CullIndex(List=frompoints, Indices="0", Wrap=True)
duppt_4 = RemoveDuplicatePts(Points=explode_3.Vertices, Tolerance=0.01)
duppt_5 = RemoveDuplicatePts(Points=explode_4.Vertices, Tolerance=0.01)
explode_5 = MeshExplode(Mesh=cull_i_2, Interpolate=False)
support = Data(duppt_5)
beam = Data(simplify(split.Negative))
load = Data(duppt_4)
column = Data(flip_3)
turn = MeshTurn(Mesh=explode_5)

# ----
# Mesh to Shell
# ShellMITC4, ShellNLDKGT
python_7 = GhPythonScript(Mesh=turn, CrossSection=python_3.fiberSection)  # -> out, Shell; inputs Mesh: Mesh, Colour: Color
# ---------- python_7: Python ----------
"""
Create a support
-
    Args:
        Mesh:
        CrossSection:
        Colour:
    Returns:
        Shell:
"""


import sys
import Rhino.Geometry as rg
import Grasshopper as gh
import copy
from System.Drawing import Color


## add alpaca install directory to system path

ghcompfolder = gh.Folders.DefaultAssemblyFolder
if ghcompfolder not in sys.path:
    sys.path.append(ghcompfolder)

try:
    from Alpaca4d import alpaca4d as alpaca
except:
    msg = "Cannot import Alpaca4d. Is the Alpaca4d folder available in " + ghcompfolder + "?"
    ghenv.Component.AddRuntimeMessage(gh.Kernel.GH_RuntimeMessageLevel.Error, msg)


checkData = True

if not Mesh:
    checkData = False
    msg = "Input parameter Mesh failed to collect data"
    ghenv.Component.AddRuntimeMessage(gh.Kernel.GH_RuntimeMessageLevel.Warning, msg)

if not CrossSection:
    checkData = False
    msg = "Input parameter CrossSection failed to collect data"
    ghenv.Component.AddRuntimeMessage(gh.Kernel.GH_RuntimeMessageLevel.Warning, msg)

if not Colour:
    Colour = Color.Blue


if checkData:
    
    Mesh.Unweld(0,True)
    explodedMesh = Mesh.ExplodeAtUnweldedEdges()
    if explodedMesh.Length > 0:
        Shell = []
        for mesh in explodedMesh:
            if mesh.Vertices.Count == 4:
                Shell.append(alpaca.ShellMITC4(mesh, copy.deepcopy(CrossSection), Colour))
            elif mesh.Vertices.Count == 3:
                Shell.append(alpaca.ShellNLDKGT(mesh, copy.deepcopy(CrossSection), Colour))
    elif explodedMesh.Length == 0:
        if Mesh.Vertices.Count == 4:
                Shell = alpaca.ShellMITC4(Mesh, copy.deepcopy(CrossSection), Colour)
        elif Mesh.Vertices.Count == 3:
            Shell = alpaca.ShellNLDKGT(Mesh, copy.deepcopy(CrossSection), Colour)
    
    #Vertices = Shell.Mesh.Vertices.ToPoint3dArray()
# ---------- end python_7 ----------

python_8 = GhPythonScript(Mesh=turn, CrossSection=python_3.fiberSection, Colour=ColourSwatch(SwatchColor=RGB(240, 0, 0)))  # -> out, Shell; inputs Mesh: Mesh, Colour: Color; same code as python_7

# ----
# uniAxial
panel_7 = Panel("80760")
ghpython_script = GhPythonScript(name="S235", E="210", eta=Slider(9.55, range=5..20), G=panel_7, v="0.3", rho="2500")  # -> out, steel
# ---------- ghpython_script: Python ----------
try:
    from Alpaca4d import alpaca4d as alpaca
except:
    msg = "Cannot import Alpaca4d. Is the Alpaca4d folder available in " + ghcompfolder + "?"
    ghenv.Component.AddRuntimeMessage(gh.Kernel.GH_RuntimeMessageLevel.Error, msg)

steel = alpaca.uniAxialMaterialElastic(name, E, Eneg, eta, G, v, rho)


print(steel.Eneg)



print(steel.write_tcl())
# ---------- end ghpython_script ----------

sb_2 = StandardBrickAlpaca4d()  # -> out, Element; inputs Brick: Mesh, Colour: Color; same code as sb
dupln = RemoveDuplicateLines(Lines=beam, Tolerance=0.01)
number_slider_7 = Slider(1, range=0..1)
panel_8 = Panel("section")

# ----
# PointLoad
panel_9 = Panel("-1000")
vec = VectorXYZ(XComponent="0", YComponent="0", ZComponent="-300")  # -> Vector, Length
python_9 = GhPythonScript(Pos=cull_i, Force=vec.Vector, TimeSeries=python_6.timeSeries)  # -> out, PointLoad; inputs Pos: Point3d, Force: Vector3d, Moment: Vector3d
# ---------- python_9: Python ----------
"""
Create a PointLoad
-
    Args:
        Pos:
        Force:
        Moment:
        TimeSeries:
    Returns:
        PointLoad:
"""

import sys
import Rhino.Geometry as rg
import Grasshopper as gh
import copy


## add alpaca install directory to system path

ghcompfolder = gh.Folders.DefaultAssemblyFolder
if ghcompfolder not in sys.path:
    sys.path.append(ghcompfolder)

try:
    from Alpaca4d import alpaca4d as alpaca
except:
    msg = "Cannot import Alpaca4d. Is the Alpaca4d folder available in " + ghcompfolder + "?"
    ghenv.Component.AddRuntimeMessage(gh.Kernel.GH_RuntimeMessageLevel.Error, msg)


checkData = True

if not Pos:
    checkData = False
    msg = "Input parameter Pos failed to collect data"
    ghenv.Component.AddRuntimeMessage(gh.Kernel.GH_RuntimeMessageLevel.Warning, msg)

if not Force:
    Force = rg.Vector3d(0.0,0.0,0.0)

if not Moment:
    Moment = rg.Vector3d(0.0,0.0,0.0)

if not TimeSeries:
    checkData = False
    msg = "Input parameter TimeSeries failed to collect data"
    ghenv.Component.AddRuntimeMessage(gh.Kernel.GH_RuntimeMessageLevel.Warning, msg)


if checkData:
    PointLoad = alpaca.PointLoad(Pos, Force, Moment, TimeSeries)
# ---------- end python_9 ----------

circle_cross_section = CircleCrossSectionAlpaca4d(d=Slider(0.5, range=0..1), t=Slider(0.01, range=0..0.01), material=ghpython_script.steel)  # -> out, CrossSection
# ---------- circle_cross_section: Python ----------
"""
Create a Circle Cross Section
-
    Args:
        secName:
        Area:
        Izz:
        Iyy:
        J:
        alphaY:
        alphaZ:
        material:
    Returns:
        genericSection:
"""


import sys
import Rhino.Geometry as rg
import Grasshopper as gh
import copy


## add alpaca install directory to system path

ghcompfolder = gh.Folders.DefaultAssemblyFolder
if ghcompfolder not in sys.path:
    sys.path.append(ghcompfolder)

try:
    from Alpaca4d import alpaca4d as alpaca
except:
    msg = "Cannot import Alpaca4d. Is the Alpaca4d folder available in " + ghcompfolder + "?"
    ghenv.Component.AddRuntimeMessage(gh.Kernel.GH_RuntimeMessageLevel.Error, msg)


checkData = True

if not d:
    checkData = False
    msg = "Input parameter d failed to collect data"
    ghenv.Component.AddRuntimeMessage(gh.Kernel.GH_RuntimeMessageLevel.Warning, msg)

if not t:
    checkData = False
    msg = "Input parameter t failed to collect data"
    ghenv.Component.AddRuntimeMessage(gh.Kernel.GH_RuntimeMessageLevel.Warning, msg)

if not material:
    checkData = False
    msg = "Input parameter material failed to collect data"
    ghenv.Component.AddRuntimeMessage(gh.Kernel.GH_RuntimeMessageLevel.Warning, msg)



if checkData:
    circleCS = alpaca.CircleCS(d,t,material)
    CrossSection = alpaca.ElasticSection(secName, circleCS.Area(), circleCS.Izz(), circleCS.Iyy(), circleCS.J(), circleCS.alphaY, circleCS.alphaZ, circleCS.material)
    CrossSection.sectionBrep = circleCS.sectionBrep
# ---------- end circle_cross_section ----------
rectangular_cross_section = RectangularCrossSectionAlpaca4d(b=Slider(0.3, range=0..1), h=Slider(0.7, range=0..1), material=ghpython_script.steel)  # -> out, CrossSection
# ---------- rectangular_cross_section: Python ----------
"""
Create a Rectangular Cross Section
-
    Args:
        secName:
        Area:
        Izz:
        Iyy:
        J:
        alphaY:
        alphaZ:
        material:
    Returns:
        genericSection:
"""


import sys
import Rhino.Geometry as rg
import Grasshopper as gh
import copy


## add alpaca install directory to system path

ghcompfolder = gh.Folders.DefaultAssemblyFolder
if ghcompfolder not in sys.path:
    sys.path.append(ghcompfolder)

try:
    from Alpaca4d import alpaca4d as alpaca
except:
    msg = "Cannot import Alpaca4d. Is the Alpaca4d folder available in " + ghcompfolder + "?"
    ghenv.Component.AddRuntimeMessage(gh.Kernel.GH_RuntimeMessageLevel.Error, msg)


checkData = True

if not b:
    checkData = False
    msg = "Input parameter b failed to collect data"
    ghenv.Component.AddRuntimeMessage(gh.Kernel.GH_RuntimeMessageLevel.Warning, msg)

if not h:
    checkData = False
    msg = "Input parameter h failed to collect data"
    ghenv.Component.AddRuntimeMessage(gh.Kernel.GH_RuntimeMessageLevel.Warning, msg)

if not material:
    checkData = False
    msg = "Input parameter material failed to collect data"
    ghenv.Component.AddRuntimeMessage(gh.Kernel.GH_RuntimeMessageLevel.Warning, msg)



if checkData:
    rectCS = alpaca.RectangularCS(b,h,material)
    CrossSection = alpaca.ElasticSection(secName, rectCS.Area(), rectCS.Izz(), rectCS.Iyy(), rectCS.J(), rectCS.alphaY, rectCS.alphaZ, rectCS.material)
    CrossSection.sectionBrep = rectCS.sectionBrep
# ---------- end rectangular_cross_section ----------
swatch_5 = ColourSwatch(SwatchColor=RGB(153, 11, 11))
ghpython_script_2 = GhPythonScript(Line=column, CrossSection=circle_cross_section.CrossSection, Colour=swatch_5)  # -> out, element; inputs Line: Curve, Colour: Color, Orient: Boolean
# ---------- ghpython_script_2: Python ----------
try:
    from Alpaca4d import alpaca4d as alpaca
except:
    msg = "Cannot import Alpaca4d. Is the Alpaca4d folder available in " + ghcompfolder + "?"
    ghenv.Component.AddRuntimeMessage(gh.Kernel.GH_RuntimeMessageLevel.Error, msg)
import copy


newCrossSection = copy.deepcopy(CrossSection)

if not Colour:
    Colour = Color.Red

if Orient is None:
    Orient = 0.0

element = alpaca.ForceBeamColumn(Line, newCrossSection, Colour, Orient)
# ---------- end ghpython_script_2 ----------
ghpython_script_3 = GhPythonScript(Line=column, CrossSection=circle_cross_section.CrossSection, Colour=swatch_5)  # -> out, element; inputs Line: Curve, Colour: Color, Orient: Boolean
# ---------- ghpython_script_3: Python ----------
import Grasshopper

try:
    from Alpaca4d import alpaca4dView as alpacaview
except:
    msg = "Cannot import Alpaca4d. Is the Alpaca4d folder available in " + ghcompfolder + "?"
    ghenv.Component.AddRuntimeMessage(gh.Kernel.GH_RuntimeMessageLevel.Error, msg)
# ---------- end ghpython_script_3 ----------
ghpython_script_4 = GhPythonScript(Line=shatter_2, CrossSection=rectangular_cross_section.CrossSection, Colour=ColourSwatch(SwatchColor=RGB(255, 223, 64)))  # -> out, element; inputs Line: Curve, Colour: Color, Orient: Boolean; same code as ghpython_script_2

# ----
# tcl
python_10 = GhPythonScript(Element=flatten(ghpython_script_4.element), Support=flatten(python_4), Load=flatten(python_9.PointLoad))  # -> out, model, mass; inputs Element: list, Support: list, Load: list, Constraint: list
# ---------- python_10: Python ----------
import os
from Alpaca4d import alpaca4d as alpaca
import ghpythonlib.treehelpers as th
import Rhino.Geometry as rg
import rhinoscriptsyntax as rs
from collections import defaultdict, OrderedDict
import copy
import time



FolderPath = rs.DocumentPath()
os.chdir(FolderPath)

# create the object model
model = alpaca.Model()


start = time.clock()
#subdivide element per type

for element in Element:
    if element.type == "Beam":
        model.beams.append(element)
    elif element.type == "Shell":
        model.shells.append(element)
    elif element.type == "Brick":
        model.bricks.append(element)

end = time.clock() - start

print("time to subdivide element {}".format(end))

# create a list of unique point
# need to add the rigid constraint

model.getuniquePoints(model.beams, model.shells, model.bricks, model.constraints)


end = time.clock() - end

print("time to get uniquepoints {}".format(end))

#############
# create node and assign to object
#############

if model.uniquePointsThreeNDF:
    model.py.append(alpaca.Model.write3nd_tcl())
    for point in model.uniquePointsThreeNDF:
        node = alpaca.Node(point)
        node.ndf = 3
        node.setNodeTag(model.cloudPoint)
        model.nodes.append( node )
    
        model.py.append(node.write_tcl())

if model.uniquePointsSixNDF:
    model.py.append(alpaca.Model.write6ndf_tcl())
    for point in model.uniquePointsSixNDF:
        node = alpaca.Node(point)
        node.ndf = 6
        node.setNodeTag(model.cloudPoint)
        model.nodes.append( node )
     
        model.py.append(node.write_tcl())



#a = model.sixNDFModel
#b = model.threeNDFModel

#################
# create supports
#################

for supportNode in Support:
    if model.uniquePointsThreeNDF.Contains(supportNode.Pos):
        supportNode.ndf = 3
        model.threeNDFModel.append(supportNode)
    elif model.uniquePointsSixNDF.Contains(supportNode.Pos):
        supportNode.ndf = 6
        model.sixNDFModel.append(supportNode)
    else:
        raise ValueError('I can not find the node at location {0}'.format(supportNode.Pos.ToString()))
    
    supportNode.setNodeTag(model.cloudPoint)
    model.supports.append(supportNode)
    model.py.append(supportNode.write_tcl())



####################
# create constraints
####################


for constraint in Constraint:
    constraint.setNodeTag(model.cloudPoint)
    model.constraints.append(constraint)


# write py file


# assign tag and node Index to element and shell
for index, element in enumerate(Element,1):
    element.setTopology(model.cloudPoint)
    element.eleTag = index
    # assign the same eleTag at the rest
    element.setTags()


## load

for item in Load:
    item.setNodeTag(model.cloudPoint)
    model.loads.append(item)

for item in model.beams:
    model.py.append(item.write_tcl())

for item in model.shells:
    model.py.append(item.write_tcl())


for item in Constraint:
    model.py.append(item.write_tcl())


timeSeriesDict = alpaca.TimeSeries.getTimeSeries(Load)[1]

model.py.append(alpaca.PointLoad.write_tcl(timeSeriesDict, model))
# ---------- end python_10 ----------

as = AnalysisSettingsAlpaca4d(Algorithm="KrylovNewton", AnalysisSteps="5")  # -> out, Analysis
# ---------- as: Python ----------
"""
Create Analysis settings
-
    Args:
        Constraint: 'Plain', 'Transformation'. Default is 'Transformation'.
        Numberer: 'RCM', 'AMD', 'Plain'. Default is 'RCM'.
        System: 'BandGen', 'BandSPD', 'ProfileSPD', 'SuperLU', 'UmfPack', 'FullGeneral', 'SparseSYM'. Default is 'BandSPD'.
        Test: Feature not implemented. Please contact alpaca4d@gmail.com 
        Algorithm: 'Linear', 'Newton', 'NewtonLineSearch', 'ModifiedNewton', 'KrylovNewton', 'SecantNewton', 'BFGS', 'Broyden'. Default is 'Linear'.
        Integrator: Default is LoadControl.
        AnalysisType: 'Static', 'Transient'. Default is 'Static'.
        AnalyesSteps:
    Returns:
        Analysis:
"""

import sys
import os


import clr
import clrtype
import Rhino.Geometry as rg
import rhinoscriptsyntax as rs
import Grasshopper as gh
import copy
import ghpythonlib.treehelpers as th


ghenv.Component.Name = "Analysis settings (Alpaca4d)"
ghenv.Component.NickName = 'AS'
ghenv.Component.Message = "Analysis settings \n(Alpaca4d)"



from Alpaca4d import alpaca4d as alpaca

checkData = True


# default Value
Constraint = 'Transformation' if Constraint is None else Constraint
ConstraintList = ['Plain', 'Transformation']

for item in ConstraintList:
    if Constraint.lower() == item.lower():
        print(item)
        Constraint = item


# default Value
Numberer = 'RCM' if Numberer is None else Numberer
NumbererList = ['RCM', 'AMD', 'Plain', 'ParallelPlain', 'ParallelRCM']

for i,item in enumerate(NumbererList):
    if Numberer.lower() == item.lower():
        Numberer = item



# default Value
System = 'BandSPD' if System is None else System
SystemList = ['BandGen', 'BandSPD', 'ProfileSPD', 'SuperLU', 'UmfPack', 'FullGeneral', 'SparseSYM']

for i,item in enumerate(SystemList):
    if System.lower() == item.lower():
        System = item


# default Test
Test = 'NormDispIncr 1.0e-6 12 5' if Test is None else Test




# default Value
Algorithm = 'Linear' if Algorithm is None else Algorithm
AlgorithmList = ['Linear', 'Newton', 'NewtonLineSearch', 'ModifiedNewton', 'KrylovNewton', 'SecantNewton', 'BFGS', 'Broyden']

for i,item in enumerate(AlgorithmList):
    if Algorithm.lower() == item.lower():
        Algorithm = item


# default Value
AnalysisType = 'Static' if AnalysisType is None else AnalysisType
AnalysisTypeList = ['Static', 'Transient']

for item in AnalysisTypeList:
    if AnalysisType.lower() == item.lower():
        AnalysisType = item


## Define Integrator
if AnalysisType == "Static":
    Integrator = "LoadControl 1.0" if Integrator is None else Integrator
elif AnalysisType == "Transien":
    Integrator = "Newmark 0.5 0.25" if Integrator is None else Integrator



if not AnalysisSteps:
    checkData = False
    msg = "Input parameter AnalysisSteps failed to collect data"
    ghenv.Component.AddRuntimeMessage(gh.Kernel.GH_RuntimeMessageLevel.Warning, msg)


if checkData:
    Analysis = alpaca.Analysis(Constraint, Numberer,System,Test,Algorithm,Integrator,AnalysisType, AnalysisSteps)
    print(Analysis.write_tcl())
# ---------- end as ----------
as_2 = AnalysisSettingsAlpaca4d(Algorithm="KrylovNewton", AnalysisSteps="5")  # -> out, Analysis; same code as as
ra = RunAnalysisAlpaca4d(AlpacaModel=python_10.model, Analysis=as_2.Analysis)  # -> out, AlpacaSolvedModel
# ---------- ra: Python ----------
"""
Run an OpenSees Analysis
-
    Args:
        AlpacaModel:
        Analysis:
    Returns:
        AlpacaSolvedModel:
"""



import Rhino.RhinoDoc
import Grasshopper as gh
import copy
import rhinoscriptsyntax as rs
import os
import time
import sys



ghenv.Component.Name = "Run Analysis (Alpaca4d)"
ghenv.Component.NickName = 'RA'
ghenv.Component.Message = "Run Analysis \n(Alpaca4d)"

ghcompfolder = gh.Folders.DefaultAssemblyFolder
if ghcompfolder not in sys.path:
    sys.path.append(ghcompfolder)

try:
    from Alpaca4d import alpaca4d as alpaca
except:
    msg = "Cannot import Alpaca4d. Is the Alpaca4d folder available in " + ghcompfolder + "?"
    ghenv.Component.AddRuntimeMessage(gh.Kernel.GH_RuntimeMessageLevel.Error, msg)


checkData = True



if not AlpacaModel:
    checkData = False
    msg = "Input parameter AlpacaModel failed to collect data"
    ghenv.Component.AddRuntimeMessage(gh.Kernel.GH_RuntimeMessageLevel.Warning, msg)


if not Analysis:
    checkData = False
    msg = "Input parameter Analysis failed to collect data"
    ghenv.Component.AddRuntimeMessage(gh.Kernel.GH_RuntimeMessageLevel.Warning, msg)


if checkData:
    FolderPath = rs.DocumentPath()
    os.chdir(FolderPath)
    
    outputFileName = 'openSeesModel'
    
    for dirpath, dirnames, filenames in os.walk(FolderPath):
        for filename in filenames:
            if filename == outputFileName:
                file = os.path.join(dirpath,outputFileName)
                os.remove(file)
    
    
    # create a copy
    
    AnalysisModel = copy.copy(AlpacaModel)
    AnalysisModel.py = list(AnalysisModel.py)
    
    # generate Recorder and assign name
    AnalysisModel.recorderName = "recorder" + ".mpco"
    
    AnalysisModel.py.append(alpaca.TCLRecorder.mpco(AnalysisModel.recorderName, True,True,True,True,False,False,True,True,True,True))
    
    
    AnalysisModel.analysis = Analysis
    AnalysisModel.py.append(Analysis.write_tcl())
    #AnalysisModel.StaticAnalysis(numIncr)
    AnalysisModel.py.append("wipe")
    
    
    #textFile = AnalysisModel.py
    
    time_start = time.clock()
    
    AnalysisModel.writeFile(outputFileName)
    
    time_elapsed = (time.clock() - time_start)
    print("Writing Time {}".format(time_elapsed))
    
    
    
    time_start = time.clock()
    
    executable = os.path.join(ghcompfolder,'Alpaca4d\OpenSees-Solvers\opensees.bat')
    a, msg = AnalysisModel.runOpensees(executable)
    
    time_elapsed = (time.clock() - time_start)
    print("Analyses Time {}".format(time_elapsed))
    
    
    AlpacaSolvedModel = copy.copy(AnalysisModel)
#ghenv.Component.AddRuntimeMessage(gh.Kernel.GH_RuntimeMessageLevel.Error, msg)
# ---------- end ra ----------
python_11 = GhPythonScript(model=python_10.model, Analysis=as.Analysis)  # -> out, AnalysisModel
# ---------- python_11: Python ----------
from Alpaca4d import alpaca4d as alpaca
import Rhino.RhinoDoc
import Grasshopper as gh
import copy
import rhinoscriptsyntax as rs
import os
import time


FolderPath = rs.DocumentPath()
os.chdir(FolderPath)

outputFileName = 'openSeesModel'

for dirpath, dirnames, filenames in os.walk(FolderPath):
    for filename in filenames:
        if filename == outputFileName:
            file = os.path.join(dirpath,outputFileName)
            os.remove(file)


# create a copy

AnalysisModel = copy.copy(model)
AnalysisModel.py = list(AnalysisModel.py)

# generate Recorder and assign name
AnalysisModel.recorderName = "recorder" + ".mpco"

AnalysisModel.py.append(alpaca.TCLRecorder.mpco(AnalysisModel.recorderName, True,True,True,True,False,False,True,True,True,True))


AnalysisModel.analysis = Analysis
AnalysisModel.py.append(Analysis.write_tcl())
#AnalysisModel.StaticAnalysis(numIncr)
AnalysisModel.py.append("wipe")


#textFile = AnalysisModel.py

time_start = time.clock()

AnalysisModel.writeFile(outputFileName)

time_elapsed = (time.clock() - time_start)
print("Writing Time {}".format(time_elapsed))



time_start = time.clock()

a, msg = AnalysisModel.runOpensees('tcl')

time_elapsed = (time.clock() - time_start)
print("Analyses Time {}".format(time_elapsed))

#ghenv.Component.AddRuntimeMessage(gh.Kernel.GH_RuntimeMessageLevel.Error, msg)
# ---------- end python_11 ----------

# ---- group: ViewModel
number_slider_8 = Slider(0.01, range=0..0.01)
python_12 = GhPythonScript(PointLoad=python_9.PointLoad, scale="0.001")  # -> out, Force, Moment; inputs PointLoad: list
# ---------- python_12: Python ----------
__author__ = "domy7"
__version__ = "2021.03.21"

import rhinoscriptsyntax as rs
import Rhino.Geometry as rg

def DrawVector( PointLoadClass, c1, viewType, color ):
    if c1 is None:
        c1 = 0.0001
    c = 0.25
    c2 = 0.1
    
    vectorDraw = []
    for iPLoad in PointLoadClass:
        if viewType is not False:
            forceType = iPLoad.Moment
        else:
            forceType = iPLoad.Force
            
        l = forceType.Length*c1
        l1 = forceType.Length*c1*c
        l2 = forceType.Length*c1*c2
        
        planeLoad =rg.Plane( iPLoad.Pos, -forceType )
        point0 = rg.Point3d.Add( iPLoad.Pos, planeLoad.ZAxis*l1)
        point1 =rg.Point3d.Add(point0, planeLoad.XAxis*l2 + planeLoad.YAxis*l2)
        point2 =rg.Point3d.Add(point0, planeLoad.XAxis*l2 - planeLoad.YAxis*l2)
        point3 =rg.Point3d.Add(point0, -planeLoad.XAxis*l2 - planeLoad.YAxis*l2)
        point4 = rg.Point3d.Add( point0, -planeLoad.XAxis*l2 + planeLoad.YAxis*l2)
        #Mesh Puntatore 
        Arrow = rg.Mesh()
        Arrow.Vertices.Add( iPLoad.Pos ) #0
        Arrow.Vertices.Add( point1 ) #1
        Arrow.Vertices.Add( point2 ) #2
        Arrow.Vertices.Add( point3 ) #3
        Arrow.Vertices.Add( point4 ) #4
        Arrow.Faces.AddFace( 0, 1, 2 ) 
        Arrow.Faces.AddFace( 0, 2, 3 )
        Arrow.Faces.AddFace( 0, 3, 4 )
        Arrow.Faces.AddFace( 0, 4, 1 )
        Arrow.Faces.AddFace( 1, 2, 3, 4)
        
        #Mesh Coda 
        point0 = rg.Point3d.Add( iPLoad.Pos, planeLoad.ZAxis*l)
        point1 =rg.Point3d.Add(point0, planeLoad.XAxis*l2*0.5 + planeLoad.YAxis*l2*0.5)
        point2 =rg.Point3d.Add(point0, planeLoad.XAxis*l2*0.5 - planeLoad.YAxis*l2*0.5)
        point3 =rg.Point3d.Add(point0, -planeLoad.XAxis*l2*0.5 - planeLoad.YAxis*l2*0.5)
        point4 = rg.Point3d.Add( point0, -planeLoad.XAxis*l2*0.5 + planeLoad.YAxis*l2*0.5)
        Arrow.Vertices.Add( point1 ) #5
        Arrow.Vertices.Add( point2 ) #6
        Arrow.Vertices.Add( point3 ) #7
        Arrow.Vertices.Add( point4 ) #8
        Arrow.Faces.AddFace( 0, 5, 6 ) 
        Arrow.Faces.AddFace( 0, 6, 7 )
        Arrow.Faces.AddFace( 0, 7, 8 )
        Arrow.Faces.AddFace( 0, 8, 5 )
        Arrow.Faces.AddFace( 5, 6, 7, 8)
        Arrow.VertexColors.CreateMonotoneMesh( color )
        vectorDraw.append( Arrow )
    return vectorDraw 

colour1 = rs.CreateColor( 255, 255, 255 )
colour2 = rs.CreateColor( 255, 100, 0 )
Force = DrawVector( PointLoad, scale, False, colour1)
Moment = DrawVector( PointLoad, scale, True, colour2)
# ---------- end python_12 ----------
python_13 = GhPythonScript(model=python_10.model, type=Toggle(False), nodeTag=Toggle(False), eleTag=Toggle(False), localAxis=Toggle(True))  # inputs type: Boolean, nodeTag: Boolean, eleTag: Boolean, localAxis: Boolean
# ---------- python_13: Python ----------
from ghpythonlib.componentbase import executingcomponent as component
import Grasshopper, GhPython
import System
import Rhino as rc
import rhinoscriptsyntax as rs
import sys
import Rhino.Geometry as rg
import Grasshopper as gh
import copy

ghcompfolder = gh.Folders.DefaultAssemblyFolder
if ghcompfolder not in sys.path:
    sys.path.append(ghcompfolder)
try:
    from Alpaca4d import alpaca4dView as alpacaView
except:
    msg = "Cannot import Alpaca4d. Is the Alpaca4d folder available in " + ghcompfolder + "?"
    ghenv.Component.AddRuntimeMessage(gh.Kernel.GH_RuntimeMessageLevel.Error, msg)

checkData = True

class MyComponent(component):
    
    def RunScript(self, model, type, nodeTag, eleTag, localAxis):
        
        self.type = type
        self.model = model
        self.nodeTag = nodeTag
        ## add alpaca install directory to system path
        
        self.ModelBeam = alpacaView.ViewBeam( model, type)
        self.ModelShell = alpacaView.ViewShell( model, type )
        #NODE TAG VIEW
        if nodeTag is True:
            self.Nodes = [ [inode.nodeTag, inode.Pos] for inode in self.model.nodes]
        else:
            self.Nodes = []
        #ELE TAG VIEW
        if eleTag is True:
            TagBeam = [ [item.eleTag, item.getPerpFrame().Origin] for item in self.model.beams]
            TagShell = [ [item.eleTag, rg.AreaMassProperties.Compute( item.Mesh, False, True, False, False ).Centroid] for item in self.model.shells]
            self.TagEle = TagBeam + TagShell
        else:
            self.TagEle = []
        #LOCAL AXIS
        if localAxis is True:
            self.localAxis = [ item.getPerpFrame() for item in self.model.beams]
        else:
            self.localAxis = []
           
            
    def DrawViewportWires(self,arg):
        # Beam
        for iBeam in self.ModelBeam:
            color = iBeam[1]
            colorMaterial = rc.Display.DisplayMaterial(color, 0.3)
            if self.type is True:
                colorWirframe = System.Drawing.Color.Gray
                #System.Drawing.Color.LightGray
                arg.Display.DrawBrepShaded(iBeam[0], colorMaterial)
                arg.Display.DrawBrepWires(iBeam[0], colorWirframe)
            else :
                thickness =2
                arg.Display.DrawCurve(iBeam[0], color, thickness)
        # Mesh
        for iShell in self.ModelShell:
            color = iShell[1]
            #color = System.Drawing.Color.Blue
            colorMaterial = rc.Display.DisplayMaterial(color,color,color,color,1,0.00)
            colorMaterial.IsTwoSided = True
            arg.Display.DrawMeshShaded(iShell[0], colorMaterial)
            colorWirframe = System.Drawing.Color.Black
            arg.Display.DrawMeshWires(iShell[0], colorWirframe)
        # node Tag view
        for inode in self.Nodes:
            arg.Display.Draw2dText( str(inode[0]), System.Drawing.Color.DarkSlateBlue, inode[1], True, 50)
        # ele Tag view
        for iEle in self.TagEle:
            arg.Display.Draw2dText( str(iEle[0]), System.Drawing.Color.BlanchedAlmond, iEle[1], True, 50)
        # local Axis
        for iLocalAxis in self.localAxis:
            arg.Display.DrawArrow( rg.Line(iLocalAxis.Origin, iLocalAxis.XAxis), System.Drawing.Color.Red)
            arg.Display.DrawArrow( rg.Line(iLocalAxis.Origin, iLocalAxis.YAxis), System.Drawing.Color.Green)
            arg.Display.DrawArrow( rg.Line(iLocalAxis.Origin, iLocalAxis.ZAxis), System.Drawing.Color.Blue)
# ---------- end python_13 ----------
python_14 = GhPythonScript(model=python_10.model, scale=Slider(0.701, range=0..2))
# ---------- python_14: Python ----------
from ghpythonlib.componentbase import executingcomponent as component
import Grasshopper, GhPython
import System
import Rhino as rc
import rhinoscriptsyntax as rs

class MyComponent(component):
    
    def RunScript(self, model, scale):
        import sys
        import Rhino.Geometry as rg
        import Grasshopper as gh
        import copy
        import rhinoscriptsyntax as rs
        import System.Drawing.Color
        import Rhino
        import math as mt
        
        self.model = model
        self.scale = scale
        
        ghcompfolder = gh.Folders.DefaultAssemblyFolder
        if ghcompfolder not in sys.path:
            sys.path.append(ghcompfolder)
        
        try:
            from Alpaca4d import alpaca4dView as alpacaView
        except:
            msg = "Cannot import Alpaca4d. Is the Alpaca4d folder available in " + ghcompfolder + "?"
            ghenv.Component.AddRuntimeMessage(gh.Kernel.GH_RuntimeMessageLevel.Error, msg)
        
        self.solidSupport = [ alpacaView.Support( iSupport, self.scale ) for iSupport in self.model.supports ]
        
    def DrawViewportWires(self,arg):
        # Support
        color = System.Drawing.Color.Azure
        colorWirframe = System.Drawing.Color.Black
        colorMaterial = rc.Display.DisplayMaterial(color, 0.0)
        for iSupport in self.solidSupport :
            arg.Display.DrawBrepShaded( iSupport, colorMaterial)
            arg.Display.DrawBrepWires( iSupport, colorWirframe)
# ---------- end python_14 ----------

# ---- group: CDS
bfd = BeamForcesDiagramAlpaca4d(
    AlpacaModel=python_11.AnalysisModel,
    step=Slider(0, range=0..10),
    cdsType=Slider(2, range=0..10),
    scale=Slider(0.01, range=0..0.01),
    viewValor=Toggle(True))  # -> ForcesDiagram; inputs step: Int32, cdsType: Int32
# ---------- bfd: Python ----------
"""
View Diagram of internal beam forces

    Args:
        AlpacaModel:
        cdsType: 
    0: to view N (forces in direction 3)
    1: to view M2 (Moments around axis 2)
    2: to view T1 (forces in direction 1)
    3: to view M1 (Moments around axis 1)
    4: to view T2 (forces in direction 2)
    5: to view Mt (Moments around axis 3)
        step:
        scale: scalar view
        viewValor: to view tthe force value
    Returns:
        ForcesDiagram: Diagram of internal beam forces
"""


ghenv.Component.Name = "BeamForcesDiagram (Alpaca4d)"
ghenv.Component.NickName = 'BFD'
ghenv.Component.Message = "Beam Forces Diagram \n(Alpaca4d)"

from ghpythonlib.componentbase import executingcomponent as component
import Grasshopper, GhPython
import rhinoscriptsyntax as rs
import sys
import os
import System
import clr
import Rhino.Geometry as rg
import Grasshopper as gh
import copy
import Rhino


from Alpaca4d import alpaca4d as alpaca
from Alpaca4d import alpaca4dView as alpacaView
FolderPath = rs.DocumentPath()
os.chdir(FolderPath)

ghcompfolder = gh.Folders.DefaultAssemblyFolder
if ghcompfolder not in sys.path:
    sys.path.append(ghcompfolder)

# import costum modules to read the hdf5 file
my_module_name = "Alpaca_StepReader"
my_module = sys.modules.setdefault(my_module_name, type(sys)(my_module_name))

hdfFilePath = os.path.join(ghcompfolder, "Alpaca4d\HDF5CSharp.dll")
clr.AddReferenceToFileAndPath(hdfFilePath)

from HDF5CSharp import Hdf5

try:
    Steps = my_module.Steps
except AttributeError:
    type_2d = type(System.Array.CreateInstance(float, 1, 1))

    class Steps(object):
        __metaclass__ = clrtype.ClrClass
        _clrfields = {"STEP_{}".format(i): type_2d for i in range(1000)} # it will work for model with less than 1000 steps
    
    my_module.Steps = Steps

checkData = True

class MyComponent(component):
    
    def RunScript(self, AlpacaModel, step, cdsType, scale, viewValor):
        
        self.AlpacaModel = AlpacaModel
        self.step = step
        self.cdsType = cdsType
        self.scale = scale 
        self.viewValor = viewValor
            
        fileId = Hdf5.OpenFile(self.AlpacaModel.recorderName, True)
        
        stressResult = Hdf5.ReadObject[Steps](fileId, "/MODEL_STAGE[1]/RESULTS/ON_ELEMENTS/section.force/74-ForceBeamColumn3d[1000:1:0]/DATA")
        #stressResult = Hdf5.ReadObject[Steps](fileId, "/MODEL_STAGE[1]/RESULTS/ON_ELEMENTS/stresses/167-UnknownMovableObject[103:0:0]/DATA")
        if self.cdsType <= 0:
            versorType, startRange, colorPos, colorNeg = 1, 0, System.Drawing.Color.SteelBlue, System.Drawing.Color.LightSalmon
        elif self.cdsType == 1:
            versorType, startRange, colorPos, colorNeg = 1, 1, System.Drawing.Color.Aqua, System.Drawing.Color.IndianRed
        elif self.cdsType== 2:
            versorType, startRange, colorPos, colorNeg = 1, 2, System.Drawing.Color.LightSalmon, System.Drawing.Color.LightSalmon
        elif self.cdsType == 3:
            versorType, startRange, colorPos, colorNeg = 2, 3, System.Drawing.Color.SteelBlue, System.Drawing.Color.Yellow
        elif self.cdsType == 4:
            versorType, startRange, colorPos, colorNeg = 2, 4, System.Drawing.Color.LawnGreen, System.Drawing.Color.LawnGreen
        else:
            versorType, startRange, colorPos, colorNeg = 2, 5, System.Drawing.Color.BlueViolet, System.Drawing.Color.BlueViolet
            
        CDSView = []
        CDSPoint = []
        CDSValor = []
        
        for i,item in enumerate(self.AlpacaModel.beams):
            ni = 5 # potrebbe cambiare per ogni trave
            #Versore
            e = item.getPerpFrame()[versorType]*-1
            valor = [ getattr(stressResult, 'STEP_{}'.format(self.step))[i,j] for j in range(startRange,ni*6, 6)]
            cdsVector = [ rg.Vector3d.Multiply(e, ivalor*self.scale) for ivalor in valor ]
            #----------------------------------------------------------------#
            cdsView, cdsPoint = alpacaView.cdsMesh( item, cdsVector, colorPos, colorNeg)
            CDSView.append(cdsView)
            CDSPoint.append(cdsPoint)
            CDSValor.append(valor)
            
        self.Pos = CDSPoint
        self.Valor = CDSValor
        self.ForcesDiagram = CDSView
        Hdf5.CloseFile(fileId)

        return self.ForcesDiagram
        
    def DrawViewportWires(self,arg):
        # node Tag view
        for iPos, ivalor, iMesh in zip(self.Pos, self.Valor, self.ForcesDiagram) :
            colorWirframe = System.Drawing.Color.Black
            arg.Display.DrawMeshWires(iMesh, colorWirframe)
            if self.viewValor is True:
                for jpos, jvalor in zip(iPos, ivalor):
                    t = 25
                    txt = str( round( jvalor, 2))
                    arg.Display.Draw2dText( txt, System.Drawing.Color.Black, jpos, True, t)
# ---------- end bfd ----------
bf = BeamForcesAlpaca4d(AlpacaModel=ra.AlpacaSolvedModel, step=Slider(3, range=0..100), History=Toggle(False))  # -> out, N, M2, T1, M1, T2, Mz; inputs step: Int32, History: Boolean
# ---------- bf: Python ----------
"""
Valor of internal beam forces

    Args:
        AlpacaModel:
        step:
        History:
    Returns:
        N: forces in direction 3  (Axial Force)
        M2: Moments around axis 2 (Bending Moment 1)
        T1: forces in direction 1 (Shear Force 1)
        M1: Moments around axis 1 (Bending Moment 2)
        T2: forces in direction 2 (Shear Force 2)
        Mt: Moments around axis 3 (Twisting Moment)
"""

import sys
import os
import System
from System.Drawing import Color
import clr
import clrtype
import Rhino.Geometry as rg
import rhinoscriptsyntax as rs
import Grasshopper as gh
import copy
import ghpythonlib.treehelpers as th


ghenv.Component.Name = "Beam Forces (Alpaca4d)"
ghenv.Component.NickName = 'BF'
ghenv.Component.Message = "Beam Forces (Alpaca4d)"
## add alpaca install directory to system path

ghcompfolder = gh.Folders.DefaultAssemblyFolder
if ghcompfolder not in sys.path:
    sys.path.append(ghcompfolder)

try:
    from Alpaca4d import alpaca4d as alpaca
except:
    msg = "Cannot import Alpaca4d. Is the Alpaca4d folder available in " + ghcompfolder + "?"
    ghenv.Component.AddRuntimeMessage(gh.Kernel.GH_RuntimeMessageLevel.Error, msg)



FolderPath = rs.DocumentPath()
os.chdir(FolderPath)


# import costum modules to read the hdf5 file

my_module_name = "Alpaca_StepReader"
my_module = sys.modules.setdefault(my_module_name, type(sys)(my_module_name))

hdfFilePath = os.path.join(ghcompfolder, "Alpaca4d\HDF5CSharp.dll")
clr.AddReferenceToFileAndPath(hdfFilePath)

from HDF5CSharp import Hdf5

try:
    Steps = my_module.Steps
except AttributeError:
    type_2d = type(System.Array.CreateInstance(float, 1, 1))

    class Steps(object):
        __metaclass__ = clrtype.ClrClass
        _clrfields = {"STEP_{}".format(i): type_2d for i in range(1000)} # it will work for model with less than 1000 steps

    my_module.Steps = Steps


checkData = True

if not AlpacaModel:
    checkData = False
    msg = "Input parameter AlpacaModel failed to collect data"
    ghenv.Component.AddRuntimeMessage(gh.Kernel.GH_RuntimeMessageLevel.Warning, msg)

if checkData:
    
    step = (int(AlpacaModel.analysis.NumberOfSteps) - 1) if step is None else step
# read result
    
    N = []
    T1 = []
    T2 = []
    M1 = []
    M2 = []
    Mz = []
    
    fileId = Hdf5.OpenFile(AlpacaModel.recorderName, True)
    
    stressResult = Hdf5.ReadObject[Steps](fileId, "/MODEL_STAGE[1]/RESULTS/ON_ELEMENTS/section.force/74-ForceBeamColumn3d[1000:1:0]/DATA")
    #stressResult = Hdf5.ReadObject[Steps](fileId, "/MODEL_STAGE[1]/RESULTS/ON_ELEMENTS/stresses/167-UnknownMovableObject[103:0:0]/DATA")
if History is True:
    
    maxNumberStep = int(AlpacaModel.analysis.NumberOfSteps)
    for istep in range(maxNumberStep):
        for i,item in enumerate(AlpacaModel.beams):
            ni = 5 # potrebbe cambiare per ogni trave
            Ni = [ getattr(stressResult, 'STEP_{}'.format(istep))[i,j] for j in range(0,ni*6, 6)]
            M2i = [ getattr(stressResult, 'STEP_{}'.format(istep))[i,j] for j in range(1,ni*6, 6)]  
            T1i = [ getattr(stressResult, 'STEP_{}'.format(istep))[i,j] for j in range(2,ni*6, 6)]
            M1i = [ getattr(stressResult, 'STEP_{}'.format(istep))[i,j] for j in range(3,ni*6, 6)]
            T2i = [ getattr(stressResult, 'STEP_{}'.format(istep))[i,j] for j in range(4,ni*6, 6)]
            Mzi = [ getattr(stressResult, 'STEP_{}'.format(istep))[i,j] for j in range(5,ni*6, 6)]
            
            N.append([Ni])
            M2.append([M2i])
            T1.append([T1i])
            M1.append([M1i])
            T2.append([T2i])
            Mz.append([Mzi])
else:
    for i,item in enumerate(AlpacaModel.beams):
        ni = 5 # potrebbe cambiare per ogni trave
        Ni = [ getattr(stressResult, 'STEP_{}'.format(step))[i,j] for j in range(0,ni*6, 6)]
        M2i = [ getattr(stressResult, 'STEP_{}'.format(step))[i,j] for j in range(1,ni*6, 6)]  
        T1i = [ getattr(stressResult, 'STEP_{}'.format(step))[i,j] for j in range(2,ni*6, 6)]
        M1i = [ getattr(stressResult, 'STEP_{}'.format(step))[i,j] for j in range(3,ni*6, 6)]
        T2i = [ getattr(stressResult, 'STEP_{}'.format(step))[i,j] for j in range(4,ni*6, 6)]
        Mzi = [ getattr(stressResult, 'STEP_{}'.format(step))[i,j] for j in range(5,ni*6, 6)]
        
        N.append([Ni])
        M2.append([M2i])
        T1.append([T1i])
        M1.append([M1i])
        T2.append([T2i])
        Mz.append([Mzi])
        
Hdf5.CloseFile(fileId)

N = th.list_to_tree(N)
M2 = th.list_to_tree(M2)
T1 = th.list_to_tree(T1)
M1 = th.list_to_tree(M1)
T2 = th.list_to_tree(T2)
Mz = th.list_to_tree(Mz)
# ---------- end bf ----------
graph = QuickGraph(bf.M2, SortOrder=0)

# ----
rf = ReactionForcesAlpaca4d(AlpacaModel=ra.AlpacaSolvedModel, History=Toggle(False))  # -> out, SupportPosition, ReactionForce, ReactionMoment; inputs History: Boolean, step: Int32
# ---------- rf: Python ----------
"""
Read Reaction Forces
    Args:
        AlpacaModel:
        History:
        step:
    Returns:
        SupportPosition:
        ReactionForce:
        ReactionMoment:
        ReactionForce_History:
        ReactionMoment_History:
"""

ghenv.Component.Name = "Reaction Forces (Alpaca4d)"
ghenv.Component.NickName = 'RF'
ghenv.Component.Message = 'Reaction Forces\n (Alpaca4d)'


import sys
import os
import System
from System.Drawing import Color


import clr
import clrtype
import Rhino.Geometry as rg
import rhinoscriptsyntax as rs
import Grasshopper as gh
import copy
import ghpythonlib.treehelpers as th



## add alpaca install directory to system path

ghcompfolder = gh.Folders.DefaultAssemblyFolder
if ghcompfolder not in sys.path:
    sys.path.append(ghcompfolder)

try:
    from Alpaca4d import alpaca4d as alpaca
except:
    msg = "Cannot import Alpaca4d. Is the Alpaca4d folder available in " + ghcompfolder + "?"
    ghenv.Component.AddRuntimeMessage(gh.Kernel.GH_RuntimeMessageLevel.Error, msg)



FolderPath = rs.DocumentPath()
os.chdir(FolderPath)

my_module_name = "Alpaca_StepReader" # replace this with something unique that doesn't collide with a real module!
my_module = sys.modules.setdefault(my_module_name, type(sys)(my_module_name))

hdfFilePath = os.path.join(ghcompfolder, "Alpaca4d\HDF5CSharp.dll")
clr.AddReferenceToFileAndPath(hdfFilePath)


from HDF5CSharp import Hdf5

try:
    Steps = my_module.Steps
except AttributeError:
    type_2d = type(System.Array.CreateInstance(float, 1, 1))

    class Steps(object):
        __metaclass__ = clrtype.ClrClass
        _clrfields = {"STEP_{}".format(i): type_2d for i in range(1000)} # it will work for model with less than 1000 steps

    my_module.Steps = Steps



checkData = True

if not AlpacaModel:
    checkData = False
    msg = "Input parameter AlpacaModel failed to collect data"
    ghenv.Component.AddRuntimeMessage(gh.Kernel.GH_RuntimeMessageLevel.Warning, msg)



History = False if History is None else History


if checkData:
    step = (int(AlpacaModel.analysis.NumberOfSteps) - 1) if step is None else step
    supportTagLocation = [item.nodeTag - 1 for item in AlpacaModel.supports] #
    
    if not History:
    
        try:
            fileId = Hdf5.OpenFile(AlpacaModel.recorderName, True)
            
            
            reactionForceResult = Hdf5.ReadObject[Steps](fileId, "/MODEL_STAGE[1]/RESULTS/ON_NODES/REACTION_FORCE/DATA")
            ReactionForce = []
            for i in supportTagLocation:
                x = getattr(reactionForceResult, 'STEP_{}'.format(step))[i,0]
                y = getattr(reactionForceResult, 'STEP_{}'.format(step))[i,1]
                z = getattr(reactionForceResult, 'STEP_{}'.format(step))[i,2]
                ReactionForce.append(rg.Vector3d(x,y,z))
            
            
            ReactionMomentResult = Hdf5.ReadObject[Steps](fileId, "/MODEL_STAGE[1]/RESULTS/ON_NODES/REACTION_MOMENT/DATA")
            ReactionMoment = []
            for i in supportTagLocation:
                x = getattr(ReactionMomentResult, 'STEP_{}'.format(step))[i,0]
                y = getattr(ReactionMomentResult, 'STEP_{}'.format(step))[i,1]
                z = getattr(ReactionMomentResult, 'STEP_{}'.format(step))[i,2]
                ReactionMoment.append(rg.Vector3d(x,y,z))
                
            Hdf5.CloseFile(fileId)
            
        except:
            if fileId >0:
                Hdf5.CloseFile(fileId)
                print("I have closed the file")
    
    
    if History:
        try:
            fileId = Hdf5.OpenFile(AlpacaModel.recorderName, True)
        
            maxNumberStep = int(AlpacaModel.analysis.NumberOfSteps)
            
            reactionForceResult = Hdf5.ReadObject[Steps](fileId, "/MODEL_STAGE[1]/RESULTS/ON_NODES/REACTION_FORCE/DATA")
            ReactionForce = []
            for i in supportTagLocation:
                reactionForceTemp = []
                for n_step in range(maxNumberStep):
                    x = getattr(reactionForceResult, 'STEP_{}'.format(n_step))[i,0]
                    y = getattr(reactionForceResult, 'STEP_{}'.format(n_step))[i,1]
                    z = getattr(reactionForceResult, 'STEP_{}'.format(n_step))[i,2]
                    reactionForceTemp.append(rg.Vector3d(x,y,z))
            
                ReactionForce.append(reactionForceTemp)
    
    
            reactionMomentResult = Hdf5.ReadObject[Steps](fileId, "/MODEL_STAGE[1]/RESULTS/ON_NODES/REACTION_MOMENT/DATA")
            ReactionMoment = []
            for i in supportTagLocation:
                reactionMomentTemp = []
                for n_step in range(maxNumberStep):
                    x = getattr(reactionMomentResult, 'STEP_{}'.format(n_step))[i,0]
                    y = getattr(reactionMomentResult, 'STEP_{}'.format(n_step))[i,1]
                    z = getattr(reactionMomentResult, 'STEP_{}'.format(n_step))[i,2]
                    reactionMomentTemp.append(rg.Vector3d(x,y,z))
            
                ReactionMoment.append(reactionMomentTemp)
            Hdf5.CloseFile(fileId)
            
        except:
            Hdf5.CloseFile(fileId)
    
    
    
    
    SupportPosition = [item.Pos for item in AlpacaModel.supports]
    ReactionForce = th.list_to_tree(ReactionForce)
    ReactionMoment = th.list_to_tree(ReactionMoment)
# ---------- end rf ----------
nd = NodalDisplacementsAlpaca4d(AlpacaModel=ra.AlpacaSolvedModel, History=Toggle(False))  # -> out, displacement, rotation; inputs History: Boolean, step: Int32
# ---------- nd: Python ----------
"""
Read displacement results
-
    Args:
        AlpacaModel:
        History: True to visualise the displacement and rotation history of the points
        step:
    Returns:
        displacement:
        rotation:
        displacement_History:
        rotation_History:
"""

ghenv.Component.Name = "Nodal Displacements (Alpaca4d)"
ghenv.Component.NickName = 'ND'
ghenv.Component.Message = "Nodal Displacements\n (Alpaca4d)"

import sys
import os
import System
from System.Drawing import Color


import clr
import clrtype
import Rhino.Geometry as rg
import rhinoscriptsyntax as rs
import Grasshopper as gh
import copy
import ghpythonlib.treehelpers as th



## add alpaca install directory to system path

ghcompfolder = gh.Folders.DefaultAssemblyFolder
if ghcompfolder not in sys.path:
    sys.path.append(ghcompfolder)

try:
    from Alpaca4d import alpaca4d as alpaca
except:
    msg = "Cannot import Alpaca4d. Is the Alpaca4d folder available in " + ghcompfolder + "?"
    ghenv.Component.AddRuntimeMessage(gh.Kernel.GH_RuntimeMessageLevel.Error, msg)



FolderPath = rs.DocumentPath()
os.chdir(FolderPath)

my_module_name = "Alpaca_StepReader" # replace this with something unique that doesn't collide with a real module!
my_module = sys.modules.setdefault(my_module_name, type(sys)(my_module_name))

hdfFilePath = os.path.join(ghcompfolder, "Alpaca4d\HDF5CSharp.dll")
clr.AddReferenceToFileAndPath(hdfFilePath)


from HDF5CSharp import Hdf5

try:
    Steps = my_module.Steps
except AttributeError:
    type_2d = type(System.Array.CreateInstance(float, 1, 1))

    class Steps(object):
        __metaclass__ = clrtype.ClrClass
        _clrfields = {"STEP_{}".format(i): type_2d for i in range(1000)} # it will work for model with less than 1000 steps

    my_module.Steps = Steps



checkData = True

if not AlpacaModel:
    checkData = False
    msg = "Input parameter AlpacaModel failed to collect data"
    ghenv.Component.AddRuntimeMessage(gh.Kernel.GH_RuntimeMessageLevel.Warning, msg)



History = False if History is None else History


if checkData:
    step = (int(AlpacaModel.analysis.NumberOfSteps) - 1) if step is None else step
    numberOfPoints = len(AlpacaModel.uniquePoints) #
    
    if not History:
        try:
            fileId = Hdf5.OpenFile(AlpacaModel.recorderName, True)
            
            
            displacementResult = Hdf5.ReadObject[Steps](fileId, "/MODEL_STAGE[1]/RESULTS/ON_NODES/DISPLACEMENT/DATA")
            displacement = []
            for i in range(numberOfPoints):
                x = getattr(displacementResult, 'STEP_{}'.format(step))[i,0]
                y = getattr(displacementResult, 'STEP_{}'.format(step))[i,1]
                z = getattr(displacementResult, 'STEP_{}'.format(step))[i,2]
                displacement.append(rg.Vector3d(x,y,z))
            
            
            rotationResult = Hdf5.ReadObject[Steps](fileId, "/MODEL_STAGE[1]/RESULTS/ON_NODES/ROTATION/DATA")
            rotation = []
            for i in range(numberOfPoints):
                x = getattr(rotationResult, 'STEP_{}'.format(step))[i,0]
                y = getattr(rotationResult, 'STEP_{}'.format(step))[i,1]
                z = getattr(rotationResult, 'STEP_{}'.format(step))[i,2]
                rotation.append(rg.Vector3d(x,y,z))
                
                
            Hdf5.CloseFile(fileId)
            print("I have closed the file")
        except:
            if fileId >0:
                Hdf5.CloseFile(fileId)
                print("I have closed the file because of exception")
    
    
    
    if History:
        try:
            fileId = Hdf5.OpenFile(AlpacaModel.recorderName, True)
            
            displacementResult = Hdf5.ReadObject[Steps](fileId, "/MODEL_STAGE[1]/RESULTS/ON_NODES/DISPLACEMENT/DATA")
            displacement = []
            
            for i in range(numberOfPoints):
                dispTemp = []
                maxNumberStep = int(AlpacaModel.analysis.NumberOfSteps)
                for n_step in range(maxNumberStep):
                    x = getattr(displacementResult, 'STEP_{}'.format(n_step))[i,0]
                    y = getattr(displacementResult, 'STEP_{}'.format(n_step))[i,1]
                    z = getattr(displacementResult, 'STEP_{}'.format(n_step))[i,2]
                    dispTemp.append(rg.Vector3d(x,y,z))
                    
                
                displacement.append(dispTemp)
    
    
    
    
            rotationResult = Hdf5.ReadObject[Steps](fileId, "/MODEL_STAGE[1]/RESULTS/ON_NODES/ROTATION/DATA")
            
            rotation = []
            
            for i in range(numberOfPoints):
                rotationTemp = []
                for n_step in range(maxNumberStep):
                    x = getattr(rotationResult, 'STEP_{}'.format(n_step))[i,0]
                    y = getattr(rotationResult, 'STEP_{}'.format(n_step))[i,1]
                    z = getattr(rotationResult, 'STEP_{}'.format(n_step))[i,2]
                    rotationTemp.append(rg.Vector3d(x,y,z))
                
                rotation.append(rotationTemp)
                
            Hdf5.CloseFile(fileId)
        except:
            Hdf5.CloseFile(fileId)
    
    
    displacement = th.list_to_tree(displacement)
    rotation = th.list_to_tree(rotation)
# ---------- end nd ----------
graph_2 = QuickGraph(nd.displacement, SortOrder=0)
ss = ShellStressesAlpaca4d()  # -> out, Mesh, p11, simplify(p22), p12, m11, m22, m12, q1, q2; inputs History: Boolean, step: Int32
# ---------- ss: Python ----------
"""
Read Shell Stresses
-
    Args:
        AlpacaModel:
        step:
    Returns:
        p11:
        p22:
        p12:
        m11:
        m22:
        m12:
        q1:
        q2:
"""

ghenv.Component.Name = "Shell Stresses (Alpaca4d)"
ghenv.Component.NickName = 'SS'
ghenv.Component.Message = "Shell Stress\n (Alpaca4d)"

import sys
import os
import System
from System.Drawing import Color


import clr
import clrtype
import Rhino.Geometry as rg
import rhinoscriptsyntax as rs
import Grasshopper as gh
import copy
import ghpythonlib.treehelpers as th


## add alpaca install directory to system path

ghcompfolder = gh.Folders.DefaultAssemblyFolder
if ghcompfolder not in sys.path:
    sys.path.append(ghcompfolder)

try:
    from Alpaca4d import alpaca4d as alpaca
except:
    msg = "Cannot import Alpaca4d. Is the Alpaca4d folder available in " + ghcompfolder + "?"
    ghenv.Component.AddRuntimeMessage(gh.Kernel.GH_RuntimeMessageLevel.Error, msg)



FolderPath = rs.DocumentPath()
os.chdir(FolderPath)


# import costum modules to read the hdf5 file

my_module_name = "Alpaca_StepReader"
my_module = sys.modules.setdefault(my_module_name, type(sys)(my_module_name))

hdfFilePath = os.path.join(ghcompfolder, "Alpaca4d\HDF5CSharp.dll")
clr.AddReferenceToFileAndPath(hdfFilePath)

from HDF5CSharp import Hdf5

try:
    Steps = my_module.Steps
except AttributeError:
    type_2d = type(System.Array.CreateInstance(float, 1, 1))

    class Steps(object):
        __metaclass__ = clrtype.ClrClass
        _clrfields = {"STEP_{}".format(i): type_2d for i in range(1000)} # it will work for model with less than 1000 steps

    my_module.Steps = Steps


checkData = True

if not AlpacaModel:
    checkData = False
    msg = "Input parameter AlpacaModel failed to collect data"
    ghenv.Component.AddRuntimeMessage(gh.Kernel.GH_RuntimeMessageLevel.Warning, msg)

History = False if History is None else History

if checkData:
    
    step = (int(AlpacaModel.analysis.NumberOfSteps) - 1) if step is None else step
# read result
    
    p11 = []
    p22 = []
    p12 = []
    
    m11 = []
    m22 = []
    m12 = []
    
    q1 = []
    q2 = []
    
    
    
    ## to fix the issue about index of different type of object
    print(not History)
    
    if not History:
        fileId = Hdf5.OpenFile(AlpacaModel.recorderName, True)
        
        stressResult = Hdf5.ReadObject[Steps](fileId, "/MODEL_STAGE[1]/RESULTS/ON_ELEMENTS/stresses/203-UnknownMovableObject[201:0:0]/DATA")
        #stressResult = Hdf5.ReadObject[Steps](fileId, "/MODEL_STAGE[1]/RESULTS/ON_ELEMENTS/stresses/53-UnknownMovableObject[53:0:0]/DATA")
        #stressResult = Hdf5.ReadObject[Steps](fileId, "/MODEL_STAGE[1]/RESULTS/ON_ELEMENTS/stresses/167-UnknownMovableObject[103:0:0]/DATA")
        for i,item in enumerate(AlpacaModel.shells):
            
            p11_0 = getattr(stressResult, 'STEP_{}'.format(step))[i,0]
            p11_1 = getattr(stressResult, 'STEP_{}'.format(step))[i,8]
            p11_2 = getattr(stressResult, 'STEP_{}'.format(step))[i,16]
            p11_3 = getattr(stressResult, 'STEP_{}'.format(step))[i,24]
            
            
            p11.append([p11_0,p11_1,p11_2,p11_3])
            
            
            
            p22_0 = getattr(stressResult, 'STEP_{}'.format(step))[i,1]
            p22_1 = getattr(stressResult, 'STEP_{}'.format(step))[i,9]
            p22_2 = getattr(stressResult, 'STEP_{}'.format(step))[i,17]
            p22_3 = getattr(stressResult, 'STEP_{}'.format(step))[i,25]
            
            p22.append([p22_0,p22_1,p22_2,p22_3])
            
            
            p12_0 = getattr(stressResult, 'STEP_{}'.format(step))[i,2]
            p12_1 = getattr(stressResult, 'STEP_{}'.format(step))[i,10]
            p12_2 = getattr(stressResult, 'STEP_{}'.format(step))[i,18]
            p12_3 = getattr(stressResult, 'STEP_{}'.format(step))[i,26]
            
            p12.append([p12_0,p12_1,p12_2,p12_3])
            
            
            m11_0 = getattr(stressResult, 'STEP_{}'.format(step))[i,3]
            m11_1 = getattr(stressResult, 'STEP_{}'.format(step))[i,11]
            m11_2 = getattr(stressResult, 'STEP_{}'.format(step))[i,19]
            m11_3 = getattr(stressResult, 'STEP_{}'.format(step))[i,27]
            
            m11.append([m11_0,m11_1,m11_2,m11_3])
            
            
            m22_0 = getattr(stressResult, 'STEP_{}'.format(step))[i,4]
            m22_1 = getattr(stressResult, 'STEP_{}'.format(step))[i,12]
            m22_2 = getattr(stressResult, 'STEP_{}'.format(step))[i,20]
            m22_3 = getattr(stressResult, 'STEP_{}'.format(step))[i,28]
            
            m22.append([m22_0,m22_1,m22_2,m22_3])
            
            
            m12_0 = getattr(stressResult, 'STEP_{}'.format(step))[i,5]
            m12_1 = getattr(stressResult, 'STEP_{}'.format(step))[i,13]
            m12_2 = getattr(stressResult, 'STEP_{}'.format(step))[i,21]
            m12_3 = getattr(stressResult, 'STEP_{}'.format(step))[i,29]
            
            m12.append([m12_0,m12_1,m12_2,m12_3])
            
            
            q1_0 = getattr(stressResult, 'STEP_{}'.format(step))[i,6]
            q1_1 = getattr(stressResult, 'STEP_{}'.format(step))[i,14]
            q1_2 = getattr(stressResult, 'STEP_{}'.format(step))[i,22]
            q1_3 = getattr(stressResult, 'STEP_{}'.format(step))[i,30]
            
            q1.append([q1_0,q1_1,q1_2,q1_3])
            
            
            q2_0 = getattr(stressResult, 'STEP_{}'.format(step))[i,7]
            q2_1 = getattr(stressResult, 'STEP_{}'.format(step))[i,15]
            q2_2 = getattr(stressResult, 'STEP_{}'.format(step))[i,23]
            q2_3 = getattr(stressResult, 'STEP_{}'.format(step))[i,31]
            
            q2.append([q2_0,q2_1,q2_2,q2_3])
            
            
            
        Hdf5.CloseFile(fileId)
    
    
    
    if History:
        try:
            fileId = Hdf5.OpenFile(AlpacaModel.recorderName, True)
        
            maxNumberStep = int(AlpacaModel.analysis.NumberOfSteps)
    
            stressResult = Hdf5.ReadObject[Steps](fileId, "/MODEL_STAGE[1]/RESULTS/ON_ELEMENTS/stresses/53-UnknownMovableObject[201:0:0]/DATA")
            #stressResult = Hdf5.ReadObject[Steps](fileId, "/MODEL_STAGE[1]/RESULTS/ON_ELEMENTS/stresses/167-UnknownMovableObject[103:0:0]/DATA")
            
            
            for i,item in enumerate(AlpacaModel.shells):
                
                p11Temp = []
                p22Temp = []
                p12Temp = []
                
                m11Temp = []
                m22Temp = []
                m12Temp = []
                
                q1Temp = []
                q2Temp = []
                
                for n_step in range(maxNumberStep):
                    
                    p11_0 = getattr(stressResult, 'STEP_{}'.format(n_step))[i,0]
                    p11_1 = getattr(stressResult, 'STEP_{}'.format(n_step))[i,8]
                    p11_2 = getattr(stressResult, 'STEP_{}'.format(n_step))[i,16]
                    p11_3 = getattr(stressResult, 'STEP_{}'.format(n_step))[i,24]
                    
                    p11Temp.append([p11_0,p11_1,p11_2,p11_3])
                    
                    
                    
                    p22_0 = getattr(stressResult, 'STEP_{}'.format(n_step))[i,1]
                    p22_1 = getattr(stressResult, 'STEP_{}'.format(n_step))[i,9]
                    p22_2 = getattr(stressResult, 'STEP_{}'.format(n_step))[i,17]
                    p22_3 = getattr(stressResult, 'STEP_{}'.format(n_step))[i,25]
                    
                    p22Temp.append([p22_0,p22_1,p22_2,p22_3])
                    
                    
                    p12_0 = getattr(stressResult, 'STEP_{}'.format(n_step))[i,2]
                    p12_1 = getattr(stressResult, 'STEP_{}'.format(n_step))[i,10]
                    p12_2 = getattr(stressResult, 'STEP_{}'.format(n_step))[i,18]
                    p12_3 = getattr(stressResult, 'STEP_{}'.format(n_step))[i,26]
                    
                    p12Temp.append([p12_0,p12_1,p12_2,p12_3])
                    
                    
                    m11_0 = getattr(stressResult, 'STEP_{}'.format(n_step))[i,3]
                    m11_1 = getattr(stressResult, 'STEP_{}'.format(n_step))[i,11]
                    m11_2 = getattr(stressResult, 'STEP_{}'.format(n_step))[i,19]
                    m11_3 = getattr(stressResult, 'STEP_{}'.format(n_step))[i,27]
                    
                    m11Temp.append([m11_0,m11_1,m11_2,m11_3])
                    
                    
                    m22_0 = getattr(stressResult, 'STEP_{}'.format(n_step))[i,4]
                    m22_1 = getattr(stressResult, 'STEP_{}'.format(n_step))[i,12]
                    m22_2 = getattr(stressResult, 'STEP_{}'.format(n_step))[i,20]
                    m22_3 = getattr(stressResult, 'STEP_{}'.format(n_step))[i,28]
                    
                    m22Temp.append([m22_0,m22_1,m22_2,m22_3])
                    
                    
                    m12_0 = getattr(stressResult, 'STEP_{}'.format(n_step))[i,5]
                    m12_1 = getattr(stressResult, 'STEP_{}'.format(n_step))[i,13]
                    m12_2 = getattr(stressResult, 'STEP_{}'.format(n_step))[i,21]
                    m12_3 = getattr(stressResult, 'STEP_{}'.format(n_step))[i,29]
                    
                    m12Temp.append([m12_0,m12_1,m12_2,m12_3])
                    
                    
                    q1_0 = getattr(stressResult, 'STEP_{}'.format(n_step))[i,6]
                    q1_1 = getattr(stressResult, 'STEP_{}'.format(n_step))[i,14]
                    q1_2 = getattr(stressResult, 'STEP_{}'.format(n_step))[i,22]
                    q1_3 = getattr(stressResult, 'STEP_{}'.format(n_step))[i,30]
                    
                    q1Temp.append([q1_0,q1_1,q1_2,q1_3])
                    
                    
                    q2_0 = getattr(stressResult, 'STEP_{}'.format(n_step))[i,7]
                    q2_1 = getattr(stressResult, 'STEP_{}'.format(n_step))[i,15]
                    q2_2 = getattr(stressResult, 'STEP_{}'.format(n_step))[i,23]
                    q2_3 = getattr(stressResult, 'STEP_{}'.format(n_step))[i,31]
                    
                    q2Temp.append([q2_0,q2_1,q2_2,q2_3])
                
                p11.append(p11Temp)
                p22.append(p22Temp)
                p12.append(p12Temp)
                
                m11.append(m11Temp)
                m22.append(m22Temp)
                m12.append(m12Temp)
                
                q1.append(q1Temp)
                q2.append(q2Temp)
            Hdf5.CloseFile(fileId)
        except:
            Hdf5.CloseFile(fileId)
    
    
    
    Mesh = []
    for item in AlpacaModel.shells:
        Mesh.append(item.Mesh)
    
    p11 = th.list_to_tree(p11)
    p22 = th.list_to_tree(p22)
    p12 = th.list_to_tree(p12)
    
    m11 = th.list_to_tree(m11)
    m22 = th.list_to_tree(m22)
    m12 = th.list_to_tree(m12)
    
    q1 = th.list_to_tree(q1)
    q2 = th.list_to_tree(q2)
# ---------- end ss ----------
panel_10 = Panel(rf.ReactionForce)

pt_5 = Point(rf.SupportPosition)
vec_2 = Vector(rf.ReactionMoment)
amp = Amplitude(Vector=vec_2, Amplitude=1)
vdisex = VectorDisplayEx(Point=pt_5, Vector=amp, Colour=ColourSwatch(SwatchColor=RGB(0, 128, 201)), Width=Slider(4, range=1..5))

pt_6 = Point(rf.SupportPosition)
vec_3 = Vector(rf.ReactionForce)
amp_2 = Amplitude(Vector=vec_3, Amplitude=1)
vdisex_2 = VectorDisplayEx(Point=pt_6, Vector=amp_2, Colour=ColourSwatch(SwatchColor=RGB(201, 0, 0)), Width=Slider(4, range=1..5))

rf_2 = ReactionForcesAlpaca4d()  # -> out, SupportPosition, ReactionForce, ReactionMoment; inputs History: Boolean, step: Int32; same code as rf

panel_11 = Panel("21000")  # disabled
panel_12 = Panel("0.3")  # disabled
panel_13 = Panel("8070")  # disabled
panel_14 = Panel("10")  # disabled
panel_15 = Panel("21000")  # disabled
panel_16 = Panel("0.3")  # disabled
panel_17 = Panel("8070")  # disabled
panel_18 = Panel("500")  # disabled
python_15 = GhPythonScript(
    Ex=panel_11,
    Ey=panel_11,
    Ez=panel_11,
    vxy=panel_12,
    vyz=panel_12,
    vzx=panel_12,
    Gxy=panel_13,
    Gyz=panel_13,
    Gzy=panel_13,
    rho=panel_14)  # -> out, nDMaterial; disabled
# ---------- python_15: Python ----------
import opensees.openseesGH as alpaca


nDMaterial = alpaca.ElasticOrthotropic(name, Ex,Ey,Ez,vxy,vyz,vzx,Gxy,Gyz,Gzy,rho,fy)




print(nDMaterial.write_tcl())
# ---------- end python_15 ----------
python_16 = GhPythonScript(
    Ex=panel_15,
    Ey=panel_15,
    Ez=panel_15,
    vxy=panel_16,
    vyz=panel_16,
    vzx=panel_16,
    Gxy=panel_17,
    Gyz=panel_17,
    Gzy=panel_17,
    rho=panel_18)  # -> out, nDMaterial; disabled
# ---------- python_16: Python ----------
import opensees.openseesGH as alpaca


nDMaterial = alpaca.ElasticOrthotropic(name, Ex,Ey,Ez,vxy,vyz,vzx,Gxy,Gyz,Gzy,rho,fy)

print(nDMaterial.rho)
print(nDMaterial.vxy)

print(nDMaterial.write_tcl())
# ---------- end python_16 ----------
merge = Merge(Data1=python_15.nDMaterial, Data2=python_16.nDMaterial, Data3=python_15.nDMaterial)  # disabled
panel_19 = Panel("""10
10
10""")  # disabled
panel_20 = Panel("CLT")  # disabled
python_17 = GhPythonScript(sectionName=panel_20, materials=merge, thicknesses=panel_19)  # -> out, layeredShellSection; inputs materials: list, thicknesses: list; disabled
# ---------- python_17: Python ----------
import opensees.openseesGH as alpaca

#layeredShellSection = alpaca.LayeredShell(sectionName, materials, thicknesses)
#layeredShellSectionPY = alpaca.LayeredShell(sectionName, materials, thicknesses).write_py()

layeredShellSection = alpaca.LayeredShell(sectionName, materials, thicknesses)
# ---------- end python_17 ----------

# ----
# ForceBeamColumn
swatch_6 = ColourSwatch(SwatchColor=RGB(255, 255, 255))
python_18 = GhPythonScript(Colour=swatch_6, Orient="3")  # -> out, element; inputs Line: Curve, Colour: Color
# ---------- python_18: Python ----------
"""
Create a support
-
    Args:
        Line:
        CrossSection:
        Colour:
        Orient:
    Returns:
        element:
"""


import sys
import Rhino.Geometry as rg
import Grasshopper as gh
import copy


## add alpaca install directory to system path

ghcompfolder = gh.Folders.DefaultAssemblyFolder
if ghcompfolder not in sys.path:
    sys.path.append(ghcompfolder)

try:
    from Alpaca4d import alpaca4d as alpaca
except:
    msg = "Cannot import Alpaca4d. Is the Alpaca4d folder available in " + ghcompfolder + "?"
    ghenv.Component.AddRuntimeMessage(gh.Kernel.GH_RuntimeMessageLevel.Error, msg)


checkData = True

if not Line:
    checkData = False
    msg = "Input parameter Line failed to collect data"
    ghenv.Component.AddRuntimeMessage(gh.Kernel.GH_RuntimeMessageLevel.Warning, msg)


if not CrossSection:
    checkData = False
    msg = "Input parameter CrossSection failed to collect data"
    ghenv.Component.AddRuntimeMessage(gh.Kernel.GH_RuntimeMessageLevel.Warning, msg)

if not Colour:
    Colour = Color.Red

if not Orient:
    Orient = 0.0


if checkData:
    newCrossSection = copy.deepcopy(CrossSection)
    element = alpaca.ForceBeamColumn(Line, newCrossSection, Colour, Orient)
# ---------- end python_18 ----------

# ----
# Layered Shell
python_19 = GhPythonScript()  # -> out, LayeredShell; inputs thicknesses: list, nDMaterials: list
# ---------- python_19: Python ----------
"""
Create a support
-
    Args:
        secName:
        thicknesses:
        nDMaterials:
    Returns:
        fiberSection:
"""


import sys
import Rhino.Geometry as rg
import Grasshopper as gh
import copy


## add alpaca install directory to system path

ghcompfolder = gh.Folders.DefaultAssemblyFolder
if ghcompfolder not in sys.path:
    sys.path.append(ghcompfolder)

try:
    from Alpaca4d import alpaca4d as alpaca
except:
    msg = "Cannot import Alpaca4d. Is the Alpaca4d folder available in " + ghcompfolder + "?"
    ghenv.Component.AddRuntimeMessage(gh.Kernel.GH_RuntimeMessageLevel.Error, msg)


checkData = True

if not thicknesses:
    checkData = False
    msg = "Input parameter thicknesses failed to collect data"
    ghenv.Component.AddRuntimeMessage(gh.Kernel.GH_RuntimeMessageLevel.Warning, msg)

if not nDMaterials:
    checkData = False
    msg = "Input parameter nDMaterials failed to collect data"
    ghenv.Component.AddRuntimeMessage(gh.Kernel.GH_RuntimeMessageLevel.Warning, msg)

if checkData:
    LayeredShell = alpaca.LayeredShell(secName, nDMaterials, thicknesses)
# ---------- end python_19 ----------

pt_7 = Point(duppt)
pdecon_3 = Deconstruct(Point=pt_7)  # -> XComponent, YComponent, ZComponent
bnd = Bounds(Numbers=pdecon_3.ZComponent)
dedomain = DeconstructDomain(Domain=bnd)  # -> Start, End
addition_2 = Addition(A="0.01", B=dedomain.Start)
smaller = SmallerThan(FirstNumber=pdecon_3.ZComponent, SecondNumber=addition_2)  # -> SmallerThan, OrEqualTo
cull_2 = CullPattern(List=pt_7, CullPattern=smaller.SmallerThan)

dispatch = Dispatch(List=pt_7, DispatchPattern=smaller.SmallerThan)  # -> ListA, ListB

rdpoints = RemoveDuplicatePointsKaramba3D(Point=dispatch.ListB, LimitDistance=0.005)  # -> OutPoint, Info, Indexes

duppt_6 = RemoveDuplicatePts(Points=dispatch.ListA, Tolerance=0.01)
duppt_7 = RemoveDuplicatePts(Points=dispatch.ListB, Tolerance=0.01)
pt_8 = Point(rdpoints.OutPoint)

# ----
# Trigonometric Time Series
python_20 = GhPythonScript(tStart=Slider(0, range=0..5), tEnd="10.00", period="3.00")  # -> timeSeries, Graph
# ---------- python_20: Python ----------
"""
Create a PointLoad
-
    Args:
        tStart:
        tEnd:
        period:
        factor:
        shift:
    Returns:
        timeSeries:
        Graph:
"""

import sys
import Rhino.Geometry as rg
import Grasshopper as gh
import copy
import math


## add alpaca install directory to system path

ghcompfolder = gh.Folders.DefaultAssemblyFolder
if ghcompfolder not in sys.path:
    sys.path.append(ghcompfolder)

try:
    from Alpaca4d import alpaca4d as alpaca
except:
    msg = "Cannot import Alpaca4d. Is the Alpaca4d folder available in " + ghcompfolder + "?"
    ghenv.Component.AddRuntimeMessage(gh.Kernel.GH_RuntimeMessageLevel.Error, msg)


def TrigonometricSeries(tStart, tEnd, period, shift, factor,t):
    if tStart <= t and t < tEnd:
        x = factor * math.sin( (2.0 * math.pi * (t - tStart))/period + shift)
        return x
    else:
        return 0

def linspace(a, b, n):
    if n < 2:
        return None
    diff = (float(b) - a)/(n - 1)
    return [diff * i + a  for i in range(n)]



checkData = True

if not tStart and not tStart == 0:
    checkData = False
    msg = "Input parameter tStart failed to collect data"
    ghenv.Component.AddRuntimeMessage(gh.Kernel.GH_RuntimeMessageLevel.Warning, msg)

if not tEnd and not tEnd == 0:
    checkData = False
    msg = "Input parameter tEnd failed to collect data"
    ghenv.Component.AddRuntimeMessage(gh.Kernel.GH_RuntimeMessageLevel.Warning, msg)

if not period:
    checkData = False
    msg = "Input parameter period failed to collect data"
    ghenv.Component.AddRuntimeMessage(gh.Kernel.GH_RuntimeMessageLevel.Warning, msg)

if not factor:
    factor = 1

if not shift:
    shift = 0

if checkData:
    timeSeries = alpaca.TimeSeriesTrigonometric(tStart, tEnd, period, factor, shift)

    Graph = []
    
    for t in linspace(0,tEnd*2,100):
        Graph.append(TrigonometricSeries(tStart, tEnd, period, shift, factor,t))
# ---------- end python_20 ----------
panel_21 = Panel(python_20.timeSeries)

graph_3 = QuickGraph(python_20.Graph, SortOrder=0)

num = Number([-0.000450671, -0.000455154, -1.48413e-05, 0.000507632, 0.000437923, 0.000441503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])
lng = ListLength(List=num)
series_3 = Series(Start=0, Step="0.01", Count=lng)

# ----
# Path TimeSeries
number_slider_9 = Slider(7, range=1..10)
python_21 = GhPythonScript(time=series_3, values=num, factor=number_slider_9)  # -> out, timeSeries, Graph; inputs time: list, values: list
# ---------- python_21: Python ----------
"""
Create a Time Series Path
-
    Args:
        time:
        values:
        factor:
    Returns:
        timeSeries:
        Graph:
"""

import sys
import Rhino.Geometry as rg
import Grasshopper as gh
import copy


## add alpaca install directory to system path

ghcompfolder = gh.Folders.DefaultAssemblyFolder
if ghcompfolder not in sys.path:
    sys.path.append(ghcompfolder)

try:
    from Alpaca4d import alpaca4d as alpaca
except:
    msg = "Cannot import Alpaca4d. Is the Alpaca4d folder available in " + ghcompfolder + "?"
    ghenv.Component.AddRuntimeMessage(gh.Kernel.GH_RuntimeMessageLevel.Error, msg)


checkData = True

if not time:
    checkData = False
    msg = "Input parameter time failed to collect data"
    ghenv.Component.AddRuntimeMessage(gh.Kernel.GH_RuntimeMessageLevel.Warning, msg)

if not values:
    checkData = False
    msg = "Input parameter values failed to collect data"
    ghenv.Component.AddRuntimeMessage(gh.Kernel.GH_RuntimeMessageLevel.Warning, msg)

if not factor:
    factor = 1


if checkData:
    timeSeries = alpaca.TimeSeriesPath(values, time, factor)
    Graph = [value * factor for value in values]
# ---------- end python_21 ----------

graph_4 = QuickGraph(python_21.Graph, SortOrder=0)
