# Grasshopper definition timberDesign.gh (Grasshopper 1.0.7)

random_value = Panel("20500")
value_list = ValueList({"C14", "C16", "C18", "C20", "C22", "C24"}, selected="C24")
tp = TimberPropertiesAlpaca4d(TimberClass="C16", kgCO_2e_kg=0)  # -> out, timber_attributes
# ---------- tp: Python ----------
"""
Create timber material attributes
-
    Args:
        TimberClass:
        fm_k:
        fc_0_k:
        fc_90_k:
        ft_0_k:
        ft_90_k:
        fv_k:
        E0_05:
        G_Mean:
        service_class:
        kgC02e_kg:
    Returns:
        timber_attributes:
"""


import os
import sys
import Rhino.Geometry as rg
import Grasshopper as gh
import copy
import json



ghenv.Component.Name = "Timber Properties (Alpaca4d)"
ghenv.Component.NickName = 'TP'
ghenv.Component.Message = "Timber Properties {} (Alpaca4d)".format(TimberClass)



## add alpaca install directory to system path

ghcompfolder = gh.Folders.DefaultAssemblyFolder
if ghcompfolder not in sys.path:
    sys.path.append(ghcompfolder)

try:
    from Alpaca4d import alpaca4d as alpaca
except:
    msg = "Cannot import Alpaca4d. Is the Alpaca4d folder available in " + ghcompfolder + "?"
    ghenv.Component.AddRuntimeMessage(gh.Kernel.GH_RuntimeMessageLevel.Error, msg)


timber_library = os.path.join(ghcompfolder,'Alpaca4d/Material/Timber/timber_properties.json')


class Struct:
    def __init__(self, **entries):
        self.__dict__.update(entries)
    
    def __repr__(self):
        return str(self.__dict__)




# Opening JSON 
with open(timber_library, 'r') as json_file:
    timber_properties = json.load(json_file)



if fc_0_k:
    timber_properties[TimberClass]['fc_0_k'] = fc_0_k
if fm_k:
    timber_properties[TimberClass]['fm_k'] = fm_k
if fc_90_k:
    timber_properties[TimberClass]['fc_90_k'] = fc_90_k
if ft_0_k:
    timber_properties[TimberClass]['ft_0_k'] = ft_0_k
if ft_90_k:
    timber_properties[TimberClass]['ft_90_k'] = ft_90_k
if fv_k:
    timber_properties[TimberClass]['fv_k'] = fv_k
if E0_05:
    timber_properties[TimberClass]['E0_05'] = E0_05
if G_Mean:
    timber_properties[TimberClass]['G_Mean'] = G_Mean

timber_properties[TimberClass]['name'] = TimberClass

timber_properties[TimberClass]['carbon_factor'] = kgCO_2e_kg


for k,v in timber_properties[TimberClass].items():
    print("{}: {}".format(k,v))



timber_attributes = Struct(**timber_properties[TimberClass])
# ---------- end tp ----------

panel = Panel(tp.out)
uem = UniaxialElasticMaterialAlpaca4d(E="210000", v="0.30", rho="400", attributes=tp.timber_attributes)  # -> out, uniAxialMaterial
# ---------- uem: Python ----------
"""
Create a uniaxial Elastic Material
-
    Args:
        E:
        Eneg:
        eta:
        G:
        v:
        rho:
    Returns:
        uniAxialMaterial:
"""

ghenv.Component.Name = "uniaxial Elastic Material (Alpaca4d)"
ghenv.Component.NickName = 'UEM'
ghenv.Component.Message = "uniaxial Elastic (Alpaca4d)"

import sys
import Rhino.Geometry as rg
import Grasshopper as gh
import copy


## add alpaca install directory to system path

ghcompfolder = gh.Folders.DefaultAssemblyFolder
if ghcompfolder not in sys.path:
    sys.path.append(ghcompfolder)

try:
    from Alpaca4d import alpaca4d as alpaca
except:
    msg = "Cannot import Alpaca4d. Is the Alpaca4d folder available in " + ghcompfolder + "?"
    ghenv.Component.AddRuntimeMessage(gh.Kernel.GH_RuntimeMessageLevel.Error, msg)


checkData = True

if not E:
    checkData = False
    msg = "Input parameter E failed to collect data"
    ghenv.Component.AddRuntimeMessage(gh.Kernel.GH_RuntimeMessageLevel.Warning, msg)

if not G and not v:
    checkData = False
    msg = "Input parameter G or v failed to collect data"
    ghenv.Component.AddRuntimeMessage(gh.Kernel.GH_RuntimeMessageLevel.Warning, msg)

if not rho:
    checkData = False
    msg = "Input parameter rho failed to collect data"
    ghenv.Component.AddRuntimeMessage(gh.Kernel.GH_RuntimeMessageLevel.Warning, msg)



if checkData:
    uniAxialMaterial = alpaca.uniAxialMaterialElastic(name, E, Eneg, eta, G, v, rho, attributes)
# ---------- end uem ----------
rs = RectangularSectionAlpaca4d(b="10", h="50", material=uem.uniAxialMaterial)  # -> out, Section
# ---------- rs: Python ----------
"""
Create a Rectangular Cross Section
-
    Args:
        secName:
        Area:
        Izz:
        Iyy:
        J:
        alphaY:
        alphaZ:
        material:
    Returns:
        Section:
"""
ghenv.Component.Name = "Rectangular Section (Alpaca4d)"
ghenv.Component.NickName = 'RS'
ghenv.Component.Message = "Rectangular Section (Alpaca4d)"

import sys
import Rhino.Geometry as rg
import Grasshopper as gh
import copy


## add alpaca install directory to system path

ghcompfolder = gh.Folders.DefaultAssemblyFolder
if ghcompfolder not in sys.path:
    sys.path.append(ghcompfolder)

try:
    from Alpaca4d import alpaca4d as alpaca
except:
    msg = "Cannot import Alpaca4d. Is the Alpaca4d folder available in " + ghcompfolder + "?"
    ghenv.Component.AddRuntimeMessage(gh.Kernel.GH_RuntimeMessageLevel.Error, msg)


checkData = True

if not b:
    checkData = False
    msg = "Input parameter b failed to collect data"
    ghenv.Component.AddRuntimeMessage(gh.Kernel.GH_RuntimeMessageLevel.Warning, msg)

if not h:
    checkData = False
    msg = "Input parameter h failed to collect data"
    ghenv.Component.AddRuntimeMessage(gh.Kernel.GH_RuntimeMessageLevel.Warning, msg)

if not material:
    checkData = False
    msg = "Input parameter material failed to collect data"
    ghenv.Component.AddRuntimeMessage(gh.Kernel.GH_RuntimeMessageLevel.Warning, msg)



if checkData:
    Section = alpaca.RectangularCS(secName, b,h,material)
# ---------- end rs ----------
crv = Curve(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)
bca = BeamColumnAttributeAlpaca4d(Buckling_Length_Y="1000", Buckling_Length_Z="1000")  # -> out, Beam_attributes
# ---------- bca: Python ----------
"""
Create a Force Beam Column Attribute
-
    Args:
        Buckling_Length_Y:
        Buckling_Length_Z:
    Returns:
        Beam_attributes:
"""

ghenv.Component.Name = "Beam Column Attribute (Alpaca4d)"
ghenv.Component.NickName = 'BCA'
ghenv.Component.Message = "Beam Column Attribute (Alpaca4d)"


import sys
import Rhino.Geometry as rg
import Grasshopper as gh
import ghpythonlib.components as ghcomp
from System.Drawing import Color

## add alpaca install directory to system path

ghcompfolder = gh.Folders.DefaultAssemblyFolder
if ghcompfolder not in sys.path:
    sys.path.append(ghcompfolder)

try:
    from Alpaca4d import alpaca4d as alpaca
except:
    msg = "Cannot import Alpaca4d. Is the Alpaca4d folder available in " + ghcompfolder + "?"
    ghenv.Component.AddRuntimeMessage(gh.Kernel.GH_RuntimeMessageLevel.Error, msg)


checkData = True

class Struct:
    def __init__(self, **entries):
        self.__dict__.update(entries)
    
    def __repr__(self):
        return str(self.__dict__)


beam_attribute = {}

beam_attribute['Buckling_Length_Y'] = Buckling_Length_Y
beam_attribute['Buckling_Length_Z'] = Buckling_Length_Z



if checkData:
    Beam_attributes = Struct(**beam_attribute)
# ---------- end bca ----------
fbc = ForceBeamColumnAlpaca4d(Line=crv, Section=rs.Section, attributes=bca.Beam_attributes)  # -> out, Element; inputs Line: Curve, Colour: Color, Z_Axis: Vector3d
# ---------- fbc: Python ----------
"""
Create a Force Beam Column
-
    Args:
        Line:
        Section:
        Colour:
        Z_Axis:
    Returns:
        Element:
"""

ghenv.Component.Name = "Force Beam Column (Alpaca4d)"
ghenv.Component.NickName = 'FBC'
ghenv.Component.Message = "Force Beam Column (Alpaca4d)"


import sys
import Rhino.Geometry as rg
import Grasshopper as gh
import ghpythonlib.components as ghcomp
from System.Drawing import Color

## add alpaca install directory to system path

ghcompfolder = gh.Folders.DefaultAssemblyFolder
if ghcompfolder not in sys.path:
    sys.path.append(ghcompfolder)

try:
    from Alpaca4d import alpaca4d as alpaca
except:
    msg = "Cannot import Alpaca4d. Is the Alpaca4d folder available in " + ghcompfolder + "?"
    ghenv.Component.AddRuntimeMessage(gh.Kernel.GH_RuntimeMessageLevel.Error, msg)


checkData = True

if not Line:
    checkData = False
    msg = "Input parameter Line failed to collect data"
    ghenv.Component.AddRuntimeMessage(gh.Kernel.GH_RuntimeMessageLevel.Warning, msg)


if not Section:
    checkData = False
    msg = "Input parameter Section failed to collect data"
    ghenv.Component.AddRuntimeMessage(gh.Kernel.GH_RuntimeMessageLevel.Warning, msg)

if not Colour:
    Colour = Color.Red


if not GeomTransf:
    GeomTransf = "Linear"

if checkData:
    
    if not Z_Axis:
        midPoint =  Line.PointAtNormalizedLength(0.5)
        parameter = Line.ClosestPoint(midPoint, 0.01)[1]
        Z_Axis = ghcomp.PerpFrame( Line, parameter )
    Element = alpaca.ForceBeamColumn(Line, Section, GeomTransf, Colour, Z_Axis, attributes)
# ---------- end fbc ----------
bf = BeamForcesAlpaca4d(History=False)  # -> out, N, T2, T3, M1, M2, M3; inputs History: Boolean, step: Int32
# ---------- bf: Python ----------
"""
Read Beam Forces

    Args:
        AlpacaModel:
        History:
        step:
    Returns:
        N: forces in direction 3  (Axial Force)
        M2: Moments around axis 2 (Bending Moment 1)
        T1: forces in direction 1 (Shear Force 1)
        M1: Moments around axis 1 (Bending Moment 2)
        T2: forces in direction 2 (Shear Force 2)
        Mt: Moments around axis 3 (Twisting Moment)
"""

import sys
import os
import System
from System.Drawing import Color
import clr
import clrtype
import Rhino.Geometry as rg
import rhinoscriptsyntax as rs
import Grasshopper as gh
import copy
import ghpythonlib.treehelpers as th


ghenv.Component.Name = "Beam Forces (Alpaca4d)"
ghenv.Component.NickName = 'BF'
ghenv.Component.Message = "Beam Forces (Alpaca4d)"
## add alpaca install directory to system path

ghcompfolder = gh.Folders.DefaultAssemblyFolder
if ghcompfolder not in sys.path:
    sys.path.append(ghcompfolder)

try:
    from Alpaca4d import alpaca4d as alpaca
except:
    msg = "Cannot import Alpaca4d. Is the Alpaca4d folder available in " + ghcompfolder + "?"
    ghenv.Component.AddRuntimeMessage(gh.Kernel.GH_RuntimeMessageLevel.Error, msg)



FolderPath = rs.DocumentPath()
os.chdir(FolderPath)


# import costum modules to read the hdf5 file

my_module_name = "Alpaca_StepReader"
my_module = sys.modules.setdefault(my_module_name, type(sys)(my_module_name))

hdfFilePath = os.path.join(ghcompfolder, "Alpaca4d\HDF5CSharp.dll")
clr.AddReferenceToFileAndPath(hdfFilePath)

from HDF5CSharp import Hdf5

try:
    Steps = my_module.Steps
except AttributeError:
    type_2d = type(System.Array.CreateInstance(float, 1, 1))

    class Steps(object):
        __metaclass__ = clrtype.ClrClass
        _clrfields = {"STEP_{}".format(i): type_2d for i in range(1000)} # it will work for model with less than 1000 steps

    my_module.Steps = Steps


checkData = True

if not AlpacaModel:
    checkData = False
    msg = "Input parameter AlpacaModel failed to collect data"
    ghenv.Component.AddRuntimeMessage(gh.Kernel.GH_RuntimeMessageLevel.Warning, msg)

if checkData:
    
    step = (int(AlpacaModel.analysis.AnalysisSteps.numIncr) - 1) if step is None else step
    
    N = []
    T1 = []
    T2 = []
    M1 = []
    M2 = []
    Mz = []
    
    fileId = Hdf5.OpenFile(AlpacaModel.recorderName, True)
    
    stressResult = Hdf5.ReadObject[Steps](fileId, "/MODEL_STAGE[1]/RESULTS/ON_ELEMENTS/section.force/74-ForceBeamColumn3d[1000:1:0]/DATA")
    if History is True:
        try:
            maxNumberStep = int(AlpacaModel.analysis.AnalysisSteps.numIncr)
        
        
            for i,item in enumerate(AlpacaModel.beams):
                
                Ni = []
                M2i = []
                T1i = []
                
                M1i = []
                T2i = []
                Mzi = []
                
                for istep in range(maxNumberStep):
                
                    ni = 5 # potrebbe cambiare per ogni trave
                    Ni.append([getattr(stressResult, 'STEP_{}'.format(istep))[i,j] for j in range(0,ni*6, 6)])
                    M2i.append([ getattr(stressResult, 'STEP_{}'.format(istep))[i,j] for j in range(1,ni*6, 6)])
                    T1i.append([ getattr(stressResult, 'STEP_{}'.format(istep))[i,j] for j in range(2,ni*6, 6)])
                    M1i.append([ getattr(stressResult, 'STEP_{}'.format(istep))[i,j] for j in range(3,ni*6, 6)])
                    T2i.append([ getattr(stressResult, 'STEP_{}'.format(istep))[i,j] for j in range(4,ni*6, 6)])
                    Mzi.append([ getattr(stressResult, 'STEP_{}'.format(istep))[i,j] for j in range(5,ni*6, 6)])
                
                N.append([Ni])
                M2.append([M2i])
                T1.append([T1i])
                M1.append([M1i])
                T2.append([T2i])
                Mz.append([Mzi])
            Hdf5.CloseFile(fileId)
            print("I have closed the file")
        except:
            Hdf5.CloseFile(fileId)
            print("I have closed the file")
    elif History == False:
        try:
            for i,item in enumerate(AlpacaModel.beams):
                ni = 5 # potrebbe cambiare per ogni trave
                Ni = [ getattr(stressResult, 'STEP_{}'.format(step))[i,j] for j in range(0,ni*6, 6)]
                M2i = [ getattr(stressResult, 'STEP_{}'.format(step))[i,j] for j in range(1,ni*6, 6)]  
                T1i = [ getattr(stressResult, 'STEP_{}'.format(step))[i,j] for j in range(2,ni*6, 6)]
                M1i = [ getattr(stressResult, 'STEP_{}'.format(step))[i,j] for j in range(3,ni*6, 6)]
                T2i = [ getattr(stressResult, 'STEP_{}'.format(step))[i,j] for j in range(4,ni*6, 6)]
                Mzi = [ getattr(stressResult, 'STEP_{}'.format(step))[i,j] for j in range(5,ni*6, 6)]
                
                N.append([Ni])
                M2.append([M2i])
                T1.append([T1i])
                M1.append([M1i])
                T2.append([T2i])
                Mz.append([Mzi])
            
            Hdf5.CloseFile(fileId)
            print("I have closed the file")
        
        except:
            Hdf5.CloseFile(fileId)
            print("I have closed the file")
    
    
    
    N = th.list_to_tree(N)
    M2 = th.list_to_tree(M2)
    T1 = th.list_to_tree(T1)
    M1 = th.list_to_tree(M1)
    T2 = th.list_to_tree(T2)
    Mz = th.list_to_tree(Mz)
# ---------- end bf ----------
knm_to_nmm = Number(expr("x*1000000", bf.M1))
knm_to_nmm_2 = Number(expr("x*1000000", bf.M2))
knm_to_nmm_3 = Number(expr("x*1000000", bf.M3))
kn_to_n = Number(expr("x*1000", bf.N))
kn_to_n_2 = Number(expr("x*1000", bf.T2))
kn_to_n_3 = Number(expr("x*1000", bf.T3))
data = Data(fbc.Element)

# ----
# units: kN
panel_2 = Panel("-10")

duration = ValueList({"permanent", "long_term", "medium_term", "short_term", "instantaneous"}, selected="instantaneous")
country = ValueList({"italy", "canicatty"}, selected="italy")
service_class = ValueList({"1", "2", "3"}, selected="1")
knm_to_nmm_4 = Number(expr("x*1000000", "-10"))
knm_to_nmm_5 = Number(expr("x*1000000", "0.0"))
knm_to_nmm_6 = Number(expr("x*1000000", "0.0"))
kn_to_n_4 = Number(expr("x*1000", panel_2))
kn_to_n_5 = Number(expr("x*1000", "0.0"))
kn_to_n_6 = Number(expr("x*1000", "2"))
tc = TimberBeamUtilisationAlpaca4d(
    BeamElement=data,
    duration=duration,
    service_class=service_class,
    country=country,
    N_x=kn_to_n_4,
    V_y=kn_to_n_5,
    V_z=kn_to_n_6,
    M_x=knm_to_nmm_4,
    M_y=knm_to_nmm_6,
    M_z=knm_to_nmm_5)  # -> out, util_axial, util_bending_y, util_bending_z, util_shear, util_bending_tens_y, util_bending_tens_z, util_bending_comp_y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
# ---------- tc: Python ----------
"""
Timber Check based on Eurocode 5
-
    Args:
        BeamElement:
        duration:
        N_x:
        V_y:
        V_z:
        M_x:
        M_y:
        M_z:
    Returns:
        util_axial:
        util_bending_y:
        util_bending_z:
        util_shear:
        util_bending_tens_y:
        util_bending_tens_z:
        util_bending_comp_y:
        util_bending_comp_z:
        util_LTB_capacity:
        utilisation:
"""


import math
import json
import os

import sys
import Rhino.Geometry as rg
import Grasshopper as gh


ghenv.Component.Name = "Timber Beam Utilisation (Alpaca4d)"
ghenv.Component.NickName = 'TC'
ghenv.Component.Message = "Timber Check (Alpaca4d)"



## add alpaca install directory to system path

ghcompfolder = gh.Folders.DefaultAssemblyFolder
if ghcompfolder not in sys.path:
    sys.path.append(ghcompfolder)

try:
    from Alpaca4d import alpaca4d as alpaca
    from Alpaca4d import alpaca4d_timber as alpacaTimber
except:
    msg = "Cannot import Alpaca4d. Is the Alpaca4d folder available in " + ghcompfolder + "?"
    ghenv.Component.AddRuntimeMessage(gh.Kernel.GH_RuntimeMessageLevel.Error, msg)



folder_path = os.path.join(ghcompfolder,'Alpaca4d/Material/Timber')


duration = 'instantaneous' if duration is None else duration
service_class = "2" if service_class is None else service_class
country = 'italy' if country is None else country

N_x = 0.00 if N_x is None else N_x
V_y = 0.00 if V_y is None else V_y
V_z = 0.00 if V_z is None else V_z
M_x = 0.00 if M_x is None else M_x
M_y = 0.00 if M_y is None else M_y
M_z = 0.00 if M_z is None else M_z



checkData = True

if not BeamElement:
    checkData = False
    msg = "Input parameter BeamElement failed to collect data"
    ghenv.Component.AddRuntimeMessage(gh.Kernel.GH_RuntimeMessageLevel.Warning, msg)


if checkData:


    b = BeamElement.CrossSection.b
    h = BeamElement.CrossSection.h
    
    Timber_Class = BeamElement.CrossSection.material.attributes.name
    
    L_ey = BeamElement.attributes.Buckling_Length_Y
    L_ez = BeamElement.attributes.Buckling_Length_Z
    
    
    
    timber_properties, k_mod, safety_factor, straightness_factor = alpacaTimber.load_timber_properties(folder_path)
    
    Area, W_y, W_z, I_y, I_z, I_t, radii_of_gyration_y, radii_of_gyration_z = alpacaTimber.section_properties(b, h)
    
    material_type, fm_k, fv_k, fc_0_k, ft_0_k, E_mean, E0_05, G_mean, G0_05 = alpacaTimber.material_properties(timber_properties, Timber_Class)
    
    km, gamma_m , kmod, ky_h, kz_h, kh = alpacaTimber.design_parameters(b, h, safety_factor, country, material_type, k_mod, service_class, duration)
    
    kc_y, kc_z, kc, k_crit_y, k_crit_z = alpacaTimber.buckling_parameters(b, h, L_ey, L_ez, radii_of_gyration_y, radii_of_gyration_z, fm_k, fc_0_k, E0_05, straightness_factor, material_type)
    
    sigma_c_0_d, sigma_t_0_d = alpacaTimber.axial_stress(N_x, Area)
    
    sigma_m_y_d, sigma_m_z_d = alpacaTimber.bending_stress(M_y, M_z, W_y, W_z)
    
    tau_d = alpacaTimber.shear_stress(V_y, V_z, b, h)
    
    fc_0_d, ft_0_d = alpacaTimber.axial_resistance(kh, kmod, fc_0_k, ft_0_k, gamma_m)
    
    fm_y_d, fm_z_d = alpacaTimber.bending_resistance(kmod, ky_h, kz_h, fm_k, gamma_m)
    
    fv_d = alpacaTimber.shear_resistance(kmod, fv_k, gamma_m)
    
    util_axial_tens, util_axial_comp, util_axial = alpacaTimber.utilisation_axial(sigma_c_0_d, sigma_t_0_d, ft_0_d, fc_0_d, kc)
    
    util_bending_y, util_bending_z = alpacaTimber.utilisation_bending(sigma_m_y_d, sigma_m_z_d, fm_y_d, fm_z_d, km)
    
    util_shear = alpacaTimber.utilisation_shear(tau_d, fv_d)
    
    util_bending_tens_y, util_bending_tens_z = alpacaTimber.utilisation_tension_bending(sigma_t_0_d, ft_0_d, sigma_m_y_d, fm_y_d, sigma_m_z_d, fm_z_d, km)
    
    util_bending_comp_y, util_bending_comp_z = alpacaTimber.utilisation_compression_bending(sigma_c_0_d, fc_0_d, sigma_m_y_d, fm_y_d, sigma_m_z_d, fm_z_d, kc_y, kc_z, km)
    
    util_LTB_capacity = alpacaTimber.utilisation_LTB(b, h, sigma_c_0_d, fc_0_d, sigma_t_0_d, sigma_m_y_d, fm_y_d, sigma_m_z_d, fm_z_d, k_crit_y, k_crit_z, kc_z, kc_y, km)
    
    
    
    utilisation = [util_axial, util_bending_y, util_bending_z, util_shear, util_bending_tens_y, util_bending_tens_z, util_bending_comp_y, util_bending_comp_z, util_LTB_capacity]
    utilisation = [round(number,2) for number in utilisation]
    
    
    
    print("\n")
    print("Util Axial: {}".format(abs(round(util_axial,2))))
    print("Util Bending y: {}".format(abs(round(util_bending_y,2))))
    print("Util Bending z: {}".format(abs(round(util_bending_z,2))))
    print("Util Shear: {}".format(abs(round(util_shear,2))))
    
    print("\n")
    print("Util Combined Bending_y Tension: {}".format(abs(round(util_bending_tens_y,2))))
    print("Util Combined Bending_z Tension: {}".format(abs(round(util_bending_tens_z,2))))
    print("Util Combined Bending_y Compression: {}".format(abs(round(util_bending_comp_y,2))))
    print("Util Combined Bending_z Compression: {}".format(abs(round(util_bending_comp_z,2))))
    print("Util Lateral Buckling: {}".format(abs(round(util_LTB_capacity,2))))
# ---------- end tc ----------
