# Grasshopper definition icons Together.gh (Grasshopper 1.0.7)

# ---- group: uniaxialMaterial
python = GhPythonScript(matName="S275", E="210000", G="80760", rho="75", fy="35")  # -> uniaxialMaterial
# ---------- python: Python ----------
"""Generate a uniaxial Elastic Material
    Inputs:
        matName: Name of the material.
        E: Young's Modulus [MPa].
        G: Tangential Modulus [MPa].
        v: Poisson ratio.
        rho: specific weight [kN/m3].
        fy: Yield stress value of the material [MPa]
    Output:
       uniaxialMaterial: Material element.
       """


import Grasshopper as gh

def ElasticMaterial(matName, E, G, v, rho, fy):

    E = E * 1000                               # Input value in N/mm2 ---> Output kN/m2
    if v == None:
    	G = G * 1000                           # Input value in N/mm2 ---> Output kN/m2
    	v = (E / (2 * G)) - 1
    else:
    	G = E / (2 * (1 + v))

    rho = rho                                  # Input value kN/m3
    
    fy = fy                                    # Input value in N/mm2
    materialDimension = "uniaxialMaterial"
    materialType = "Elastic"
    matName = matName + "_" + materialDimension + "_" + materialType
    
    return [[matName, E, G, v, rho, fy, materialType]]

checkData = True

if matName is None:
    checkData = False
    msg = "input 'matName' failed to collect data"
    ghenv.Component.AddRuntimeMessage(gh.Kernel.GH_RuntimeMessageLevel.Warning, msg)

if E is None:
    checkData = False
    msg = "input 'E' failed to collect data"
    ghenv.Component.AddRuntimeMessage(gh.Kernel.GH_RuntimeMessageLevel.Warning, msg)

if G is None and v is None:
    checkData = False
    msg = "input 'G' or 'v' failed to collect data"
    ghenv.Component.AddRuntimeMessage(gh.Kernel.GH_RuntimeMessageLevel.Warning, msg)


if rho is None:
    checkData = False
    msg = "input 'rho' failed to collect data"
    ghenv.Component.AddRuntimeMessage(gh.Kernel.GH_RuntimeMessageLevel.Warning, msg)


if checkData != False:
    uniaxialMaterial = ElasticMaterial(matName, E, G, v, rho, fy)
# ---------- end python ----------

# ---- group: nDMaterial
python_2 = GhPythonScript(matName="S275", E="210000", G="80760", rho="75", fy="35")  # -> nDMaterial
# ---------- python_2: Python ----------
"""Generate a n-Dimensional Elastic Isotropic Material
    Inputs:
        matName: Name of the material.
        E: Young's Modulus [MPa].
        G: Tangential Modulus [MPa].
        v: Poisson ratio.
        rho: specific weight [kN/m3].
        fy: Yield stress value of the material [MPa]
    Output:
       nDMaterial: Material element.
       """


import Grasshopper as gh

def ElasticMaterial(matName, E, G, v, rho, fy):

    E = E * 1000                               # Input value in N/mm2 ---> Output kN/m2
    if v == None:
    	G = G * 1000                           # Input value in N/mm2 ---> Output kN/m2
    	v = (E / (2 * G)) - 1
    else:
    	G = E / (2 * (1 + v))

    rho = rho                                  # Force Density
    fy = fy                                    # Input value in N/mm2
    materialDimension = "nDMaterial"
    materialType = "ElasticIsotropic"
    matName = matName + "_" + materialDimension + "_" + materialType

    return [[matName, E, G, v, rho, fy, materialType]]

checkData = True

if matName is None:
    checkData = False
    msg = "input 'matName' failed to collect data"
    ghenv.Component.AddRuntimeMessage(gh.Kernel.GH_RuntimeMessageLevel.Warning, msg)

if E is None:
    checkData = False
    msg = "input 'E' failed to collect data"
    ghenv.Component.AddRuntimeMessage(gh.Kernel.GH_RuntimeMessageLevel.Warning, msg)


if G is None and v is None:
    checkData = False
    msg = "input 'G' or 'v' failed to collect data"
    ghenv.Component.AddRuntimeMessage(gh.Kernel.GH_RuntimeMessageLevel.Warning, msg)


if rho is None:
    checkData = False
    msg = "input 'rho' failed to collect data"
    ghenv.Component.AddRuntimeMessage(gh.Kernel.GH_RuntimeMessageLevel.Warning, msg)


if checkData != False:
    nDMaterial = ElasticMaterial(matName, E, G, v, rho, fy)
# ---------- end python_2 ----------

# ---- group: Rectangle Cross Section
python_3 = GhPythonScript(sectionName="RHS", base="300", height="300", uniaxialMaterial="Grasshopper.Kernel.Types.GH_ObjectWrapper")  # -> CrossSection
# ---------- python_3: Python ----------
"""Generate a Rectangular cross section
    Inputs:
        sectionName: Name of the section.
        base: Base of cross section [mm].
        height: Height of cross section [mm].
        uniaxialMaterial: Material element.
    Output:
       CrossSection: CrossSection element.
       """


import math
import Grasshopper as gh

def RectangularCrossSection(sectionName, base, height, uniaxialMaterial):
    
    sectionName = sectionName
    shape = "rectangular"
    base = base / 1000                      # Input value in mm ---> Output m
    height = height / 1000                  # Input value in mm ---> Output m
    Area = base * height
    Ay = Area * 5/6
    Az = Area * 5/6
    Iyy = base*pow(height,3)/12
    Izz = pow(base,3)*height/12
    if height < base:
        k = 1 / (3+4.1*pow((height/base),3/2))
        J = k*base*pow(height,3)
    else:
        k = 1 / (3+4.1*pow((base/height),3/2))
        J = k*height*pow(base,3)
    material = uniaxialMaterial

    return [[Area, Ay, Az, Iyy, Izz, J, material, [shape, base, height], sectionName ]]

checkData = True

if sectionName is None:
    checkData = False
    msg = "input 'sectionName' failed to collect data"
    ghenv.Component.AddRuntimeMessage(gh.Kernel.GH_RuntimeMessageLevel.Warning, msg)

if base is None:
    checkData = False
    msg = "input 'base' failed to collect data"
    ghenv.Component.AddRuntimeMessage(gh.Kernel.GH_RuntimeMessageLevel.Warning, msg)

if height is None:
    checkData = False
    msg = "input 'height' failed to collect data"
    ghenv.Component.AddRuntimeMessage(gh.Kernel.GH_RuntimeMessageLevel.Warning, msg)

if uniaxialMaterial is None:
    checkData = False
    msg = "input 'uniaxialMaterial' failed to collect data"
    ghenv.Component.AddRuntimeMessage(gh.Kernel.GH_RuntimeMessageLevel.Warning, msg)

if checkData != False:
    CrossSection = RectangularCrossSection(sectionName, base, height, uniaxialMaterial)
# ---------- end python_3 ----------

# ---- group: Circular Cross Section
python_4 = GhPythonScript(sectionName="CHS", diameter="400", thickness="40")  # -> CrossSection
#   port sectionName: Name of the section.
# ---------- python_4: Python ----------
a =2
# ---------- end python_4 ----------

# ---- group: Generic Cross Section
python_5 = GhPythonScript()  # -> CrossSection
# ---------- python_5: Python ----------
a = 2
# ---------- end python_5 ----------

# ---- group: Rectangle Hollow Cross Section
python_6 = GhPythonScript()  # -> CrossSection; same code as python_4

# ---- group: I Cross Section
python_7 = GhPythonScript()  # -> CrossSection; same code as python_5

# ---- group: Shell Cross Section
python_8 = GhPythonScript(sectionName="concreteSlab", thickness="700", nDMaterial="Grasshopper.Kernel.Types.GH_ObjectWrapper")  # -> CrossSection
# ---------- python_8: Python ----------
"""Generate a Plate cross section
    Inputs:
        sectionName: Name of the section.
        thickness: Height of the cross section [mm].
        nDMaterial: Material element.
    Output:
       CrossSection: Elastic Plate Section element.
       """

import math
import Grasshopper as gh

def ElasticMembranePlateSection(sectionName, thickness, nDMaterial):
    
    sectionName = sectionName
    thickness = thickness / 1000		# Input value in mm ---> Output m
    material = nDMaterial
    sectionType = "ElasticMembranePlateSection"
    sectionProperties = sectionName + "_" + sectionType
    return [[sectionProperties, thickness, material]]

checkData = True

if sectionName is None:
    checkData = False
    msg = "input 'sectionName' failed to collect data"
    ghenv.Component.AddRuntimeMessage(gh.Kernel.GH_RuntimeMessageLevel.Warning, msg)

if thickness is None:
    checkData = False
    msg = "input 'thickness' failed to collect data"
    ghenv.Component.AddRuntimeMessage(gh.Kernel.GH_RuntimeMessageLevel.Warning, msg)

if nDMaterial is None:
    checkData = False
    msg = "input 'nDMaterial' failed to collect data"
    ghenv.Component.AddRuntimeMessage(gh.Kernel.GH_RuntimeMessageLevel.Warning, msg)

if checkData != False:
    CrossSection = ElasticMembranePlateSection(sectionName, thickness, nDMaterial)
# ---------- end python_8 ----------

# ---- group: Line to Beam
python_9 = GhPythonScript(Line=[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], CrossSection="Grasshopper.Kernel.Types.GH_ObjectWrapper")  # -> beamWrapper; inputs Line: Curve; same code as python_5

# ---- group: Mesh to Shell
python_10 = GhPythonScript(Mesh=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, CrossSection="Grasshopper.Kernel.Types.GH_ObjectWrapper")  # -> shellWrapper; inputs Mesh: Mesh
# ---------- python_10: Python ----------
"""Generate a Shell MITC4 element
    Inputs:
        Mesh: QuadMesh representing the structural element.
        CrossSection: Cross section of the mesh.
        Colour: Colour of the element.
    Output:
       shellWrapper: Shell with properties.
       """


import Rhino.Geometry as rg
import Grasshopper as gh
from System.Drawing import Color 

def MeshToShell(Mesh, Colour, CrossSection):
    
    
    elementType = []
    if Mesh.Vertices.Count == 4:
        elementType = "ShellMITC4"
        if Colour is None:
            colour = Color.FromArgb(49, 159, 255)
        else:
            colour = Colour
    else:
        elementType = "shellDKGT"
        if Colour is None:
            colour = Color.FromArgb(49, 159, 255)
        else:
            colour = Colour
    newMesh = Mesh
    
    CrossSection = CrossSection
    return[ [ newMesh , elementType, CrossSection, colour] ]

checkData = True

if Mesh is None:
    checkData = False
    msg = "input 'Mesh' failed to collect data"
    ghenv.Component.AddRuntimeMessage(gh.Kernel.GH_RuntimeMessageLevel.Warning, msg)

if CrossSection is None:
    checkData = False
    msg = "input 'CrossSection' failed to collect data"
    ghenv.Component.AddRuntimeMessage(gh.Kernel.GH_RuntimeMessageLevel.Warning, msg)


if checkData != False:
    Mesh.Unweld(0, True)
    explodedMesh = Mesh.ExplodeAtUnweldedEdges()
    shellWrapper = []
    if explodedMesh.Length > 0:
        for mesh in explodedMesh:
            shellWrapper.append(MeshToShell(mesh, Colour, CrossSection))
    elif explodedMesh.Length == 0:
            shellWrapper.append(MeshToShell(Mesh, Colour, CrossSection))
# ---------- end python_10 ----------

# ---- group: Brick Element
python_11 = GhPythonScript(nDMaterial="Grasshopper.Kernel.Types.GH_ObjectWrapper")  # -> solidWrapper; inputs Brick: Mesh; same code as python_5

# ---- group: Support
python_12 = GhPythonScript()  # -> supportWrapper; inputs Pos: Point3d, Tx: Int32, Ty: Int32, Tz: Int32, Rx: Int32, Ry: Int32, Rz: Int32
# ---------- python_12: Python ----------
"""Generate support for the structure.
    Inputs:
        Pos: QuadMesh representing the structural element.
        Tx: Translation in X. TRUE if it is Fixed.
        Ty: Translation in Y. TRUE if it is Fixed.
        Tz: Translation in Z. TRUE if it is Fixed.
        Rx: Rotation about the X axis. TRUE if it is Fixed.
        Ry: Rotation about the Y axis. TRUE if it is Fixed.
        Rz: Rotation about the Z axis. TRUE if it is Fixed.
    Output:
       supportWrapper: Point with constraint properties.
       """

import Grasshopper as gh


def SupportWrapper(Pos, Tx, Ty, Tz, Rx, Ry, Rz):

    Pos = Pos

    Tx = int(False) if Tx is None else Tx
    Ty = int(False) if Ty is None else Ty
    Tz = int(False) if Tz is None else Tz
    Rx = int(False) if Rx is None else Rx
    Ry = int(False) if Ry is None else Ry
    Rz = int(False) if Rz is None else Rz

    return [[Pos, Tx, Ty, Tz, Rx, Ry, Rz]]

checkData = True

if checkData != False:
    supportWrapper = SupportWrapper(Pos, Tx, Ty, Tz, Rx, Ry, Rz)
# ---------- end python_12 ----------

# ---- group: Uniform Distributed Load
python_13 = GhPythonScript()  # -> beamUniformLoad; inputs Force: Vector3d, Element: Curve, Orientation: Int32; unedited script template

# ---- group: Point Load
python_14 = GhPythonScript(Force=Point(0, 0, 0), Moment=Point(0, 0, 0))  # -> LoadWrapper; inputs Force: Vector3d, Moment: Vector3d, Pos: Point3d
# ---------- python_14: Python ----------
import Rhino.Geometry as rg

def pointLoad(Force=rg.Vector3d(0, 0, 0), Moment=rg.Vector3d(0, 0, 0), Pos = None):

    Pos = Pos
    Force = Force                  # Input value in kN ---> Output kN
    Moment = Moment 			   # Input value in kNm ---> Output kNm
    loadType = "pointLoad"

    return [[Pos, Force, Moment, loadType]]


LoadWrapper = pointLoad(Force, Moment, Pos)
# ---------- end python_14 ----------

# ---- group: Mass Point
python_15 = GhPythonScript()  # -> Mass; inputs Pos: Point3d; unedited script template

# ---- group: Disassemble Model
python_16 = GhPythonScript()  # -> ModelView, ModelViewExtruded, Points, Support, Load, Material, Section; inputs AlpacaModel: list
#   port AlpacaModel: Output of Assemble Model.
# ---------- python_16: Python ----------
a =1
# ---------- end python_16 ----------

# ---- group: Assemble Model
python_17 = GhPythonScript()  # -> out, AlpacaModel, MassOfStructure; inputs Element: list, Support: list, Load: list, Mass: list; same code as python_5

# ---- group: Ground Motion Analyses
analyze = GhPythonScript(GroundMotionFactor=1, Damping=0.02, NewmarkGamma=0.5, NewmarkBeta=0.25)  # -> AlpacaGroundmotionOutput, maxDisplacement, minDisplacement; inputs AlpacaModel: list, GroundMotionDirection: Int32, GroundMotionValues: list, GroundMotionTimeStep: list; same code as python_5

# ---- group: Modal Analyses
analyze_2 = GhPythonScript()  # -> AlpacaModalOutput, frequency, period; inputs AlpacaModel: list, numVibrationModes: Int32; same code as python_5

# ---- group: Static Analyses
analyze_3 = GhPythonScript()  # -> AlpacaStaticOutput; inputs AlpacaModel: list; same code as python_4

# ----
ghpython_script = GhPythonScript()  # -> ModelCurve, ModelShell, ModelSolid; inputs openSeesOutputWrapper: list, numberMode: Int32, Animate: Boolean, Reset: Boolean; same code as python_5
python_18 = GhPythonScript()  # -> ModelCurve, ModelShell, ModelSolid; inputs AlpacaStaticOutput: list; same code as python_5

# ---- group: Disassemble Model
python_19 = GhPythonScript()  # -> modelView, lineModel, forceDisplay, support, localAxis, tagNode, tagEle, Mass; inputs AlpacaModel: list, modelExstrud: Boolean, Load: Boolean, Support: Boolean, LocalAxes: Boolean, nodeTag: Boolean, elementTag: Boolean, nodalMass: Boolean; same code as python_5

# ----
python_20 = GhPythonScript()  # -> tagPoints, ReactionForce, ReactionMoment; inputs AlpacaStaticOutput: list; same code as python_5
python_21 = GhPythonScript()  # -> Points, Trans, Rot; inputs AlpacaStaticOutput: list; same code as python_5
python_22 = GhPythonScript()  # -> tagElement, N, V1, V2, Mt, M1, M2; inputs AlpacaStaticOutput: list, numberResults: Int32; same code as python_5
python_23 = GhPythonScript()  # -> tagElement, localTrans, localRot, globalTrans, globalRot; inputs AlpacaStaticOutput: list, numberResults: Int32; same code as python_5
python_24 = GhPythonScript()  # -> tagElement, Trans, Rot; inputs AlpacaStaticOutput: list; same code as python_5
python_25 = GhPythonScript()  # -> shell, stressValue; inputs AlpacaStaticOutput: list, stressView: Int32; same code as python_5
python_26 = GhPythonScript()  # -> tagElement, Fx, Fy, Fz, Mx, My, Mz; inputs AlpacaStaticOutput: list; same code as python_5
python_27 = GhPythonScript()  # -> tagElement, Trans; inputs AlpacaStaticOutput: list; same code as python_5
python_28 = GhPythonScript()  # -> brick, stressValue; inputs AlpacaStaticOutput: list, stressView: Int32; same code as python_5
